# Grasshopper definition Collaboration table GH defintion.gh (Grasshopper 0.9.76)
# Copyright: Co-de-iT
# plug-ins: LocalCode, Firefly.X, Kangaroo Components, setFlounderCamera, Weaverbird, Firefly.Core

number_slider = Slider(300, range=0..1000)
srf = Surface([<surface referenced from the Rhino model> x6])
dim = Dimensions(Surface=srf)  # -> UDimension, VDimension
number_slider_2 = Slider(0.1, range=0..0.1)
division = Division(A=dim.VDimension, B=Slider(71, range=0..100))
series = Series(Start=0, Step=Slider(0.3, range=0..1), Count=Slider(42, range=0..100))
pt = ConstructPoint(XCoordinate=0, YCoordinate=series, ZCoordinate=0)
iso = IsoCurve(Surface=graft(srf), UVPoint=pt)  # -> UIsocurve, VIsocurve
flatten = FlattenTree(Tree=iso.UIsocurve, Path="{0}")
dispatch = Dispatch(List=flatten, DispatchPattern=[True, False])  # -> ListA, ListB
flip = FlipCurve(Curve=dispatch.ListB)  # -> Curve, Flag
weave = Weave(Pattern=[0, 1], Stream0=dispatch.ListA, Stream1=flip.Curve, NullGaps=False)
end = EndPoints(Curve=weave)  # -> Start, End
shift = ShiftList(List=end.Start, Shift=1, Wrap=False)
shift_2 = ShiftList(List=end.End, Shift=-1, Wrap=False)
ln = Line(StartPoint=shift, EndPoint=shift_2)
attempt_to_make_offset_mesh_with_evenly = BooleanToggle(True)  # "Attempt to make offset mesh with evenly sized polygons"
join = JoinCurves(Curves=flatten([weave, ln]), Preserve=False)
enable_laser_stream = BooleanToggle(True)
overhang_degree_threshold = Slider(75, range=5..90)
crv = Curve(join)
support_spacing_distance = Slider(5, range=2..10)
use_end_mill_for_cutout = BooleanToggle(False)
support_diameter = Slider(0.8, range=0.4..2)
rebuild_slice_curves = BooleanToggle(True)
sample_reolution = Slider(0.5, range=0..1)
slice_at_full_depth = BooleanToggle(True)
edge_fade_distnce = Slider(4, range=0..100)
cutout_tolerance = Slider(0, range=-0.5..0.5)
layer_height = Slider(0.1, range=0.05..0.2)
cutout_to_full_material_depth = BooleanToggle(False)
cut_depth_line_engrave = Slider(0, range=0..20)
milling_bit_diameter = Slider(6, range=0..10)
deviation_tolerance = Slider(0.02, range=0.02..0.1)
custom_jog_home_x = Slider(800, range=0..2440)
custom_jog_home_y = Slider(625, range=0..1000)
cut_depth_pocket = Slider(2, range=0..25)
pass_depth = Slider(20, range=0.5..20)
cut_depth_cutout = Slider(20, range=0.2..45)
# Fix project to cplaen or check if flat
# 
# Fix pocket bit offset - make tool diam based?
# 
# Make pocket go full depth per pocket
# 
# Make tabs based on z0?
# Add angled cut functions - input = two curves
# Add basic 3D milling - roughing and finsihing
cutout_tolerance_2 = Slider(0, range=-0.5..0.5)
breps_for_3d_mill = Brep()
pocket_stepover = Slider(0.8, range=0..1)
make_flea_jump_transitions = BooleanToggle(False)
meshes_for_3d_mill = Mesh()
pipeline = GeometryPipeline(
    GroupByLayer=False,
    GroupByType=False,
    IncludeHidden=True,
    IncludeLocked=True,
    LayerFilter="CNC 3D",
    NameFilter="*",
    TypeFilter=1073741848)
plunge_rate = Slider(25, range=6..25)
pipeline_2 = GeometryPipeline(
    GroupByLayer=False,
    GroupByType=False,
    IncludeHidden=True,
    IncludeLocked=True,
    LayerFilter="CNC 3D",
    NameFilter="*",
    TypeFilter=32)
connect_toolpaths_levels = BooleanToggle(True)
feed_rate = Slider(25, range=6..150)
number_slider_3 = Slider(10, range=0..10)
ramp_angle = Slider(30, range=0..100)
spindle_speed = Slider(18000, range=6000..18000)
# Make max depth value
# Make use cutout for last roughing pass boolean
# Fix roughing selection pattern
generate_roughing = BooleanToggle(False)
generate_finishing = BooleanToggle(True)
raster_direction_along_y = BooleanToggle(False)
generate_cutout = BooleanToggle(False)
cnc_pocket_curves = Curve()
cnc_cutout_curves = Curve()
cnc_hold_down_curves = Curve()
cnc_line_engrave_curves = Curve()
tab_breps = Brep()
pipeline_3 = GeometryPipeline(
    GroupByLayer=False,
    GroupByType=False,
    IncludeHidden=True,
    IncludeLocked=True,
    LayerFilter="CNC line engrave",
    NameFilter="*",
    TypeFilter=4)
use_custom_jog_home = BooleanToggle(True)
pipeline_4 = GeometryPipeline(
    GroupByLayer=False,
    GroupByType=False,
    IncludeHidden=True,
    IncludeLocked=True,
    LayerFilter="CNC hold down",
    NameFilter="*",
    TypeFilter=4)
pipeline_5 = GeometryPipeline(
    GroupByLayer=False,
    GroupByType=False,
    IncludeHidden=True,
    IncludeLocked=True,
    LayerFilter="CNC pocket",
    NameFilter="*",
    TypeFilter=4)
pipeline_6 = GeometryPipeline(
    GroupByLayer=False,
    GroupByType=False,
    IncludeHidden=True,
    IncludeLocked=True,
    LayerFilter="CNC cut",
    NameFilter="*",
    TypeFilter=4)
pipeline_7 = GeometryPipeline(
    GroupByLayer=False,
    GroupByType=False,
    IncludeHidden=True,
    IncludeLocked=True,
    LayerFilter="CNC tabs",
    NameFilter="*",
    TypeFilter=1073741848)
use_climb_direction = BooleanToggle(False)
safe_z = Slider(6, range=0..20)
use_inside_cutting = BooleanToggle(False)
ramp_plunges = BooleanToggle(False)
attempt_to_make_offset_mesh_with_evenly_2 = Panel(attempt_to_make_offset_mesh_with_evenly)  # "Attempt to make offset mesh with evenly sized polygons"
use_spindle = BooleanToggle(True)
crv_2 = Curve(<curve referenced from the Rhino model>)
camera_height_factor = Slider(2.29, range=1.6..2.3)
_3d_view_rotation_z = Slider(63, range=10..170)
_3d_view_rotation = Slider(0, range=0..360)

pt_2 = ConstructPoint(XCoordinate=0, YCoordinate=0, ZCoordinate=0)
pt_3 = ConstructPoint(XCoordinate=0, YCoordinate=0, ZCoordinate="0.01")
ln_2 = Line(StartPoint=pt_2, EndPoint=pt_3)
short_curve_for_making_empty_layer = Curve(ln_2)

# ---- group: 3D CNC mill - Slice quality settings
rebuild_slice_curves_for_increased_resol = Panel(rebuild_slice_curves)  # "Rebuild slice curves for increased resolution"
rebuild_curve_resolution = Panel("1")
slice_at_full_depth_2 = Panel(slice_at_full_depth)

# ----
pipeline_8 = GeometryPipeline(
    GroupByLayer=False,
    GroupByType=False,
    IncludeHidden=True,
    IncludeLocked=True,
    LayerFilter="Laser engrave",
    NameFilter="*",
    TypeFilter=1073741884)
pipeline_9 = GeometryPipeline(
    GroupByLayer=False,
    GroupByType=False,
    IncludeHidden=True,
    IncludeLocked=True,
    LayerFilter="Laser cut",
    NameFilter="*",
    TypeFilter=4)

# ---- group: SLA support settings
support_start_height = Panel("4.8")
support_spacing_distance_2 = Panel(support_spacing_distance)
support_diameter_2 = Panel(support_diameter)
overhang_degree_threshold_2 = Panel(overhang_degree_threshold)
foundation_plate_thickness = Panel("0.5")
release_tab_length = Panel("4")
release_tab_angle = Panel("30")

# ---- group: 3D CNC mill - Cutout settings
cutout_tolerance_3 = Panel(cutout_tolerance)
cutout_to_full_material_depth_2 = Panel(cutout_to_full_material_depth)
material_thickness = Panel("19")
extra_cut_depth = Panel("0.5")

# ---- group: SLA slice settings
layer_height_2 = Panel(layer_height)
gradient_sample_resolution = Panel(sample_reolution)
edge_fade_count = Panel(edge_fade_distnce)

# ---- group: 3D CNC mill settings
roughing_material_leftover = Panel("0.5")
generate_finishing_2 = Panel(generate_finishing)
generate_roughing_2 = Panel(generate_roughing)
generate_cutout_2 = Panel(generate_cutout)
finishing_stepover = Panel("0.05")
roughing_stepover = Panel("0.6")

# ----
cycle_view = Button()

# ---- group: 3D CNC mill - Advanced slice quality settings
curve_sample_slice_reduction = Panel("2")
reduction_tolerance = Panel("0.02")
top_layer_pocket_threshold = Panel("5")
inital_sample_slice_spacing = Panel("1")
sample_top_value_percentage = Panel("0.25")
top_slice_thickness = Panel("0.01")
vertical_angle_cutoff = Panel("89")
max_angle_limit = Panel("1")
lowes_slice_leftover_thickness = Panel("0.01")

# ---- group: SLA 3D print input geometry
# fix - slice objects true triggers camera to be set to 1:1 location
pipeline_10 = GeometryPipeline(
    GroupByLayer=False,
    GroupByType=False,
    IncludeHidden=True,
    IncludeLocked=True,
    LayerFilter="SLA 3D print",
    NameFilter="*",
    TypeFilter=1073741848)
pipeline_11 = GeometryPipeline(
    GroupByLayer=False,
    GroupByType=False,
    IncludeHidden=True,
    IncludeLocked=True,
    LayerFilter="SLA 3D print",
    NameFilter="*",
    TypeFilter=32)

# ----
button = Button()  # "2D/3D"
generate_suport = BooleanToggle(True)
connect_toolpath_tolerance_factor = Panel("2")

# ---- group: 2D CNC mill settings
milling_bit_diameter_2 = Panel(milling_bit_diameter)
feed_rate_2 = Panel(feed_rate)
plunge_rate_2 = Panel(plunge_rate)
cut_depth_pocket_2 = Panel(cut_depth_pocket)
pass_depth_2 = Panel(pass_depth)
cut_depth = Panel(cut_depth_cutout)
cut_depth_line_engrave_2 = Panel(cut_depth_line_engrave)

# ---- group: 3D CNC mill input geometry
meshes_for_3d_mill_2 = Mesh([pipeline_2, meshes_for_3d_mill])
breps_for_3d_mill_2 = Brep([pipeline, breps_for_3d_mill])

# ---- group: Advanced 2D CNC mill settings
cutout_tolerance_4 = Panel(cutout_tolerance_2)
ramp_plunges_2 = Panel(ramp_plunges)
ramp_angle_2 = Panel(ramp_angle)
pocket_stepover_2 = Panel(pocket_stepover)
raster_direction_along_y_2 = Panel(raster_direction_along_y)
use_inside_cutting_2 = Panel(use_inside_cutting)
use_climb_direction_2 = Panel(use_climb_direction)

# ----
explode = Explode(Curve=crv_2, Recursive=True)  # -> Segments, Vertices
make_flea_jump_transitions_2 = Integer(make_flea_jump_transitions)

# ---- group: PostProcessor settings
job_name = Panel("Bark beetle stream")
safe_z_height = Panel(safe_z)
use_spindle_2 = Panel(use_spindle)
spindle_speed_2 = Panel(spindle_speed)
use_custom_jog_home_2 = Panel(use_custom_jog_home)
custom_jog_home_x_2 = Panel(custom_jog_home_x)
custom_jog_home_y_2 = Panel(custom_jog_home_y)
deviation_tolerance_2 = Panel(deviation_tolerance)

# ----
timer = Timer(TimerInterval=2, Target=[counter_2, counter])  # disabled
explode_2 = Explode(Curve=crv_2, Recursive=True)  # -> Segments, Vertices
connect_toolpaths_levels_2 = Integer(connect_toolpaths_levels)
slice_object = BooleanToggle(False)

# ---- group: 2D CNC mill input geometry
tab_breps_2 = Brep([pipeline_7, tab_breps])
cnc_pocket_curves_2 = Curve([pipeline_5, cnc_pocket_curves])
cnc_line_engrave_curves_2 = Curve([pipeline_3, cnc_line_engrave_curves])
cnc_hold_down_curves_2 = Curve([pipeline_4, cnc_hold_down_curves])
cnc_cutout_curves_2 = Curve([pipeline_6, cnc_cutout_curves])

# ----
list = ValueList({"One": 1, "Two": 2, "Three": 2² - 1, "Four": Sqrt(16)}, selected="Two")
series_2 = Series(Start=0, Step=number_slider_3, Count=Slider(4, range=0..10))
list_2 = ValueList({"One": 1, "Two": 2, "Three": 2² - 1, "Four": Sqrt(16)}, selected="Three")
list_3 = ValueList({"One": 1, "Two": 2, "Three": 2² - 1, "Four": Sqrt(16)}, selected="One")
laser_engrave = Geometry(pipeline_8)
laser_cut = Curve(pipeline_9)

laser_and_cnc_bed = Curve(<curve referenced from the Rhino model>)
sla_3d_print_bed = Curve(<curve referenced from the Rhino model>)
fff_3d_print_bed = Curve(<curve referenced from the Rhino model>)
Y = UnitY(Factor=Slider(63, range=50..450))
Y_2 = UnitY(Factor=Slider(11, range=0..450))
Y_3 = UnitY(Factor=Slider(406, range=350..450))
move = Move(Geometry=fff_3d_print_bed, Motion=Y)  # -> Geometry, Transform
move_2 = Move(Geometry=sla_3d_print_bed, Motion=Y_2)  # -> Geometry, Transform
move_3 = Move(Geometry=laser_and_cnc_bed, Motion=Y_3)  # -> Geometry, Transform
area = Area(Geometry=flatten(move_3.Geometry))  # -> Area, Centroid
dim_2 = Dimensions(Surface=flatten(move_3.Geometry))  # -> UDimension, VDimension
area_2 = Area(Geometry=flatten(move.Geometry))  # -> Area, Centroid
dim_3 = Dimensions(Surface=flatten(move.Geometry))  # -> UDimension, VDimension
area_3 = Area(Geometry=flatten(move_2.Geometry))  # -> Area, Centroid
dim_4 = Dimensions(Surface=flatten(move_2.Geometry))  # -> UDimension, VDimension
multiplication = Multiplication(A=dim_2.VDimension, B=camera_height_factor)
multiplication_2 = Multiplication(A=dim_4.VDimension, B=camera_height_factor)
multiplication_3 = Multiplication(A=dim_3.VDimension, B=camera_height_factor)
Z = UnitZ(Factor=multiplication)
Z_2 = UnitZ(Factor=multiplication_2)
Z_3 = UnitZ(Factor=multiplication_3)
move_4 = Move(Geometry=area.Centroid, Motion=Z)  # -> Geometry, Transform
move_5 = Move(Geometry=area_3.Centroid, Motion=Z_2)  # -> Geometry, Transform
move_6 = Move(Geometry=area_2.Centroid, Motion=Z_3)  # -> Geometry, Transform

item = ListItem(List=explode.Segments, Index=0, Wrap=True)
item_2 = ListItem(List=explode.Segments, Index=list, Wrap=True)
item_3 = ListItem(List=explode_2.Segments, Index=list_3, Wrap=True)
item_4 = ListItem(List=explode_2.Segments, Index=list_2, Wrap=True)
smooth = SettingsQuality()
mesh = Mesh(pipeline_11)
divlength = DivideLength(Curve=item, Length=number_slider_3)  # -> Points, Tangents, Parameters
divlength_2 = DivideLength(Curve=item_3, Length=number_slider_3)  # -> Points, Tangents, Parameters
mesh_2 = MeshBrep(Brep=pipeline_10, Settings=smooth)
pass_depth_roughing_and_cutout = Number(pass_depth_2)
milling_bit_diameter_3 = Number(milling_bit_diameter_2)
int = Integer()
int_2 = Integer()
int_3 = Integer()
num = Number()
num_2 = Number()
# E:\Projects\Toolpaths\BarkBeetle\Networked fabrication\Stream testing\Laser test stream\laserstream_engrave.3dm
panel = Panel("\\FELLES-LASER\Users\Public\Test stream\laserstream_engrave.3dm")
# E:\Projects\Toolpaths\BarkBeetle\Networked fabrication\Stream testing\Laser test stream\laserstream_cut.3dm
panel_2 = Panel("Laser cut stream")
meshes_for_3d_mill_3 = Mesh(meshes_for_3d_mill_2)
num_3 = Number()
panel_3 = Panel("\\FELLES-LASER\Users\Public\Test stream\laserstream_cut.3dm")
breps_for_3d_mill_3 = Brep(breps_for_3d_mill_2)
crv_cp = CurveClosestPoint(Point=divlength.Points, Curve=item_2)  # -> Point, Parameter, Distance
crv_cp_2 = CurveClosestPoint(Point=divlength_2.Points, Curve=item_4)  # -> Point, Parameter, Distance
swatch = ColourSwatch(SwatchColor=RGB(117, 117, 117))
swatch_2 = ColourSwatch(SwatchColor=RGB(138, 90, 90))
mjoin = MeshJoin(Meshes=flatten([mesh_2, mesh]))
ln_3 = Line(StartPoint=divlength.Points, EndPoint=crv_cp.Point)
ln_4 = Line(StartPoint=divlength_2.Points, EndPoint=crv_cp_2.Point)
neg = Negative(Value=Slider(20, range=0..100))
neg_2 = Negative(Value=series_2)
material = CreateMaterial(Diffuse=swatch_2, Specular=RGB(255, 255, 255), Emission=RGB(0, 0, 0), Transparency=0, Shine=0)
material_2 = CreateMaterial(Diffuse=swatch, Specular=RGB(255, 255, 255), Emission=RGB(0, 0, 0), Transparency=0, Shine=0)
localcodeexport = LocalCodeExport(
    DestinationFilePath=panel_3,
    Export=enable_laser_stream,
    LayerNames=panel_2,
    LayerColors=swatch_2,
    GeometryTree=[laser_cut, short_curve_for_making_empty_layer])
localcodeexport_2 = LocalCodeExport(
    DestinationFilePath=panel,
    Export=enable_laser_stream,
    LayerNames="Laser engrave stream",
    LayerColors=swatch,
    GeometryTree=[laser_engrave, short_curve_for_making_empty_layer])
Z_4 = UnitZ(Factor=neg)
crv_3 = Curve([ln_3, ln_4])
Z_5 = UnitZ(Factor=neg_2)
preview = CustomPreview(Geometry=laser_cut, Shader=material)
preview_2 = CustomPreview(Geometry=laser_engrave, Shader=material_2)
panel_4 = Panel(localcodeexport)
panel_5 = Panel(localcodeexport_2)
move_7 = Move(Geometry=crv_3, Motion=graft(Z_5))  # -> Geometry, Transform
filter = StreamFilter(Gate=generate_suport, Stream1=mjoin)
move_8 = Move(Geometry=crv_3, Motion=graft(Z_4))  # -> Geometry, Transform

mesh_for_sla_print = Mesh(filter)
bbox = BoundingBox(Content=mesh_for_sla_print, Plane=PlaneXY(0, 0, 0), UnionBox=True)  # -> Box, Box_2
debrep = DeconstructBrep(Brep=bbox.Box)  # -> Faces, Edges, Vertices
support_start_height_2 = Panel(support_start_height)
support_spacing_distance_3 = Panel(support_spacing_distance_2)
item_5 = ListItem(List=debrep.Faces, Index="10", Wrap=True)
neg_3 = Negative(Value=support_start_height_2)
area_4 = Area(Geometry=item_5)  # -> Area, Centroid
xy = XYPlane(Origin=area_4.Centroid)
Z_6 = UnitZ(Factor=neg_3)
move_9 = Move(Geometry=xy, Motion=Z_6)  # -> Geometry, Transform
build_platform_plane = Plane(move_9.Geometry)
mshadow = MeshShadow(Mesh=mesh_for_sla_print, Light=Vector(0, 0, -1), Plane=build_platform_plane)
divide_curve_even_lenght = DivideCurveEvenLenght(crv=mshadow, B=support_spacing_distance_3)
pline = PolyLine(Vertices=divide_curve_even_lenght, Closed=Toggle(True))

number_slider_4 = Slider(25, range=0..100)
counter = Counter(Reset=button)
dom = ConstructDomain(DomainStart=Slider(0, range=0..100), DomainEnd=number_slider_4)
constrain = Constrain(Number=counter, Domain=dom)
panel_6 = Panel(constrain)
subtraction = Subtraction(A=number_slider_4, B=panel_6)
division_2 = Division(A=subtraction, B=number_slider_4)
graph = GraphMapper(division_2, x0=0, x1=1, y0=0, y1=1, container_name="Bezier", cpx=[0, 0.3626089692, 0.494587332, 1], cpy=[0, 0, 1, 1])

crv_4 = Curve(crv_3)
preview_3 = CustomPreview(Geometry=crv_4, Shader=ColourSwatch(SwatchColor=RGB(0, 26, 33)))

number_slider_5 = Slider(25, range=0..100)
counter_2 = Counter(Reset=cycle_view)
dom_2 = ConstructDomain(DomainStart=Slider(0, range=0..100), DomainEnd=number_slider_5)
constrain_2 = Constrain(Number=counter_2, Domain=dom_2)
panel_7 = Panel(constrain_2)
subtraction_2 = Subtraction(A=number_slider_5, B=panel_7)
division_3 = Division(A=subtraction_2, B=number_slider_5)
graph_2 = GraphMapper(division_3, x0=0, x1=1, y0=0, y1=1, container_name="Bezier", cpx=[0, 0.3626089692, 0.494587332, 1], cpy=[0, 0, 1, 1])

pt_4 = Point(flatten([move_4.Geometry, move_6.Geometry, move_5.Geometry]))
pt_5 = Point(flatten([area.Centroid, area_2.Centroid, area_3.Centroid]))
pline_2 = PolyLine(Vertices=pt_5, Closed=False)
pline_3 = PolyLine(Vertices=pt_4, Closed=False)
detect = StateDetection(Value=cycle_view, Modulo=3)  # -> CurrentState, Counter
disc = Discontinuity(Curve=pline_2, Level=2)  # -> Points, Parameters
panel_8 = Panel(detect.Counter)
item_6 = ListItem(List=disc.Parameters, Index=panel_8, Wrap=True)
subtraction_3 = Subtraction(A=item_6, B=graph_2)
smaller = SmallerThan(FirstNumber=subtraction_3, SecondNumber=Slider(0, range=0..100))  # -> SmallerThan, OrEqualTo
lng = ListLength(List=pt_5)
subtraction_4 = Subtraction(A=lng, B=Slider(1, range=0..1))
multiplication_4 = Multiplication(A=subtraction_3, B=subtraction_4)
neg_4 = Negative(Value=multiplication_4)
filter_2 = StreamFilter(Gate=smaller.SmallerThan, Stream0=subtraction_3, Stream1=neg_4)
eval = EvaluateCurve(Curve=pline_2, Parameter=filter_2)  # -> Point, Tangent, Angle
eval_2 = EvaluateCurve(Curve=pline_3, Parameter=filter_2)  # -> Point, Tangent, Angle
yz = YZPlane(Origin=eval.Point)
xy_2 = XYPlane(Origin=eval.Point)

multiplication_5 = Multiplication(A=milling_bit_diameter_3, B=finishing_stepover)
multiplication_6 = Multiplication(A=milling_bit_diameter_3, B=roughing_stepover)
multiplication_7 = Multiplication(A=milling_bit_diameter_3, B="0.5")
custom_mesh_settings = SettingsCustom(
    StitchSeams=True,
    SimplePlanes=False,
    Refine=True,
    MinCount=16,
    MaxCount=400,
    AspectRatio=20,
    MaxDistance=0,
    MaxAngle=20,
    MinEdge=0,
    MaxEdge=0)
smooth_2 = SettingsQuality()
jagged = SettingsSpeed()
stepover_distance_roughing = Panel(multiplication_6)
milling_bit_radius = Panel(multiplication_7)
stepover_distance = Panel(multiplication_5)
mesh_3 = MeshBrep(Brep=breps_for_3d_mill_3, Settings=smooth_2)
# Horizontal slice from bottom.
# Start with tool dimater spacing.
# Evalute max angle of surface between slices.
# Generate additional slices based on inclination
# make guide graph with points position from average inclination of slices
# (average of top 25%)
# 
# cull sampling points colliding with mesh
# 
# rebuild graph with even distance for slice density positions
# 
# pocket last top 0.1mm slice if needed
filter_3 = StreamFilter(Gate=use_end_mill_for_cutout, Stream0=milling_bit_radius)
merge = Merge(Data1=flatten(mesh_3), Data2=flatten(meshes_for_3d_mill_3))
addition = Addition(A=filter_3, B=extra_cut_depth)
measured_projected_size = Slider(263, range=0..1000)
expected_projected_size = Slider(300, range=0..1000)
flatten_2 = FlattenTree(Tree=merge, Path="{0}")
rotation_correction = Slider(-0.01, range=-0.1..0.1)
position_correction_x = Slider(14, range=0..100)
position_correction_y = Slider(3, range=-10..10)
meshes_for_3d_milling = Mesh(flatten_2)
mesh_4 = Mesh(meshes_for_3d_milling)  # disabled
xy_3 = XYPlane(Origin=Point(0, 0, 0))
xz = XZPlane(Origin=Point(0, 0, 0))
cutting_curves = Curve(cnc_cutout_curves_2)
pocket_curves = Curve(cnc_pocket_curves_2)
faceb = FaceBoundaries(Mesh=mesh_4)
demesh = DeconstructMesh(Mesh=mesh_4)  # -> Vertices, Faces, Colours, Normals
x_tremez = Extremes(Curve=faceb, Plane=xy_3)  # -> Highest, Lowest
panel_9 = Panel(graph)
Z_7 = UnitZ(Factor=1)
pdecon = Deconstruct(Point=x_tremez.Highest)  # -> XComponent, YComponent, ZComponent
pdecon_2 = Deconstruct(Point=x_tremez.Lowest)  # -> XComponent, YComponent, ZComponent
planar = Planar(Curve=faceb)  # -> Planar, Plane, Deviation
rad = Radians(Degrees=Slider(21, range=0..100))
pt_6 = ConstructPoint(XCoordinate=0, YCoordinate=0, ZCoordinate=pdecon.ZComponent)
pt_7 = ConstructPoint(XCoordinate=0, YCoordinate=0, ZCoordinate=pdecon_2.ZComponent)
deplane = DeconstructPlane(Plane=planar.Plane)  # -> Origin, XAxis, YAxis, ZAxis
angle = Angle(VectorA=deplane.ZAxis, VectorB=Z_7)  # -> Angle, Reflex
dist = Distance(PointA=pt_6, PointB=pt_7)
mesh_for_sla_print_2 = Mesh(mjoin)
larger = LargerThan(FirstNumber=angle.Angle, SecondNumber=rad)  # -> LargerThan, OrEqualTo

# ---- group: Align curve directions
curves_for_aligned_direction = Curve(pline)
graft = GraftTree(Tree=curves_for_aligned_direction, IncludeEmptyLists=True, IncludeNullItems=True)
offset = Offset(Curve=graft, Distance="0.01", Plane=PlaneXY(0, 0, 0), Corners=2)
end_2 = EndPoints(Curve=offset)  # -> Start, End
pshift = ShiftPaths(Data=end_2.Start, Offset=-1)
incurve = PointInCurve(Point=pshift, Curve=graft)  # -> Relationship, Point
multiplication_8 = Multiplication(A=incurve.Relationship, B="0.5")
round = Round(Number=multiplication_8)  # -> Nearest, Floor, Ceiling
crv_5 = Curve(graft)
int_4 = Integer(round.Nearest)
flip_2 = FlipCurve(Curve=crv_5)  # -> Curve, Flag
weave_2 = Weave(Pattern=int_4, Stream0=flip_2.Curve, Stream1=crv_5, NullGaps=False)
pshift_2 = ShiftPaths(Data=weave_2, Offset=-1)
aligned_curves = Curve(pshift_2)

# ----
dispatch_2 = Dispatch(List=faceb, DispatchPattern=larger.LargerThan)  # -> ListA, ListB
mjoin_2 = MeshJoin(Meshes=meshes_for_3d_milling)
crv_6 = Curve(dispatch_2.ListB)
xy_4 = XYPlane(Origin=Point(0, 0, 0))
bbox_2 = BoundingBox(Content=meshes_for_3d_milling, Plane=PlaneXY(0, 0, 0), UnionBox=False)  # -> Box, Box_2
project = Project(Geometry=crv_6, Plane=xy_4)  # -> Geometry, Transform
runion = RegionUnion(Curves=project.Geometry)
debrep_2 = DeconstructBrep(Brep=bbox_2.Box)  # -> Faces, Edges, Vertices
bbox_3 = BoundingBox(Content=meshes_for_3d_milling, Plane=PlaneXY(0, 0, 0), UnionBox=False)  # -> Box, Box_2

meshes_without_offset = Mesh(meshes_for_3d_milling)
bbox_4 = BoundingBox(Content=meshes_without_offset, Plane=PlaneXY(0, 0, 0), UnionBox=False)  # -> Box, Box_2
debrep_3 = DeconstructBrep(Brep=bbox_4.Box)  # -> Faces, Edges, Vertices
item_7 = ListItem(List=debrep_3.Vertices, Index="4", Wrap=True)
top_slice_sample_thickness = Panel("0.01")
simplify = SimplifyTree(Tree=item_7, Front=False)
pdecon_3 = Deconstruct(Point=simplify)  # -> XComponent, YComponent, ZComponent
subtraction_5 = Subtraction(A=pdecon_3.ZComponent, B=top_slice_sample_thickness)
pt_8 = ConstructPoint(XCoordinate=pdecon_3.XComponent, YCoordinate=pdecon_3.YComponent, ZCoordinate=subtraction_5)
xy_5 = XYPlane(Origin=pt_8)
sec = MeshPlane(Mesh=graft(meshes_without_offset), Plane=xy_5)
top_layer_slice = Curve(sec)

Y_4 = UnitY(Factor=1)

detect_2 = StateDetection(Value=button, Modulo=2)  # -> CurrentState, Counter
panel_10 = Panel(detect_2.Counter)
larger_2 = LargerThan(FirstNumber=panel_10, SecondNumber=Slider(0, range=0..100))  # -> LargerThan, OrEqualTo
subtraction_6 = Subtraction(A=Slider(1, range=0..1), B=graph)
filter_4 = StreamFilter(Gate=larger_2.LargerThan, Stream0=graph, Stream1=subtraction_6)
Z_8 = UnitZ(Factor=1)
round_2 = Round(Number=filter_4)  # -> Nearest, Floor, Ceiling
multiplication_9 = Multiplication(A=_3d_view_rotation_z, B=filter_4)
filter_5 = StreamFilter(Gate=round_2.Ceiling, Stream0=Y_4, Stream1=Z_8)
panel_11 = Panel(multiplication_9)

cp = ControlPoints(Curve=runion)  # -> Points, Weights, Knots
item_8 = ListItem(List=debrep_2.Vertices, Index="0", Wrap=True)
item_9 = ListItem(List=debrep_2.Vertices, Index="4", Wrap=True)
debrep_4 = DeconstructBrep(Brep=bbox_3.Box)  # -> Faces, Edges, Vertices
xy_6 = XYPlane(Origin=item_9)
nurbs = NurbsCurve(Vertices=cp.Points, Degree=3, Periodic=False)  # -> Curve, Length, Domain
item_10 = ListItem(List=debrep_4.Vertices, Index="0", Wrap=True)
item_11 = ListItem(List=debrep_4.Vertices, Index="4", Wrap=True)
pshift_3 = ShiftPaths(Data=xy_6, Offset=-1)
dist_2 = Distance(PointA=item_11, PointB=item_10)
mshadow_2 = MeshShadow(Mesh=meshes_for_3d_milling, Light=Vector(0, 0, -1), Plane=pshift_3)
model_height = Panel(dist_2)
lng_2 = ListLength(List=mshadow_2)

rotate = Rotate(Geometry=eval_2.Point, Angle=degrees(panel_11), Plane=yz)  # -> Geometry, Transform
num_4 = Number(_3d_view_rotation)
rotate_2 = Rotate(Geometry=rotate.Geometry, Angle=degrees(num_4), Plane=xy_2)  # -> Geometry, Transform
enable_view_control = BooleanToggle(True)
int_5 = Integer(Slider(35, range=0..100))
syncfloundercamera = SyncFlounderCamera(
    Activate=enable_view_control,
    ViewportName="Fellesverkstedet",
    Location=rotate_2.Geometry,
    Target=eval.Point,
    Lens=int_5,
    Up=filter_5)

Z_9 = UnitZ(Factor=1)
cp_2 = ControlPoints(Curve=mshadow_2)  # -> Points, Weights, Knots
sort = SortList(Keys=flatten(lng_2))  # -> Keys, ValuesA
rev = Reverse(Vector=Z_9)
simplify_2 = SimplifyTree(Tree=model_height, Front=False)
item_12 = ListItem(List=sort.Keys, Index=0, Wrap=True)

milling_bit_diameter_4 = Panel(milling_bit_diameter_3)
top_layer_pocket_threshold_2 = Panel(top_layer_pocket_threshold)
multiplication_10 = Multiplication(A=milling_bit_diameter_4, B=top_layer_pocket_threshold_2)
top_layer_pocket_threshold_area = Panel(multiplication_10)
join_2 = JoinCurves(Curves=sec, Preserve=False)
item_13 = ListItem(List=join_2, Index=0, Wrap=True)
lng_3 = ListLength(List=join_2)
area_5 = Area(Geometry=item_13)  # -> Area, Centroid
larger_3 = LargerThan(FirstNumber=lng_3, SecondNumber="1")  # -> LargerThan, OrEqualTo
larger_4 = LargerThan(FirstNumber=area_5.Area, SecondNumber=top_layer_pocket_threshold_area)  # -> LargerThan, OrEqualTo
xor = GateXor(A=larger_3.LargerThan, B=larger_4.LargerThan)
skip_top_slices_boolean = Integer(xor)

cutout_to_full_material_depth_3 = Panel(cutout_to_full_material_depth_2)
meshray = MeshRay(Mesh=mjoin_2, Point=cp_2.Points, Direction=rev)  # -> Point, Hit
model_height_2 = Panel(simplify_2)
material_thickness_2 = Panel(material_thickness)
not = GateNot(A=item_12)
pline_4 = PolyLine(Vertices=meshray.Point, Closed=False)
failed_mesh_shadow_boolean = Panel(not)
# make grid?
slice_at_full_depth_boolean = Panel(slice_at_full_depth_2)
pshift_4 = ShiftPaths(Data=pline_4, Offset=-1)
filter_6 = StreamFilter(Gate=cutout_to_full_material_depth_3, Stream0=model_height_2, Stream1=material_thickness_2)
bbox_5 = BoundingBox(Content=pshift_4, Plane=PlaneXY(0, 0, 0), UnionBox=True)  # -> Box, Box_2
material_3 = CreateMaterial(
    Diffuse=ColourSwatch(SwatchColor=RGB(33, 108, 112)),
    Specular=RGB(255, 255, 255),
    Emission=RGB(0, 0, 0),
    Transparency=0,
    Shine=Slider(70, range=0..100))
top_slice_location_point = Point(item_9)
or = GateOr(A=slice_at_full_depth_boolean, B=failed_mesh_shadow_boolean)
debrep_5 = DeconstructBrep(Brep=bbox_5.Box)  # -> Faces, Edges, Vertices
cutout_depth = Panel(filter_6)
top_slice_thickness_2 = Panel(top_slice_thickness)
panel_12 = Panel(or)
item_14 = ListItem(List=debrep_5.Vertices, Index=0, Wrap=True)

# ---- group: Generate support points on lowes location on model
layer_height_3 = Panel(layer_height_2)
support_start_height_3 = Panel(support_start_height_2)
support_spacing_distance_4 = Panel(support_spacing_distance_3)
build_platform_plane_2 = Plane(build_platform_plane)
mesh_for_sla_print_3 = Mesh(filter)
multiplication_11 = Multiplication(A=layer_height_3, B="0.1")
offset_2 = Offset(Curve=aligned_curves, Distance=multiplication_11, Plane=PlaneXY(0, 0, 0), Corners=1)
boundary = BoundarySurfaces(Edges=offset_2)
mesh_5 = MeshBrep(
    Brep=boundary,
    Settings={GridMaxCount=0, GridMinCount=16, JaggedSeams=False, MaxEdgeLength=0, MinEdgeLength=0.0001, MinTolerance=0, Refine=True, RefineAngle=0, RelativeTolerance=0.65, SimplePlanes=True, Tolerance=0})
addition_2 = Addition(A=support_start_height_3, B="0.02")
Z_10 = UnitZ(Factor=addition_2)
move_10 = Move(Geometry=mesh_5, Motion=Z_10)  # -> Geometry, Transform
mmx = MeshMesh(MeshA=move_10.Geometry, MeshB=mesh_for_sla_print_3, UseMeshMeshFast=True)
divdist = DivideDistance(Curve=mmx, Distance=support_spacing_distance_4)  # -> Points, Tangents, Parameters
pt_9 = Point(divdist.Points)
multiplication_12 = Multiplication(A=support_spacing_distance_4, B="0.6")
pshift_5 = ShiftPaths(Data=pt_9, Offset=-1)
cullpt = CullDuplicates(Points=pshift_5, Tolerance=multiplication_12, CullMode=1)  # -> Points, Indices, Valence
simplify_3 = SimplifyTree(Tree=cullpt.Points, Front=False)
project_2 = Project(Geometry=simplify_3, Plane=build_platform_plane_2)  # -> Geometry, Transform
lowest_point_on_model_loactions = Point(project_2.Geometry)

# ---- group: Generate platfrom with release tap
boundary_curves = Curve(pline)
release_tab_length_2 = Panel(release_tab_length)
release_tab_angle_2 = Panel(release_tab_angle)
foundation_plate_thickness_2 = Panel(foundation_plate_thickness)
pshift_6 = ShiftPaths(Data=boundary_curves, Offset=-1)
runion_2 = RegionUnion(Curves=pshift_6)
lng_4 = ListLength(List=runion_2)
flatten_3 = FlattenTree(Tree=lng_4, Path="{0}")
sort_2 = SortList(Keys=flatten_3)  # -> Keys, ValuesA
smaller_2 = SmallerThan(FirstNumber=sort_2.Keys, SecondNumber="1")  # -> SmallerThan, OrEqualTo
filter_7 = StreamFilter(Gate=smaller_2.SmallerThan, Stream0=runion_2, Stream1=pshift_6)
crv_7 = Curve(filter_7)
explode_3 = Explode(Curve=crv_7, Recursive=True)  # -> Segments, Vertices
pshift_7 = ShiftPaths(Data=explode_3.Segments, Offset=-1)
boundary_2 = BoundarySurfaces(Edges=crv_7)
neg_5 = Negative(Value=release_tab_length_2)
Z_11 = UnitZ(Factor=foundation_plate_thickness_2)
item_15 = ListItem(List=explode_3.Segments, Index=0, Wrap=True)
offset_3 = Offset(Curve=item_15, Distance=neg_5, Plane=PlaneXY(0, 0, 0), Corners=1)
extr = Extrude(Base=boundary_2, Direction=Z_11)
pshift_8 = ShiftPaths(Data=offset_3, Offset=-1)
loft = Loft(
    Curves=[item_15, pshift_8],
    Options={Adjust=False, Closed=False, LoftEnds=0, LoftSimp=0, LoftType=0, Rebuild=10, Refit=0.01})
extr_2 = Extrude(Base=loft, Direction=Z_11)
rad_2 = Radians(Degrees=release_tab_angle_2)
rotax = RotateAxis(Geometry=extr_2, Angle=rad_2, Axis=item_15)  # -> Geometry, Transform
mesh_6 = MeshBrep(
    Brep=flatten([extr, rotax.Geometry]),
    Settings={GridMaxCount=0, GridMinCount=16, JaggedSeams=False, MaxEdgeLength=0, MinEdgeLength=0.0001, MinTolerance=0, Refine=True, RefineAngle=0, RelativeTolerance=0.65, SimplePlanes=True, Tolerance=0})
supprt_platform = Mesh(mesh_6)

# ----
support_diameter_3 = Panel(support_diameter_2)
filter_8 = StreamFilter(Gate=panel_12, Stream0=item_14, Stream1=item_8)
simplify_4 = SimplifyTree(Tree=top_slice_location_point, Front=False)
stepover_distance_2 = Panel(stepover_distance)
lowes_slice_leftover_thickness_2 = Panel(lowes_slice_leftover_thickness)
simplify_5 = SimplifyTree(Tree=filter_8, Front=False)
pdecon_4 = Deconstruct(Point=simplify_4)  # -> XComponent, YComponent, ZComponent
pdecon_5 = Deconstruct(Point=simplify_5)  # -> XComponent, YComponent, ZComponent
subtraction_7 = Subtraction(A=pdecon_4.ZComponent, B=top_slice_thickness_2)
addition_3 = Addition(A=pdecon_5.ZComponent, B=lowes_slice_leftover_thickness_2)
pt_10 = ConstructPoint(XCoordinate=pdecon_4.XComponent, YCoordinate=pdecon_4.YComponent, ZCoordinate=subtraction_7)
pt_11 = ConstructPoint(XCoordinate=pdecon_4.XComponent, YCoordinate=pdecon_4.YComponent, ZCoordinate=addition_3)
lower_boundary_point = Point(pt_11)
inital_sample_slice_spacing_2 = Panel(inital_sample_slice_spacing)
meshes_for_3d_milling_2 = Mesh(meshes_for_3d_milling)
multiplication_13 = Multiplication(A=inital_sample_slice_spacing_2, B=curve_sample_slice_reduction)
graft_2 = GraftTree(Tree=meshes_for_3d_milling_2, IncludeEmptyLists=True, IncludeNullItems=True)
inital_sample_slice_spacing_3 = Panel(multiplication_13)
Z_12 = UnitZ(Factor="0.1")
Z_13 = UnitZ(Factor=1)
mjoin_3 = MeshJoin(Meshes=meshes_for_3d_milling_2)
Z_14 = UnitZ(Factor=1)
support_diameter_4 = Panel(support_diameter_2)
build_platform_plane_3 = Plane(build_platform_plane)
multiplication_14 = Multiplication(A=support_diameter_4, B="1.5")

# ---- group: Create support tip
pt_12 = ConstructPoint(XCoordinate=0, YCoordinate=0, ZCoordinate=multiplication_14)
pt_13 = ConstructPoint(XCoordinate=0, YCoordinate=0, ZCoordinate=0)
ln_5 = Line(StartPoint=pt_13, EndPoint=pt_12)
multiplication_15 = Multiplication(A=support_diameter_4, B="0.25")
multiplication_16 = Multiplication(A=support_diameter_4, B="0.5")
panel_13 = Panel("""0
1""")
vpipe = PipeVariable(Curve=ln_5, Parameters=panel_13, Radii=[multiplication_15, multiplication_16], Caps="2")
custom_mesh_settings_2 = SettingsCustom(
    StitchSeams=True,
    SimplePlanes=False,
    Refine=True,
    MinCount=16,
    MaxCount=400,
    AspectRatio=20,
    MaxDistance=0,
    MaxAngle=20,
    MinEdge="0.1",
    MaxEdge=0)
mesh_7 = MeshBrep(Brep=vpipe, Settings=custom_mesh_settings_2)
support_tip_mesh = Mesh(mesh_7)

# ----
lng_5 = ListLength(List=meshes_for_3d_milling)
larger_5 = LargerThan(FirstNumber=lng_5, SecondNumber="1")  # -> LargerThan, OrEqualTo
max_angle_limit_2 = Panel(max_angle_limit)
supprt_platform_2 = Mesh(supprt_platform)
xy_7 = XYPlane(Origin=Point(0, 0, 0))
stepover = Panel(stepover_distance)
skip_top_slices_boolean_2 = Integer(skip_top_slices_boolean)
top_layer_slice_2 = Curve(top_layer_slice)
crv_8 = Curve(top_layer_slice_2)
p_n_c = PickNChoose(Pattern=skip_top_slices_boolean_2, Stream1=crv_8)
Z_15 = UnitZ(Factor=top_slice_sample_thickness)
move_11 = Move(Geometry=p_n_c, Motion=Z_15)  # -> Geometry, Transform
top_slice_section_for_pocket = Curve(move_11.Geometry)
meshes_for_3d_milling_3 = Mesh(graft(meshes_for_3d_milling))
milling_bit_radius_2 = Panel(multiplication_7)
initial_sample_lenght = Panel("0.2")
samples_per_circle = Panel("24")
reduction_tolerance_2 = Panel(reduction_tolerance)
milling_bit_radius_3 = Panel(milling_bit_radius_2)
meshes_for_3d_milling_4 = Mesh(mjoin_2)
reduction_tolerance_3 = Panel(reduction_tolerance_2)
Z_16 = UnitZ(Factor=1)
panel_14 = Panel(Slider(33, range=0..100))
xy_8 = XYPlane(Origin=Point(0, 0, 0))
rad_3 = Radians(Degrees=panel_14)
samples_per_circle_2 = Panel(samples_per_circle)
cir = Circle(Plane=xy_8, Radius=milling_bit_radius_3)
len = Length(Curve=cir)
division_4 = Division(A=len, B=samples_per_circle_2)
reduction_tolerance_4 = Panel(reduction_tolerance_2)

mesh_8 = Mesh(meshes_for_3d_milling)
bbox_6 = BoundingBox(Content=mesh_8, Plane=PlaneXY(0, 0, 0), UnionBox=False)  # -> Box, Box_2
debrep_6 = DeconstructBrep(Brep=bbox_6.Box)  # -> Faces, Edges, Vertices
item_16 = ListItem(List=debrep_6.Vertices, Index="4", Wrap=True)
xy_9 = XYPlane(Origin=item_16)
pshift_9 = ShiftPaths(Data=xy_9, Offset=-1)
area_cull = Panel("10")
milling_bit_radius_4 = Panel(milling_bit_radius)
mshadow_3 = MeshShadow(Mesh=mesh_8, Light=Vector(0, 0, -1), Plane=pshift_9)
area_6 = Area(Geometry=mshadow_3)  # -> Area, Centroid
multiplication_17 = Multiplication(A=milling_bit_radius_4, B=area_cull)
smaller_3 = SmallerThan(FirstNumber=area_6.Area, SecondNumber=multiplication_17)  # -> SmallerThan, OrEqualTo
# fix: select failed shadow and tringulate for speed
dispatch_3 = Dispatch(List=mshadow_3, DispatchPattern=smaller_3.SmallerThan)  # -> ListA, ListB

xy_10 = XYPlane(Origin=Point(0, 0, 0))
simplify_6 = SimplifyTree(Tree=top_layer_slice_2, Front=False)
project_3 = Project(Geometry=simplify_6, Plane=xy_10)  # -> Geometry, Transform

tri = Triangulate(Mesh=mesh_8)  # -> Mesh, Count; disabled
wbtriangles = WeaverbirdsSplitTrianglesSubdivision(MeshCurves=tri.Mesh, Level=2)
pshift_10 = ShiftPaths(Data=wbtriangles, Offset=-1)

joined_meshes = Mesh(mjoin_2)

oultine_curve_for_cutout = Curve(dispatch_3.ListB)
tool_diameter = Panel(milling_bit_diameter_3)
simplify_7 = SimplifyTree(Tree=oultine_curve_for_cutout, Front=False)
tool_diameter_2 = Panel(tool_diameter)
xy_11 = XYPlane(Origin=Point(0, 0, 0))
operation_plane = Plane(xy_11)
multiplication_18 = Multiplication(A=tool_diameter_2, B="0.5")
tool_radius = Panel(multiplication_18)
cutout_tolerance_5 = Panel(cutout_tolerance_3)
addition_4 = Addition(A=tool_radius, B=cutout_tolerance_5)
compensated_tool_radius = Panel(addition_4)

# ---- group: Filter out open curves
curves_for_cutout = Curve(simplify_7)
cls = Closed(Curve=curves_for_cutout)  # -> Closed, Periodic
dispatch_4 = Dispatch(List=curves_for_cutout, DispatchPattern=cls.Closed)  # -> ListA, ListB

# ---- group: Merge overlapping curves
curves_for_merging_overlap = Curve(dispatch_4.ListA)
mcx = MultipleCurves(Curves=curves_for_merging_overlap)  # -> Points, IndexA, IndexB, ParamA, ParamB
dcon = DeleteConsecutive(Set=[mcx.IndexA, mcx.IndexB], Wrap=False)  # -> Set, Count
item_17 = ListItem(List=curves_for_merging_overlap, Index=dcon.Set, Wrap=True)
cull_i = CullIndex(List=curves_for_merging_overlap, Indices=dcon.Set, Wrap=True)
runion_3 = RegionUnion(Curves=item_17, Plane=operation_plane)
merged_overlapping_curves = Curve([runion_3, cull_i])

# ----
ratio_for_cull_2 = Panel("0.5")
threshold_for_rebuild = Panel("0.1")
# fix bad corner cull and angle check. use obr test triangle
panel_15 = Panel("2")
use_inside_cutting_3 = Panel("0")
generate_roughing_3 = Panel(generate_roughing_2)
operation_plane_2 = Plane(operation_plane)
neg_6 = Negative(Value=compensated_tool_radius)
finish_stepover = Panel(finishing_stepover)
roughing_stepover_2 = Panel(roughing_stepover)
milling_bit_radius_5 = Panel(milling_bit_radius)
reduction_tolerance_5 = Panel(reduction_tolerance)
multiplication_19 = Multiplication(A=milling_bit_radius_5, B="1")
generate_finishing_3 = Panel(generate_finishing_2)
neg_7 = Negative(Value=milling_bit_radius_5)
Z_17 = UnitZ(Factor=neg_7)
lng_6 = ListLength(List=meshes_for_3d_milling)
smaller_4 = SmallerThan(FirstNumber=lng_6, SecondNumber="2")  # -> SmallerThan, OrEqualTo
crv_9 = Curve(<curve referenced from the Rhino model>)
number_slider_6 = Slider(0, range=0..1)
generate_cutout_3 = Panel(generate_cutout_2)
generate_roughing_4 = Panel(generate_roughing_2)
stepover_distance_3 = Panel(stepover_distance)
make_flea_jump_transitions_3 = Integer(make_flea_jump_transitions_2)
connect_toolpath_tolerance_factor_2 = Panel(connect_toolpath_tolerance_factor)
connect_toolpaths_levels_3 = Integer(connect_toolpaths_levels_2)
addition_5 = Addition(A=connect_toolpath_tolerance_factor_2, B="1")
multiplication_20 = Multiplication(A=stepover_distance_3, B=connect_toolpath_tolerance_factor_2)
stepover_distance_4 = Panel(stepover_distance_3)
Z_18 = UnitZ(Factor=stepover_distance_4)

# ---- group: SLA export slider
current_slice = Slider(0.363, range=0..1)

# ----
drill = Drill(drill_curves=cnc_hold_down_curves_2, I=cut_depth, I_2=milling_bit_diameter_2)  # -> drill_toolpaths_3, drill_preview_geometry_3
pocket = Pocket(
    curves_for_raster_pocket=cnc_pocket_curves_2,
    cut_depth_pocket=cut_depth_pocket_2,
    pass_depth=pass_depth_2,
    tool_diameter=milling_bit_diameter_2,
    stepover_0_1=pocket_stepover_2,
    raster_along_y_0_1=raster_direction_along_y_2)
cutout = Cutout(
    curves_for_cutout=cnc_cutout_curves_2,
    cut_depth=cut_depth,
    pass_depth=pass_depth_2,
    tool_diameter=milling_bit_diameter_2,
    cutout_tolerance=cutout_tolerance_4,
    use_climb_direction=use_climb_direction_2,
    use_inside_cutting=use_inside_cutting_2)
engrave = Engrave(engrave_curves=cnc_line_engrave_curves_2, cut_depth=cut_depth_line_engrave_2, pass_depth=pass_depth_2)

drill_preview_geometry = Curve(drill.drill_preview_geometry_3)
engrave_toolpaths = Curve(flatten(engrave))
cutout_toolpaths = Curve(flatten(cutout))
pocket_toolpaths = Curve(flatten(pocket))

# ---- group: Create slice plane positions
layer_height_4 = Panel(layer_height_2)
current_slice_2 = Panel(current_slice)

# ---- group: Toolpath preview
drill_preview_geometry_2 = Curve(drill.drill_preview_geometry_3)
jog_transitions = ColourSwatch(SwatchColor=RGB(71, 61, 38))
hold_down = ColourSwatch(SwatchColor=RGB(255, 191, 0))
cut_entries = ColourSwatch(SwatchColor=RGB(145, 193, 194))
toolpaths = ColourSwatch(SwatchColor=RGB(184, 251, 255))
cut_exits = ColourSwatch(SwatchColor=RGB(61, 88, 89))
preview_4 = CustomPreview(Geometry=drill_preview_geometry_2, Shader=hold_down)

# ---- group: Create slices for support
jagged_2 = SettingsSpeed()

# ----
support_spacing_distance_5 = Panel(support_spacing_distance_3)
oultines_for_support_grid = Curve(aligned_curves)
multiplication_21 = Multiplication(A=support_diameter_3, B="0.6")
flatten_4 = FlattenTree(Tree=oultines_for_support_grid, Path="{0}")
offset_4 = Offset(Curve=flatten_4, Distance=multiplication_21, Plane=PlaneXY(0, 0, 0), Corners=1)
pshift_11 = ShiftPaths(Data=offset_4, Offset=-1)
boundary_3 = BoundarySurfaces(Edges=pshift_11)
edges = BrepEdges(Brep=boundary_3)  # -> Naked, Interior, NonManifold
join_3 = JoinCurves(Curves=edges.Naked, Preserve=False)
dim_5 = Dimensions(Surface=boundary_3)  # -> UDimension, VDimension
divide_curve_even_lenght_2 = DivideCurveEvenLenght(crv=join_3, B=support_spacing_distance_3)
division_5 = Division(A=dim_5.UDimension, B=support_spacing_distance_5)
division_6 = Division(A=dim_5.VDimension, B=support_spacing_distance_5)
sdivide = DivideSurface(Surface=boundary_3, UCount=division_5, VCount=division_6)  # -> Points, Normals, Parameters
pline_5 = PolyLine(Vertices=divide_curve_even_lenght_2, Closed=Toggle(True))
pshift_12 = ShiftPaths(Data=sdivide.Points, Offset=-1)
clean = CleanTree(RemoveNulls=True, RemoveInvalid=True, RemoveEmpty=False, Tree=pshift_12)

pshift_13 = ShiftPaths(Data=pline_5, Offset=-1)
pt_14 = Point(clean)
multiplication_22 = Multiplication(A=support_spacing_distance_5, B="0.6")

cp_3 = ControlPoints(Curve=pshift_13)  # -> Points, Weights, Knots
cp_4 = ClosestPoint(Point=pt_14, Cloud=cp_3.Points)  # -> ClosestPoint, CPIndex, Distance
smaller_5 = SmallerThan(FirstNumber=cp_4.Distance, SecondNumber=multiplication_22)  # -> SmallerThan, OrEqualTo
dispatch_5 = Dispatch(List=pt_14, DispatchPattern=smaller_5.SmallerThan)  # -> ListA, ListB
merge_2 = Merge(Data1=dispatch_5.ListB, Data2=cp_3.Points)

lowest_point_on_model_loactions_2 = Point(lowest_point_on_model_loactions)
pt_15 = Point(merge_2)
multiplication_23 = Multiplication(A=support_spacing_distance_5, B="0.5")
cp_5 = ClosestPoint(Point=pt_15, Cloud=lowest_point_on_model_loactions_2)  # -> ClosestPoint, CPIndex, Distance
smaller_6 = SmallerThan(FirstNumber=cp_5.Distance, SecondNumber=multiplication_23)  # -> SmallerThan, OrEqualTo
dispatch_6 = Dispatch(List=pt_15, DispatchPattern=smaller_6.SmallerThan)  # -> ListA, ListB
grid_of_points = Point(dispatch_6.ListB)

lowest_point_on_model_loactions_3 = Point(lowest_point_on_model_loactions)
overhang_degree_threshold_3 = Panel(overhang_degree_threshold_2)
mesh_for_sla_print_4 = Mesh(mesh_for_sla_print)
mesh_for_sla_print_5 = Mesh(mesh_for_sla_print)
grid_of_points_2 = Point(grid_of_points)
Z_19 = UnitZ(Factor=1)
meshray_2 = MeshRay(Mesh=mesh_for_sla_print_4, Point=grid_of_points_2, Direction=Z_19)  # -> Point, Hit
meshray_3 = MeshRay(Mesh=mesh_for_sla_print_5, Point=lowest_point_on_model_loactions_3, Direction=Z_19)  # -> Point, Hit
meshcp = MeshClosestPoint(Point=meshray_2.Point, Mesh=mesh_for_sla_print_4)  # -> Point, Index, Parameter
meval = MeshEval(Mesh=mesh_for_sla_print_4, Parameter=meshcp.Parameter)  # -> Point, Normal, Colour
Z_20 = UnitZ(Factor=1)
rev_2 = Reverse(Vector=Z_20)
angle_2 = Angle(VectorA=meval.Normal, VectorB=rev_2)  # -> Angle, Reflex
deg = Degrees(Radians=angle_2.Angle)
larger_6 = LargerThan(FirstNumber=deg, SecondNumber=overhang_degree_threshold_3)  # -> LargerThan, OrEqualTo
meshcp_2 = MeshClosestPoint(Point=meshray_3.Point, Mesh=mesh_for_sla_print_4)  # -> Point, Index, Parameter
meval_2 = MeshEval(Mesh=mesh_for_sla_print_4, Parameter=meshcp_2.Parameter)  # -> Point, Normal, Colour
dispatch_7 = Dispatch(List=meval.Normal, DispatchPattern=larger_6.LargerThan)  # -> ListA, ListB
dispatch_8 = Dispatch(List=meshray_2.Point, DispatchPattern=larger_6.LargerThan)  # -> ListA, ListB
clean_2 = CleanTree(RemoveNulls=True, RemoveInvalid=True, RemoveEmpty=False, Tree=dispatch_8.ListB)
clean_3 = CleanTree(RemoveNulls=True, RemoveInvalid=True, RemoveEmpty=False, Tree=dispatch_7.ListB)
clean_4 = CleanTree(RemoveNulls=True, RemoveInvalid=True, RemoveEmpty=False, Tree=meshray_3.Point)
clean_5 = CleanTree(RemoveNulls=True, RemoveInvalid=True, RemoveEmpty=False, Tree=meval_2.Normal)
merge_3 = Merge(Data1=clean_2, Data2=clean_4)
merge_4 = Merge(Data1=clean_3, Data2=clean_5)
support_location_normals = Vector(merge_4)
support_locations = Point(merge_3)

support_location_normals_2 = Vector(support_location_normals)
support_locations_2 = Point(support_locations)

# ---- group: Create suport stems
amp = Amplitude(Vector=support_location_normals_2, Amplitude=multiplication_14)
move_12 = Move(Geometry=support_locations_2, Motion=amp)  # -> Geometry, Transform
project_4 = Project(Geometry=move_12.Geometry, Plane=build_platform_plane_3)  # -> Geometry, Transform
ln_6 = Line(StartPoint=project_4.Geometry, EndPoint=move_12.Geometry)
multiplication_24 = Multiplication(A=support_diameter_4, B="1.5")
multiplication_25 = Multiplication(A=support_diameter_4, B="0.5")
multiplication_26 = Multiplication(A=support_diameter_4, B="0.5")
panel_16 = Panel("""0
0.3
1""")
vpipe_2 = PipeVariable(Curve=ln_6, Parameters=panel_16, Radii=[multiplication_24, multiplication_25, multiplication_26], Caps="0")
custom_mesh_settings_3 = SettingsCustom(
    StitchSeams=True,
    SimplePlanes=False,
    Refine=True,
    MinCount=16,
    MaxCount=400,
    AspectRatio=20,
    MaxDistance=0,
    MaxAngle=20,
    MinEdge="0.1",
    MaxEdge=0)
pshift_14 = ShiftPaths(Data=vpipe_2, Offset=-1)
mesh_9 = MeshBrep(Brep=pshift_14, Settings=custom_mesh_settings_3)
support_stem_mesh = Mesh(mesh_9)

# ---- group: Position support tips
pl = PlaneNormal(Origin=support_locations_2, ZAxis=support_location_normals_2)
xy_12 = XYPlane(Origin=Point(0, 0, 0))
orient = Orient(Geometry=support_tip_mesh, Source=xy_12, Target=pl)  # -> Geometry, Transform

# ---- group: Check for stem collisions with print object
mesh_for_sla_print_6 = Mesh(mesh_for_sla_print)
merge_5 = Merge(Data1=orient.Geometry, Data2=support_stem_mesh)
colom = CollisionOneMany(Collider=support_stem_mesh, Obstacles=mesh_for_sla_print_6)  # -> Collision, Index
dispatch_9 = Dispatch(List=merge_5, DispatchPattern=colom.Collision)  # -> ListA, ListB

# ---- group: Create support connectors
support_spacing_distance_6 = Panel(support_spacing_distance_3)
ln_7 = Line(StartPoint=project_4.Geometry, EndPoint=move_12.Geometry)
dispatch_10 = Dispatch(List=ln_7, DispatchPattern=colom.Collision)  # -> ListA, ListB
divlength_3 = DivideLength(Curve=flatten(dispatch_10.ListB), Length=support_spacing_distance_6)  # -> Points, Tangents, Parameters
cull_i_2 = CullIndex(List=divlength_3.Points, Indices="0", Wrap=True)
pshift_15 = ShiftPaths(Data=cull_i_2, Offset=-1)
pshift_16 = ShiftPaths(Data=cull_i_2, Offset=0)
flip_3 = FlipMatrix(Data=pshift_15)
con = DelaunayEdges(Points=flip_3, Plane=PlaneXY(0, 0, 0))  # -> Connectivity, Edges
clean_6 = CleanTree(RemoveNulls=True, RemoveInvalid=True, RemoveEmpty=False, Tree=flatten(con.Edges))
line = Line(clean_6)
len_2 = Length(Curve=line)
multiplication_27 = Multiplication(A=support_spacing_distance_6, B="2")
mesh_for_sla_print_7 = Mesh(mesh_for_sla_print)
larger_7 = LargerThan(FirstNumber=len_2, SecondNumber=multiplication_27)  # -> LargerThan, OrEqualTo
dispatch_11 = Dispatch(List=line, DispatchPattern=larger_7.LargerThan)  # -> ListA, ListB
colom_2 = CollisionOneMany(Collider=dispatch_11.ListB, Obstacles=mesh_for_sla_print_7)  # -> Collision, Index
dispatch_12 = Dispatch(List=dispatch_11.ListB, DispatchPattern=colom_2.Index)  # -> ListA, ListB
multiplication_28 = Multiplication(A=support_diameter_4, B="0.4")
line_2 = Line(dispatch_12.ListA)
pipe = Pipe(Curve=line_2, Radius=multiplication_28, Caps="1")
custom_mesh_settings_4 = SettingsCustom(
    StitchSeams=True,
    SimplePlanes=False,
    Refine=True,
    MinCount=16,
    MaxCount=400,
    AspectRatio=20,
    MaxDistance=0,
    MaxAngle=20,
    MinEdge="1",
    MaxEdge=0)
mesh_10 = MeshBrep(Brep=pipe, Settings=custom_mesh_settings_4)

# ----
support_beams = Mesh(mesh_10)
support_stems = Mesh(dispatch_9.ListB)
support_mesh = Mesh(flatten([support_stems, support_beams, supprt_platform_2]))
support_meshes_for_sla_print = Mesh(flatten(support_mesh))

# ---- group: Create slice plane positions (continued)
bbox_7 = BoundingBox(Content=[mesh_for_sla_print_2, support_meshes_for_sla_print], Plane=PlaneXY(0, 0, 0), UnionBox=True)  # -> Box, Box_2
debrep_7 = DeconstructBrep(Brep=bbox_7.Box)  # -> Faces, Edges, Vertices
item_18 = ListItem(List=debrep_7.Edges, Index="9", Wrap=True)
divlength_4 = DivideLength(Curve=item_18, Length=layer_height_4)  # -> Points, Tangents, Parameters
lng_7 = ListLength(List=divlength_4.Points)
subtraction_8 = Subtraction(A=lng_7, B="1")
multiplication_29 = Multiplication(A=lng_7, B=current_slice_2)
item_19 = ListItem(List=divlength_4.Points, Index=multiplication_29, Wrap=True)
xy_13 = XYPlane(Origin=item_19)

# ---- group: SLA export slider (continued)
number_of_slices = Panel(subtraction_8)

# ----
gate = StreamGate(Stream=support_meshes_for_sla_print, Gate=slice_object)  # -> Target0, Target1
sec_2 = MeshPlane(Mesh=mesh_for_sla_print_2, Plane=xy_13)
sec_3 = MeshPlane(Mesh=support_meshes_for_sla_print, Plane=xy_13)
gate_2 = StreamGate(Stream=sec_2, Gate=slice_object)  # -> Target0, Target1
gate_3 = StreamGate(Stream=sec_3, Gate=slice_object)  # -> Target0, Target1

# ---- group: Create surfaces and remove overlpping edges
boundary_4 = BoundarySurfaces(Edges=gate_2.Target1)
sunion = SolidUnion(Breps=boundary_4)
lng_8 = ListLength(List=sunion)
flatten_5 = FlattenTree(Tree=lng_8, Path="{0}")
sort_3 = SortList(Keys=flatten_5)  # -> Keys, ValuesA
item_20 = ListItem(List=sort_3.Keys, Index=0, Wrap=True)
fmerge = MergeFaces(Brep=sunion)  # -> Breps, Before, After
smaller_7 = SmallerThan(FirstNumber=item_20, SecondNumber="1")  # -> SmallerThan, OrEqualTo
filter_9 = StreamFilter(Gate=smaller_7.SmallerThan, Stream0=fmerge.Breps, Stream1=boundary_4)
srf_2 = Surface(filter_9)

# ---- group: Create slices for support (continued)
boundary_5 = BoundarySurfaces(Edges=gate_3.Target1)
mesh_11 = MeshBrep(Brep=boundary_5, Settings=jagged_2)
support_slices = Mesh(mesh_11)

# ----
preview_5 = CustomPreview(Geometry=gate.Target0, Shader=material_3)
preview_6 = CustomPreview(Geometry=[gate_3.Target0, gate_2.Target0], Shader=ColourSwatch(SwatchColor=RGB(0, 242, 255)))

# ---- group: Create mesh grid and analyze grdis position distance from nearest edge
custom_mesh_settings_5 = SettingsCustom(
    StitchSeams=True,
    SimplePlanes=False,
    Refine=True,
    MinCount=16,
    MaxCount=400,
    AspectRatio=20,
    MaxDistance=0,
    MaxAngle=20,
    MinEdge=0,
    MaxEdge=gradient_sample_resolution)
mesh_12 = MeshBrep(Brep=srf_2, Settings=custom_mesh_settings_5)
demesh_2 = DeconstructMesh(Mesh=mesh_12)  # -> Vertices, Faces, Colours, Normals
meshcp_3 = MeshClosestPoint(Point=demesh_2.Vertices, Mesh=mesh_for_sla_print_2)  # -> Point, Index, Parameter
dist_3 = Distance(PointA=demesh_2.Vertices, PointB=meshcp_3.Point)

# ---- group: Colur mesh with grdient colours
division_7 = Division(A=dist_3, B=edge_fade_count)
subtraction_9 = Subtraction(A=Slider(1, range=0..1), B=division_7)
swatch_3 = ColourSwatch(SwatchColor=RGB(255, 255, 255))
white_overexpose_factor = ColourSwatch(SwatchColor=RGB(33, 33, 33))
multiplication_30 = Multiplication(A=swatch_3, B=subtraction_9)
addition_6 = Addition(A=multiplication_30, B=white_overexpose_factor)
conmesh = ConstructMesh(Vertices=demesh_2.Vertices, Faces=demesh_2.Faces, Colours=addition_6)

# ----
support_slices_2 = Mesh(support_slices)
mcol = MeshColours(Mesh=support_slices_2, Colours=swatch_3)
mesh_slice_with_gradient = Mesh(flatten([conmesh, mcol]))

skip_top_slices_boolean_3 = Integer(skip_top_slices_boolean)
stepover_distance_5 = Panel(stepover_distance)
simplify_8 = SimplifyTree(Tree=skip_top_slices_boolean_3, Front=False)
pdecon_6 = Deconstruct(Point=pt_10)  # -> XComponent, YComponent, ZComponent

multiplication_31 = Multiplication(A=stepover_distance_5, B="0.33")

multiplication_32 = Multiplication(A=simplify_8, B=multiplication_31)
subtraction_10 = Subtraction(A=pdecon_6.ZComponent, B=multiplication_32)
pt_16 = ConstructPoint(XCoordinate=pdecon_6.XComponent, YCoordinate=pdecon_6.YComponent, ZCoordinate=subtraction_10)

upper_boundary_point = Point(pt_16)
ln_8 = Line(StartPoint=upper_boundary_point, EndPoint=lower_boundary_point)
master_graph_line = Line(ln_8)
divide_curve_even_lenght_3 = DivideCurveEvenLenght(crv=master_graph_line, B=inital_sample_slice_spacing_2)
master_graph_points = Point(divide_curve_even_lenght_3)
xy_14 = XYPlane(Origin=master_graph_points)
pshift_17 = ShiftPaths(Data=xy_14, Offset=-1)
sec_4 = MeshPlane(Mesh=graft_2, Plane=pshift_17)
divlength_5 = DivideLength(Curve=sec_4, Length=inital_sample_slice_spacing_3)  # -> Points, Tangents, Parameters
move_13 = Move(Geometry=divlength_5.Points, Motion=Z_12)  # -> Geometry, Transform
pshift_18 = ShiftPaths(Data=move_13.Geometry, Offset=-1)
simplify_9 = SimplifyTree(Tree=pshift_18, Front=False)
meshray_4 = MeshRay(Mesh=mjoin_3, Point=simplify_9, Direction=Z_13)  # -> Point, Hit
dispatch_13 = Dispatch(List=simplify_9, DispatchPattern=meshray_4.Hit)  # -> ListA, ListB
pt_17 = Point(dispatch_13.ListB)

# ---- group: test
clean_7 = CleanTree(RemoveNulls=True, RemoveInvalid=True, RemoveEmpty=True, Tree=pt_17)

# ----
meshcp_4 = MeshClosestPoint(Point=clean_7, Mesh=mjoin_3)  # -> Point, Index, Parameter
meval_3 = MeshEval(Mesh=mjoin_3, Parameter=meshcp_4.Parameter)  # -> Point, Normal, Colour
vdis = VectorDisplay(Anchor=clean_7, Vector=meval_3.Normal)
angle_3 = Angle(VectorA=meval_3.Normal, VectorB=Z_14)  # -> Angle, Reflex
deg_2 = Degrees(Radians=angle_3.Angle)
lng_9 = ListLength(List=deg_2)
sort_4 = SortList(Keys=deg_2)  # -> Keys, ValuesA
panel_17 = Panel(sort_4.Keys)
multiplication_33 = Multiplication(A=lng_9, B=sample_top_value_percentage)
round_3 = Round(Number=multiplication_33)  # -> Nearest, Floor, Ceiling
split = SplitList(List=sort_4.Keys, Index=round_3.Ceiling)  # -> ListA, ListB
panel_18 = Panel(split.ListA)
avr = Average(Input=split.ListA)
panel_19 = Panel(avr)
pshift_19 = ShiftPaths(Data=avr, Offset=-1)
pshift_20 = ShiftPaths(Data=pshift_19, Offset=-1)
pshift_21 = ShiftPaths(Data=avr, Offset=1)
filter_10 = StreamFilter(Gate=larger_5.LargerThan, Stream0=pshift_21, Stream1=pshift_20)
smaller_8 = SmallerThan(FirstNumber=filter_10, SecondNumber=max_angle_limit_2)  # -> SmallerThan, OrEqualTo
dispatch_14 = Dispatch(List=filter_10, DispatchPattern=smaller_8.SmallerThan)  # -> ListA, ListB
lng_10 = ListLength(List=dispatch_14.ListA)
dup = DuplicateData(Data=max_angle_limit_2, Number=lng_10, Order=True)
master_graph_points_2 = Point(master_graph_points)
master_graph_line_2 = Line(master_graph_line)
pshift_22 = ShiftPaths(Data=dup, Offset=-1)
weave_3 = Weave(Pattern=smaller_8.SmallerThan, Stream0=dispatch_14.ListB, Stream1=pshift_22, NullGaps=False)
average_surface_angle = Panel(weave_3)
lng_11 = ListLength(List=master_graph_points_2)
len_3 = Length(Curve=master_graph_line_2)
subtraction_11 = Subtraction(A=lng_11, B="1")
division_8 = Division(A=len_3, B=subtraction_11)
division_9 = Division(A=division_8, B="2")
neg_8 = Negative(Value=division_9)
Z_21 = UnitZ(Factor=neg_8)
Z_22 = UnitZ(Factor=division_9)
move_14 = Move(Geometry=master_graph_points_2, Motion=Z_22)  # -> Geometry, Transform
move_15 = Move(Geometry=master_graph_points_2, Motion=Z_21)  # -> Geometry, Transform
xy_15 = XYPlane(Origin=master_graph_points_2)
subtraction_12 = Subtraction(A="90", B=average_surface_angle)
xz_2 = XZPlane(Origin=master_graph_points_2)
neg_9 = Negative(Value=division_9)
ln_9 = Line(StartPoint=move_14.Geometry, EndPoint=move_15.Geometry)
neg_10 = Negative(Value=subtraction_12)
Z_23 = UnitZ(Factor=neg_9)
Z_24 = UnitZ(Factor=division_9)
move_16 = Move(Geometry=xy_15, Motion=Z_24)  # -> Geometry, Transform
move_17 = Move(Geometry=xy_15, Motion=Z_23)  # -> Geometry, Transform
rotate_3 = Rotate(Geometry=ln_9, Angle=degrees(neg_10), Plane=xz_2)  # -> Geometry, Transform
plx = LinePlane(Line=rotate_3.Geometry, Plane=move_16.Geometry)  # -> Point, ParamL, ParamP
plx_2 = LinePlane(Line=rotate_3.Geometry, Plane=move_17.Geometry)  # -> Point, ParamL, ParamP
ln_10 = Line(StartPoint=plx.Point, EndPoint=plx_2.Point)
project_5 = Project(Geometry=ln_10, Plane=xy_7)  # -> Geometry, Transform
bbox_8 = BoundingBox(Content=ln_10, Plane=PlaneXY(0, 0, 0))  # -> Box, Box_2; disabled
len_4 = Length(Curve=project_5.Geometry)
dim_6 = Dimensions(Surface=bbox_8.Box)  # -> UDimension, VDimension; disabled
line_width = Number(len_4)
ma = MassAddition(Input=line_width)  # -> Result, PartialResults
division_10 = Division(A=line_width, B="2")
neg_11 = Negative(Value=ma.PartialResults)
X = UnitX(Factor=division_10)
X_2 = UnitX(Factor=neg_11)
move_18 = Move(Geometry=ln_10, Motion=X)  # -> Geometry, Transform
move_19 = Move(Geometry=move_18.Geometry, Motion=X_2)  # -> Geometry, Transform

milling_bit_radius_6 = Panel(multiplication_7)
curvepoint = PointOnCurve(move_19.Geometry, parameter=0.5)
intcrv = Interpolate(Vertices=curvepoint, Degree=3, Periodic=False, KnotStyle=1)  # -> Curve, Length, Domain
neg_12 = Negative(Value=milling_bit_radius_6)
xz_3 = XZPlane(Origin=Point(0, 0, 0))
offset_5 = Offset(Curve=intcrv.Curve, Distance=milling_bit_radius_6, Plane=xz_3, Corners=1)

crv_10 = Curve(intcrv.Curve)
end_3 = EndPoints(Curve=master_graph_line_2)  # -> Start, End
end_4 = EndPoints(Curve=crv_10)  # -> Start, End
vec2pt = Vector2Pt(PointA=end_4.End, PointB=end_3.End, Unitize=False)  # -> Vector, Length

# ---- group: fix skew vector
move_20 = Move(Geometry=crv_10, Motion=vec2pt.Vector)  # -> Geometry, Transform

# ----
simplify_10 = SimplifyTree(Tree=crv_10, Front=False)
divide_curve_even_lenght_4 = DivideCurveEvenLenght(crv=simplify_10, B=stepover)
pshift_23 = ShiftPaths(Data=divide_curve_even_lenght_4, Offset=-1)
pt_18 = Point(end_3.End)
pdecon_7 = Deconstruct(Point=pshift_23)  # -> XComponent, YComponent, ZComponent
pdecon_8 = Deconstruct(Point=pt_18)  # -> XComponent, YComponent, ZComponent
pt_19 = ConstructPoint(XCoordinate=pdecon_8.XComponent, YCoordinate=pdecon_7.YComponent, ZCoordinate=pdecon_7.ZComponent)

stepover_distance_6 = Panel(stepover_distance)
milling_bit_radius_7 = Panel(multiplication_7)
top_slice_location_point_2 = Point(item_9)
pt_20 = Point(pt_19)
subtraction_13 = Subtraction(A=milling_bit_radius_7, B=stepover_distance_6)
pdecon_9 = Deconstruct(Point=top_slice_location_point_2)  # -> XComponent, YComponent, ZComponent
pdecon_10 = Deconstruct(Point=pt_20)  # -> XComponent, YComponent, ZComponent
addition_7 = Addition(A=pdecon_9.ZComponent, B=subtraction_13)
item_21 = ListItem(List=pdecon_10.ZComponent, Index=0, Wrap=True)
p_n_c_2 = PickNChoose(Pattern=skip_top_slices_boolean_2, Stream0=item_21, Stream1=addition_7)
pshift_24 = ShiftPaths(Data=p_n_c_2, Offset=-1)
larger_8 = LargerThan(FirstNumber=pdecon_10.ZComponent, SecondNumber=pshift_24)  # -> LargerThan, OrEqualTo
dispatch_15 = Dispatch(List=pt_20, DispatchPattern=larger_8.LargerThan)  # -> ListA, ListB
pt_21 = Point(dispatch_15.ListB)

xy_16 = XYPlane(Origin=pt_21)
sec_5 = MeshPlane(Mesh=meshes_for_3d_milling_3, Plane=xy_16)
join_4 = JoinCurves(Curves=sec_5, Preserve=False)
clean_8 = CleanTree(RemoveNulls=True, RemoveInvalid=True, RemoveEmpty=True, Tree=join_4)
simplify_11 = SimplifyTree(Tree=clean_8, Front=False)
redpline = Reduce(Polyline=simplify_11, Tolerance=reduction_tolerance_2)  # -> Polyline, Reduction
disc_2 = Discontinuity(Curve=redpline.Polyline, Level=1)  # -> Points, Parameters
crv_11 = Curve(redpline.Polyline)
xy_17 = XYPlane(Origin=disc_2.Points)
cir_2 = Circle(Plane=xy_17, Radius=initial_sample_lenght)
ccx = CurveCurve(CurveA=cir_2, CurveB=graft(crv_11))  # -> Points, ParamsA, ParamsB
ccx_2 = CurveCurve(CurveA=crv_11, CurveB=cir_2)  # -> Points, ParamsA, ParamsB; disabled
pshift_25 = ShiftPaths(Data=ccx.Points, Offset=-1)
crv_12 = Curve(crv_11)
alongcrv = SortAlongCurve(Points=pshift_25, Curve=graft(crv_12))  # -> Points, Indices
pshift_26 = ShiftPaths(Data=alongcrv.Points, Offset=-1)
sample_points_for_offset = Point(pshift_26)
sample_points_for_offset_2 = Point(sample_points_for_offset)

meshcp_5 = MeshClosestPoint(Point=sample_points_for_offset_2, Mesh=meshes_for_3d_milling_4)  # -> Point, Index, Parameter
meval_4 = MeshEval(Mesh=meshes_for_3d_milling_4, Parameter=meshcp_5.Parameter)  # -> Point, Normal, Colour
amp_2 = Amplitude(Vector=meval_4.Normal, Amplitude=milling_bit_radius_3)
move_21 = Move(Geometry=meshcp_5.Point, Motion=amp_2)  # -> Geometry, Transform

pt_22 = Point(move_21.Geometry)

meshcp_6 = MeshClosestPoint(Point=pt_22, Mesh=meshes_for_3d_milling_4)  # -> Point, Index, Parameter
vec2pt_2 = Vector2Pt(PointA=meshcp_6.Point, PointB=pt_22, Unitize=False)  # -> Vector, Length
amp_3 = Amplitude(Vector=vec2pt_2.Vector, Amplitude=milling_bit_radius_3)
move_22 = Move(Geometry=meshcp_6.Point, Motion=amp_3)  # -> Geometry, Transform

crv_13 = Curve(crv_11)
cullpt_2 = CullDuplicates(Points=move_22.Geometry, Tolerance=reduction_tolerance_3, CullMode=3)  # -> Points, Indices, Valence
alongcrv_2 = SortAlongCurve(Points=cullpt_2.Points, Curve=graft(crv_13))  # -> Points, Indices
pline_6 = PolyLine(Vertices=cullpt_2.Points, Closed=True)
pline_7 = PolyLine(Vertices=alongcrv_2.Points, Closed=True)
redpline_2 = Reduce(Polyline=pline_7, Tolerance=reduction_tolerance_3)  # -> Polyline, Reduction
simplify_12 = SimplifyTree(Tree=redpline_2.Polyline, Front=False)
crv_14 = Curve(simplify_12)
cp_6 = ControlPoints(Curve=crv_14)  # -> Points, Weights, Knots
simplify_13 = SimplifyTree(Tree=cp_6.Points, Front=False)
cullpt_3 = CullDuplicates(Points=simplify_13, Tolerance=reduction_tolerance_3, CullMode=3)  # -> Points, Indices, Valence
pt_23 = Point(cullpt_3.Points)
crv_cp_3 = CurveClosestPoint(Point=pt_23, Curve=crv_14)  # -> Point, Parameter, Distance
eval_3 = EvaluateCurve(Curve=crv_14, Parameter=crv_cp_3.Parameter)  # -> Point, Tangent, Angle
pt_24 = Point(cullpt_3.Points)
larger_9 = LargerThan(FirstNumber=eval_3.Angle, SecondNumber=rad_3)  # -> LargerThan, OrEqualTo
p_n_c_3 = PickNChoose(Pattern=larger_9.LargerThan, Stream1=pt_23)
pt_25 = Point(p_n_c_3)
cps = ClosestPoints(Point=pt_25, Cloud=pt_25, Count="2")  # -> ClosestPoint, CPIndex, Distance
item_22 = ListItem(List=cps.Distance, Index="1", Wrap=True)
pshift_27 = ShiftPaths(Data=item_22, Offset=-1)
multiplication_34 = Multiplication(A=pshift_27, B="0.49")
division_11 = Division(A=multiplication_34, B=division_4)
round_4 = Round(Number=division_11)  # -> Nearest, Floor, Ceiling
pt_26 = Point(p_n_c_3)
pt_27 = Point(cullpt_3.Points)
division_12 = Division(A=multiplication_34, B=round_4.Ceiling)
xy_18 = XYPlane(Origin=pt_26)
series_3 = Series(Start=division_12, Step=division_12, Count=round_4.Ceiling)
graft_3 = GraftTree(Tree=xy_18, IncludeEmptyLists=True, IncludeNullItems=True)
sph = Sphere(Base=graft_3, Radius=series_3)
pshift_28 = ShiftPaths(Data=sph, Offset=-1)
bcx = BrepCurve(Brep=pshift_28, Curve=crv_14)  # -> Curves, Points
pshift_29 = ShiftPaths(Data=bcx.Points, Offset=-1)
merge_6 = Merge(Data1=cullpt_3.Points, Data2=pshift_29)
alongcrv_3 = SortAlongCurve(Points=merge_6, Curve=graft(crv_14))  # -> Points, Indices
pline_8 = PolyLine(Vertices=alongcrv_3.Points, Closed=True)
smoothpline = SmoothPolyline(Polyline=pline_8, Strength="1", Times="2")
redpline_3 = Reduce(Polyline=smoothpline, Tolerance=reduction_tolerance_4)  # -> Polyline, Reduction; disabled
cp_7 = ControlPoints(Curve=smoothpline)  # -> Points, Weights, Knots
pshift_30 = ShiftPaths(Data=cp_7.Points, Offset=-1)

meshcp_7 = MeshClosestPoint(Point=pshift_30, Mesh=meshes_for_3d_milling_4)  # -> Point, Index, Parameter
vec2pt_3 = Vector2Pt(PointA=meshcp_7.Point, PointB=pshift_30, Unitize=False)  # -> Vector, Length
amp_4 = Amplitude(Vector=vec2pt_3.Vector, Amplitude=milling_bit_radius_3)
move_23 = Move(Geometry=meshcp_7.Point, Motion=amp_4)  # -> Geometry, Transform

pline_9 = PolyLine(Vertices=move_23.Geometry, Closed=True)
crv_15 = Curve(pline_9)
explode_4 = Explode(Curve=crv_15, Recursive=True)  # -> Segments, Vertices

# ---- group: Remove undercut points
cp_8 = ControlPoints(Curve=explode_4.Segments)  # -> Points, Weights, Knots
# Fix undercut based on points on surface
simplify_14 = SimplifyTree(Tree=cp_8.Points, Front=False)
Z_25 = UnitZ(Factor="0.1")
move_24 = Move(Geometry=simplify_14, Motion=Z_25)  # -> Geometry, Transform
mjoin_4 = MeshJoin(Meshes=meshes_for_3d_milling_2)
simplify_15 = SimplifyTree(Tree=move_24.Geometry, Front=False)
Z_26 = UnitZ(Factor=1)
meshray_5 = MeshRay(Mesh=mjoin_4, Point=simplify_15, Direction=Z_26)  # -> Point, Hit
dispatch_16 = Dispatch(List=simplify_15, DispatchPattern=meshray_5.Hit)  # -> ListA, ListB
neg_13 = Negative(Value="0.1")
Z_27 = UnitZ(Factor=neg_13)
move_25 = Move(Geometry=dispatch_16.ListB, Motion=Z_27)  # -> Geometry, Transform

# ----
rev_3 = ReverseList(List=pt_21)
milling_bit_radius_8 = Panel(milling_bit_radius)
item_23 = ListItem(List=rev_3, Index=0, Wrap=True)
devec = DeconstructVector(Vector=item_23)  # -> XComponent, YComponent, ZComponent
subtraction_14 = Subtraction(A=devec.ZComponent, B=milling_bit_radius_8)
abs = Absolute(Value=subtraction_14)

joined_meshes_2 = Mesh(mjoin_2)
neg_14 = Negative(Value="0.01")
pt_28 = Point(move_25.Geometry)
meshcp_8 = MeshClosestPoint(Point=pt_28, Mesh=joined_meshes_2)  # -> Point, Index, Parameter
Z_28 = UnitZ(Factor=neg_14)
move_26 = Move(Geometry=meshcp_8.Point, Motion=Z_28)  # -> Geometry, Transform
vertical_angle_cutoff_2 = Panel(vertical_angle_cutoff)
meshcp_9 = MeshClosestPoint(Point=move_26.Geometry, Mesh=joined_meshes_2)  # -> Point, Index, Parameter
meval_5 = MeshEval(Mesh=joined_meshes_2, Parameter=meshcp_9.Parameter)  # -> Point, Normal, Colour
Z_29 = UnitZ(Factor=1)
angle_4 = Angle(VectorA=meval_5.Normal, VectorB=Z_29)  # -> Angle, Reflex
deg_3 = Degrees(Radians=angle_4.Angle)
larger_10 = LargerThan(FirstNumber=deg_3, SecondNumber=vertical_angle_cutoff_2)  # -> LargerThan, OrEqualTo
dispatch_17 = Dispatch(List=pt_28, DispatchPattern=larger_10.LargerThan)  # -> ListA, ListB

vec2pt_4 = Vector2Pt(PointA=meshcp_9.Point, PointB=pt_28, Unitize=False)  # -> Vector, Length
dispatch_18 = Dispatch(List=vec2pt_4.Vector, DispatchPattern=larger_10.LargerThan)  # -> ListA, ListB
angle_5 = Angle(VectorA=dispatch_18.ListB, VectorB=Z_16)  # -> Angle, Reflex
deg_4 = Degrees(Radians=angle_5.Angle)
larger_11 = LargerThan(FirstNumber=deg_4, SecondNumber="90")  # -> LargerThan, OrEqualTo
dispatch_19 = Dispatch(List=dispatch_17.ListB, DispatchPattern=larger_11.LargerThan)  # -> ListA, ListB

pt_29 = Point(dispatch_19.ListB)

# ---- group: Remove points in cavity
milling_bit_radius_9 = Panel(multiplication_7)
joined_meshes_3 = Mesh(mjoin_2)
pt_30 = Point(pt_29)
meshcp_10 = MeshClosestPoint(Point=pt_30, Mesh=joined_meshes_3)  # -> Point, Index, Parameter
pdecon_11 = Deconstruct(Point=pt_30)  # -> XComponent, YComponent, ZComponent
pdecon_12 = Deconstruct(Point=meshcp_10.Point)  # -> XComponent, YComponent, ZComponent
pt_31 = ConstructPoint(XCoordinate=pdecon_12.XComponent, YCoordinate=pdecon_12.YComponent, ZCoordinate=pdecon_11.ZComponent)
vec2pt_5 = Vector2Pt(PointA=pt_30, PointB=pt_31, Unitize=False)  # -> Vector, Length
amp_5 = Amplitude(Vector=vec2pt_5.Vector, Amplitude=milling_bit_radius_9)
series_4 = Series(Start=0, Step=Slider(45, range=0..100), Count=Slider(8, range=0..10))
move_27 = Move(Geometry=pt_30, Motion=amp_5)  # -> Geometry, Transform
xy_19 = XYPlane(Origin=pt_30)
rad_4 = Radians(Degrees=series_4)
rotate_4 = Rotate(Geometry=move_27.Geometry, Angle=rad_4, Plane=xy_19)  # -> Geometry, Transform
Z_30 = UnitZ(Factor=1)
meshray_6 = MeshRay(Mesh=joined_meshes_3, Point=rotate_4.Geometry, Direction=Z_30)  # -> Point, Hit
sort_5 = SortList(Keys=meshray_6.Hit)  # -> Keys, ValuesA
rev_4 = ReverseList(List=sort_5.Keys)
item_24 = ListItem(List=rev_4, Index=0, Wrap=True)
dispatch_20 = Dispatch(List=pt_30, DispatchPattern=item_24)  # -> ListA, ListB
pt_32 = Point(dispatch_20.ListB)

# ----
pt_33 = Point(pt_32)
pline_10 = PolyLine(Vertices=pt_33, Closed=False)
clean_9 = CleanTree(RemoveNulls=True, RemoveInvalid=True, RemoveEmpty=True, Tree=pline_10)

crv_16 = Curve(clean_9)
explode_5 = Explode(Curve=crv_16, Recursive=True)  # -> Segments, Vertices
project_6 = Project(Geometry=explode_5.Segments, Plane=xy_10)  # -> Geometry, Transform
colom_3 = CollisionOneMany(Collider=project_6.Geometry, Obstacles=flatten(project_3.Geometry))  # -> Collision, Index

colom_4 = CollisionOneMany(Collider=explode_5.Segments, Obstacles=flatten(joined_meshes))  # -> Collision, Index
or_2 = GateOr(A=colom_4.Collision, B=colom_3.Collision)

dispatch_21 = Dispatch(List=explode_5.Segments, DispatchPattern=or_2)  # -> ListA, ListB
crv_17 = Curve(dispatch_21.ListB)

explode_6 = Explode(Curve=crv_17, Recursive=True)  # -> Segments, Vertices; disabled
simplify_16 = SimplifyTree(Tree=explode_6.Segments, Front=False)
curvepoint_2 = PointOnCurve(simplify_16, parameter=0.5)
project_7 = Project(Geometry=curvepoint_2, Plane=xy_10)  # -> Geometry, Transform; disabled
# Fix: make slices from donut shape work
panel_20 = Panel("0.6")
incurves = PointInCurves(Point=project_7.Geometry, Curves=flatten(project_3.Geometry))  # -> Relationship, Index, Point
multiplication_35 = Multiplication(A=incurves.Relationship, B=panel_20)
int_6 = Integer(multiplication_35)
dispatch_22 = Dispatch(List=simplify_16, DispatchPattern=int_6)  # -> ListA, ListB

collison_free_polylines = Curve(crv_17)

explode_7 = Explode(Curve=collison_free_polylines, Recursive=True)  # -> Segments, Vertices
number_of_checking_points_per_segment = Panel("4")
simplify_17 = SimplifyTree(Tree=explode_7.Segments, Front=False)
divide = DivideCurve(Curve=simplify_17, Count=number_of_checking_points_per_segment, Kinks=False)  # -> Points, Tangents, Parameters
mesh_13 = Mesh(mjoin_4)
cull_i_3 = CullIndex(List=divide.Points, Indices="0", Wrap=True)
rev_5 = ReverseList(List=cull_i_3)
cull_i_4 = CullIndex(List=rev_5, Indices="0", Wrap=True)
simplify_18 = SimplifyTree(Tree=cull_i_4, Front=False)

pt_34 = Point(simplify_18)

meshcp_11 = MeshClosestPoint(Point=pt_34, Mesh=mesh_13)  # -> Point, Index, Parameter
milling_bit_radius_10 = Panel(milling_bit_radius)
dist_4 = Distance(PointA=pt_34, PointB=meshcp_11.Point)
subtraction_15 = Subtraction(A=dist_4, B=milling_bit_radius_10)
abs_2 = Absolute(Value=subtraction_15)
sort_6 = SortList(Keys=abs_2)  # -> Keys, ValuesA
rev_6 = ReverseList(List=sort_6.Keys)
multiplication_36 = Multiplication(A=milling_bit_radius_10, B=ratio_for_cull_2)
item_25 = ListItem(List=rev_6, Index=0, Wrap=True)
larger_12 = LargerThan(FirstNumber=item_25, SecondNumber=multiplication_36)  # -> LargerThan, OrEqualTo
dispatch_23 = Dispatch(List=item_25, DispatchPattern=larger_12.LargerThan)  # -> ListA, ListB
dispatch_24 = Dispatch(List=simplify_17, DispatchPattern=larger_12.LargerThan)  # -> ListA, ListB
# For higher sampling number fix bridge curves beeing pulled under overhangs
larger_13 = LargerThan(FirstNumber=dispatch_23.ListB, SecondNumber=threshold_for_rebuild)  # -> LargerThan, OrEqualTo
crv_18 = Curve(dispatch_24.ListB)
dispatch_25 = Dispatch(List=crv_18, DispatchPattern=larger_13.LargerThan)  # -> ListA, ListB

multiplication_37 = Multiplication(A=number_of_checking_points_per_segment, B=panel_15)

# ---- group: Align curve directions
curves_for_aligned_direction_2 = Curve(merged_overlapping_curves)
graft_4 = GraftTree(Tree=curves_for_aligned_direction_2, IncludeEmptyLists=True, IncludeNullItems=True)
offset_6 = Offset(Curve=graft_4, Distance="0.01", Plane=PlaneXY(0, 0, 0), Corners=2)
end_5 = EndPoints(Curve=offset_6)  # -> Start, End
pshift_31 = ShiftPaths(Data=end_5.Start, Offset=-1)
incurve_2 = PointInCurve(Point=pshift_31, Curve=graft_4)  # -> Relationship, Point
multiplication_38 = Multiplication(A=incurve_2.Relationship, B="0.5")
round_5 = Round(Number=multiplication_38)  # -> Nearest, Floor, Ceiling
crv_19 = Curve(graft_4)
int_7 = Integer(round_5.Nearest)
flip_4 = FlipCurve(Curve=crv_19)  # -> Curve, Flag
weave_4 = Weave(Pattern=int_7, Stream0=flip_4.Curve, Stream1=crv_19, NullGaps=False)
pshift_32 = ShiftPaths(Data=weave_4, Offset=-1)

# ----
flip_5 = FlipCurve(Curve=pshift_32)  # -> Curve, Flag
filter_11 = StreamFilter(Gate=use_inside_cutting_3, Stream0=pshift_32, Stream1=flip_5.Curve)

# ---- group: Align curve directions (continued)
aligned_curves_2 = Curve(filter_11)

# ----
simplify_19 = SimplifyTree(Tree=aligned_curves_2, Front=False)

divide_2 = DivideCurve(Curve=dispatch_25.ListA, Count="1", Kinks=False)  # -> Points, Tangents, Parameters
pline_11 = PolyLine(Vertices=divide_2.Points, Closed=False)
clean_10 = CleanTree(RemoveNulls=True, RemoveInvalid=True, RemoveEmpty=False, Tree=pline_11)
pshift_33 = ShiftPaths(Data=clean_10, Offset=-1)
curvepoint_3 = PointOnCurve(pshift_33, parameter=0.496)
Z_31 = UnitZ(Factor="0.1")
move_28 = Move(Geometry=curvepoint_3, Motion=Z_31)  # -> Geometry, Transform
mjoin_5 = MeshJoin(Meshes=meshes_for_3d_milling_2)
simplify_20 = SimplifyTree(Tree=move_28.Geometry, Front=False)
Z_32 = UnitZ(Factor=1)
meshray_7 = MeshRay(Mesh=mjoin_5, Point=simplify_20, Direction=Z_32)  # -> Point, Hit
dispatch_26 = Dispatch(List=pshift_33, DispatchPattern=meshray_7.Hit)  # -> ListA, ListB
lng_12 = ListLength(List=dispatch_26.ListA)
crv_20 = Curve(dispatch_26.ListB)
dup_2 = DuplicateData(Data="0", Number=lng_12, Order=True)

pshift_34 = ShiftPaths(Data=dup_2, Offset=-1)

weave_5 = Weave(Pattern=[0, 1], Stream0=crv_20, Stream1=pshift_34, NullGaps=False)
weave_6 = Weave(Pattern=larger_13.LargerThan, Stream0=dispatch_25.ListB, Stream1=weave_5, NullGaps=False)
crv_21 = Curve(weave_6)
clean_11 = CleanTree(RemoveNulls=True, RemoveInvalid=True, RemoveEmpty=False, Tree=crv_21)

crv_22 = Curve(clean_11)
pshift_35 = ShiftPaths(Data=crv_22, Offset="-2")
null = NullItem(Item=pshift_35)  # -> NullFlags, InvalidFlags, Description
flatten_6 = FlattenTree(Tree=crv_22, Path="{0}")
item_26 = ListItem(List=flatten(null.InvalidFlags), Index=0, Wrap=True)
filter_12 = StreamFilter(Gate=item_26, Stream0=pshift_35, Stream1=flatten_6)
join_5 = JoinCurves(Curves=filter_12, Preserve=False)
cp_9 = ControlPoints(Curve=join_5)  # -> Points, Weights, Knots

pdecon_13 = Deconstruct(Point=cp_9.Points)  # -> XComponent, YComponent, ZComponent
nblur = BlurNumbers(
    Numbers=pdecon_13.ZComponent,
    Strength=Slider(1, range=0..1),
    Iterations=Slider(10, range=0..10),
    Lock=Toggle(True),
    Wrap=False)

milling_bit_radius_11 = Panel(milling_bit_radius)
mesh_14 = Mesh(mjoin_2)
points_to_offset_with_tool_radius = Point(cp_9.Points)
meshcp_12 = MeshClosestPoint(Point=points_to_offset_with_tool_radius, Mesh=mesh_14)  # -> Point, Index, Parameter
dist_5 = Distance(PointA=points_to_offset_with_tool_radius, PointB=meshcp_12.Point)
vec2pt_6 = Vector2Pt(PointA=meshcp_12.Point, PointB=points_to_offset_with_tool_radius, Unitize=False)  # -> Vector, Length
subtraction_16 = Subtraction(A=milling_bit_radius_11, B=dist_5)
amp_6 = Amplitude(Vector=vec2pt_6.Vector, Amplitude=subtraction_16)
move_29 = Move(Geometry=points_to_offset_with_tool_radius, Motion=amp_6)  # -> Geometry, Transform
points_at_tool_radius_distance_from_mesh = Point(move_29.Geometry)

avr_2 = Average(Input=pdecon_13.ZComponent)
pt_35 = ConstructPoint(XCoordinate=pdecon_13.XComponent, YCoordinate=pdecon_13.YComponent, ZCoordinate=nblur)
pline_12 = PolyLine(Vertices=pt_35, Closed=False)
smoothpline_2 = SmoothPolyline(Polyline=pline_12, Strength=1, Times=Slider(5, range=0..10))
redpline_4 = Reduce(Polyline=smoothpline_2, Tolerance="0.02")  # -> Polyline, Reduction
cp_10 = ControlPoints(Curve=redpline_4.Polyline)  # -> Points, Weights, Knots
pt_36 = Point(cp_10.Points)

simplify_21 = SimplifyTree(Tree=points_at_tool_radius_distance_from_mesh, Front=False)
mjoin_6 = MeshJoin(Meshes=meshes_for_3d_milling_2)
Z_33 = UnitZ(Factor=1)
meshray_8 = MeshRay(Mesh=mjoin_6, Point=simplify_21, Direction=Z_33)  # -> Point, Hit
dispatch_27 = Dispatch(List=simplify_21, DispatchPattern=meshray_8.Hit)  # -> ListA, ListB
pt_37 = Point(dispatch_27.ListB)

pline_13 = PolyLine(Vertices=pt_37, Closed=False)
redpline_5 = Reduce(Polyline=pline_13, Tolerance=reduction_tolerance_5)  # -> Polyline, Reduction
len_5 = Length(Curve=redpline_5.Polyline)
smaller_9 = SmallerThan(FirstNumber=len_5, SecondNumber=multiplication_19)  # -> SmallerThan, OrEqualTo
dispatch_28 = Dispatch(List=redpline_5.Polyline, DispatchPattern=smaller_9.SmallerThan)  # -> ListA, ListB
crv_23 = Curve(dispatch_28.ListB)
filter_13 = StreamFilter(Gate=generate_roughing_3, Stream1=crv_23)
len_6 = Length(Curve=flatten(dispatch_28.ListB))

simplify_22 = SimplifyTree(Tree=filter_13, Front=False)
pshift_36 = ShiftPaths(Data=simplify_22, Offset=-1)
null_2 = NullItem(Item=pshift_36)  # -> NullFlags, InvalidFlags, Description
flatten_7 = FlattenTree(Tree=null_2.NullFlags, Path="{0}")
item_27 = ListItem(List=flatten_7, Index=0, Wrap=True)
filter_14 = StreamFilter(Gate=item_27, Stream0=pshift_36, Stream1=simplify_22)
pshift_37 = ShiftPaths(Data=filter_14, Offset=-1)
null_3 = NullItem(Item=pshift_37)  # -> NullFlags, InvalidFlags, Description
flatten_8 = FlattenTree(Tree=null_3.NullFlags, Path="{0}")
item_28 = ListItem(List=flatten_8, Index=0, Wrap=True)
filter_15 = StreamFilter(Gate=item_28, Stream0=pshift_37, Stream1=filter_14)
flatten_9 = FlattenTree(Tree=filter_15, Path="{0}")
pshift_38 = ShiftPaths(Data=filter_15, Offset=-1)
null_4 = NullItem(Item=pshift_38)  # -> NullFlags, InvalidFlags, Description
flatten_10 = FlattenTree(Tree=null_4.NullFlags, Path="{0}")
item_29 = ListItem(List=flatten_10, Index=0, Wrap=True)
filter_16 = StreamFilter(Gate=item_29, Stream0=pshift_38, Stream1=flatten_9)
rev_7 = ReverseList(List=filter_16)

ma_2 = MassAddition(Input=len_6)  # -> Result, PartialResults
panel_21 = Panel(ma_2.Result)

division_13 = Division(A=roughing_stepover_2, B=finish_stepover)
round_6 = Round(Number=division_13)  # -> Nearest, Floor, Ceiling
# Use cutout as last roughing pass?
# Fix: cull logic. not always true. make possible use all finsih for roughing
toggle = BooleanToggle(True)
smaller_10 = SmallerThan(FirstNumber=round_6.Floor, SecondNumber="2")  # -> SmallerThan, OrEqualTo
dup_3 = DuplicateData(Data=Toggle(False), Number=round_6.Floor, Order=True)
merge_7 = Merge(Data1=flatten(toggle), Data2=flatten(dup_3))
cull = CullPattern(List=rev_7, CullPattern=merge_7)
filter_17 = StreamFilter(Gate=smaller_10.SmallerThan, Stream0=cull, Stream1=rev_7)
clean_12 = CleanTree(RemoveNulls=True, RemoveInvalid=True, RemoveEmpty=True, Tree=filter_17)
rev_8 = ReverseList(List=clean_12)

# ----
# Fix: pick correct bottom lines when opn toolpaths in bottom
divide_3 = DivideCurve(Curve=rev_7, Count=10, Kinks=False)  # -> Points, Tangents, Parameters; disabled
pdecon_14 = Deconstruct(Point=divide_3.Points)  # -> XComponent, YComponent, ZComponent
avr_3 = Average(Input=pdecon_14.ZComponent)
pshift_39 = ShiftPaths(Data=avr_3, Offset=-1)
panel_22 = Panel(pshift_39)
filter_18 = StreamFilter(Gate=generate_finishing_3, Stream1=dispatch_28.ListB)

crv_24 = Curve(rev_8)
cp_11 = ControlPoints(Curve=crv_24)  # -> Points, Weights, Knots
points_to_offset_with_tool_radius_2 = Point(cp_11.Points)
milling_bit_radius_12 = Panel(milling_bit_radius)
mesh_15 = Mesh(mjoin_2)
roughing_material_leftover_2 = Panel(roughing_material_leftover)
addition_8 = Addition(A=milling_bit_radius_12, B=roughing_material_leftover_2)
meshcp_13 = MeshClosestPoint(Point=points_to_offset_with_tool_radius_2, Mesh=mesh_15)  # -> Point, Index, Parameter
dist_6 = Distance(PointA=points_to_offset_with_tool_radius_2, PointB=meshcp_13.Point)
vec2pt_7 = Vector2Pt(PointA=meshcp_13.Point, PointB=points_to_offset_with_tool_radius_2, Unitize=False)  # -> Vector, Length
subtraction_17 = Subtraction(A=addition_8, B=dist_6)
amp_7 = Amplitude(Vector=vec2pt_7.Vector, Amplitude=subtraction_17)
move_30 = Move(Geometry=points_to_offset_with_tool_radius_2, Motion=amp_7)  # -> Geometry, Transform
points_at_tool_radius_distance_from_mesh_2 = Point(move_30.Geometry)
pline_14 = PolyLine(Vertices=points_at_tool_radius_distance_from_mesh_2, Closed=False)

move_31 = Move(Geometry=filter_18, Motion=Z_17)  # -> Geometry, Transform
clean_13 = CleanTree(RemoveNulls=True, RemoveInvalid=True, RemoveEmpty=False, Tree=move_31.Geometry)
simplify_23 = SimplifyTree(Tree=clean_13, Front=False)
flatten_11 = FlattenTree(Tree=simplify_23, Path="{0}")
pshift_40 = ShiftPaths(Data=simplify_23, Offset="-1")
pshift_41 = ShiftPaths(Data=simplify_23, Offset="-2")
item_30 = ListItem(List=flatten(pshift_41), Index=0, Wrap=True)
null_5 = NullItem(Item=item_30)  # -> NullFlags, InvalidFlags, Description
filter_19 = StreamFilter(Gate=null_5.NullFlags, Stream0=pshift_41, Stream1=pshift_40)
filter_20 = StreamFilter(Gate=smaller_4.SmallerThan, Stream0=filter_19, Stream1=flatten_11)
finishing_toolpaths = Curve(filter_20)

cls_2 = Closed(Curve=finishing_toolpaths)  # -> Closed, Periodic
dispatch_29 = Dispatch(List=finishing_toolpaths, DispatchPattern=cls_2.Closed)  # -> ListA, ListB
end_6 = EndPoints(Curve=dispatch_29.ListB)  # -> Start, End
sort_pt = SortPoints(Points=end_6.Start)  # -> Points, Indices
item_31 = ListItem(List=dispatch_29.ListB, Index=sort_pt.Indices, Wrap=True)
rev_9 = ReverseList(List=item_31)
dispatch_30 = Dispatch(List=item_31, DispatchPattern=[True, False])  # -> ListA, ListB
flip_6 = FlipCurve(Curve=dispatch_30.ListB)  # -> Curve, Flag
weave_7 = Weave(Pattern=[0, 1], Stream0=dispatch_30.ListA, Stream1=flip_6.Curve, NullGaps=False)
weave_8 = Weave(Pattern=cls_2.Closed, Stream0=weave_7, Stream1=dispatch_29.ListA, NullGaps=False)

milling_bit_radius_13 = Panel(milling_bit_radius)
neg_15 = Negative(Value=milling_bit_radius_13)
pshift_42 = ShiftPaths(Data=pline_14, Offset=-1)
Z_34 = UnitZ(Factor=neg_15)
move_32 = Move(Geometry=pshift_42, Motion=Z_34)  # -> Geometry, Transform
xz_4 = XZPlane(Origin=Point(0, 0, 0))
pass_depth_cutout = Panel(pass_depth_roughing_and_cutout)
x_tremez_2 = Extremes(Curve=move_32.Geometry, Plane=xz_4)  # -> Highest, Lowest
devec_2 = DeconstructVector(Vector=x_tremez_2.Lowest)  # -> XComponent, YComponent, ZComponent
division_14 = Division(A=devec_2.ZComponent, B=pass_depth_cutout)
round_7 = Round(Number=division_14)  # -> Nearest, Floor, Ceiling
neg_16 = Negative(Value=round_7.Floor)

flatten_12 = FlattenTree(Tree=weave_8, Path="{0}")
clean_14 = CleanTree(RemoveNulls=True, RemoveInvalid=True, RemoveEmpty=False, Tree=flatten_12)
finishing_toolpaths_2 = Curve(clean_14)
smaller_11 = SmallerThan(FirstNumber=neg_16, SecondNumber="2")  # -> SmallerThan, OrEqualTo
end_7 = EndPoints(Curve=finishing_toolpaths_2)  # -> Start, End
dispatch_31 = Dispatch(List=neg_16, DispatchPattern=smaller_11.SmallerThan)  # -> ListA, ListB
crv_25 = Curve(move_32.Geometry)
subtraction_18 = Subtraction(A=dispatch_31.ListB, B="1")
dispatch_32 = Dispatch(List=crv_25, DispatchPattern=smaller_11.SmallerThan)  # -> ListA, ListB

series_5 = Series(Start=pass_depth_cutout, Step=pass_depth_cutout, Count=subtraction_18)
clean_15 = CleanTree(RemoveNulls=True, RemoveInvalid=True, RemoveEmpty=True, Tree=series_5)

shift_3 = ShiftList(List=end_7.Start, Shift="1", Wrap=True)
crv_26 = Curve(dispatch_32.ListB)
ln_11 = Line(StartPoint=end_7.End, EndPoint=shift_3)
Z_35 = UnitZ(Factor=clean_15)
move_33 = Move(Geometry=graft(crv_26), Motion=Z_35)  # -> Geometry, Transform
rev_10 = ReverseList(List=move_33.Geometry)
flatten_13 = FlattenTree(Tree=rev_10, Path="{0}")
crv_27 = Curve(flatten_13)

len_7 = Length(Curve=ln_11)
lng_13 = ListLength(List=finishing_toolpaths_2)
larger_14 = LargerThan(FirstNumber=len_7, SecondNumber=multiplication_20)  # -> LargerThan, OrEqualTo
series_6 = Series(Start=0, Step=1, Count=lng_13)
dispatch_33 = Dispatch(List=series_6, DispatchPattern=larger_14.LargerThan)  # -> ListA, ListB

# ---- group: Flip every second curve to prep for weaving
cls_3 = Closed(Curve=crv_27)  # -> Closed, Periodic
dispatch_34 = Dispatch(List=crv_27, DispatchPattern=cls_3.Closed)  # -> ListA, ListB
dispatch_35 = Dispatch(List=dispatch_34.ListB, DispatchPattern=[True, False])  # -> ListA, ListB
flip_7 = FlipCurve(Curve=dispatch_35.ListB)  # -> Curve, Flag
weave_9 = Weave(Pattern=[0, 1], Stream0=dispatch_35.ListA, Stream1=flip_7.Curve, NullGaps=False)
weave_10 = Weave(Pattern=cls_3.Closed, Stream0=weave_9, Stream1=dispatch_34.ListA, NullGaps=False)

# ----
replace = ReplaceItems(List=ln_11, Indices=dispatch_33.ListA, Wrap=False)
end_8 = EndPoints(Curve=graft(replace))  # -> Start, End
move_34 = Move(Geometry=end_8.Start, Motion=Z_18)  # -> Geometry, Transform
move_35 = Move(Geometry=end_8.End, Motion=Z_18)  # -> Geometry, Transform
nurbs_2 = NurbsCurve(Vertices=[end_8.Start, move_34.Geometry, move_35.Geometry, end_8.End], Degree=3, Periodic=False)  # -> Curve, Length, Domain
rouging_toolpaths = Curve(weave_10)
pshift_43 = ShiftPaths(Data=nurbs_2.Curve, Offset=-1)
item_32 = ListItem(List=weave_10, Index=Slider(0, range=0..100), Wrap=False)
filter_21 = StreamFilter(Gate=make_flea_jump_transitions_3, Stream0=replace, Stream1=pshift_43)
flatten_14 = FlattenTree(Tree=simplify_23, Path="{0}")
weave_11 = Weave(Pattern=[0, 1], Stream0=finishing_toolpaths_2, Stream1=filter_21, NullGaps=False)
clean_16 = CleanTree(RemoveNulls=True, RemoveInvalid=True, RemoveEmpty=False, Tree=flatten_14)
clean_17 = CleanTree(RemoveNulls=True, RemoveInvalid=True, RemoveEmpty=False, Tree=weave_11)
connected_finishing_toolpaths = Curve(clean_17)
finishing_toolpaths_3 = Curve(clean_16)
rouging_toolpaths_2 = Curve(rouging_toolpaths)
filter_22 = StreamFilter(Gate=connect_toolpaths_levels_3, Stream0=finishing_toolpaths_3, Stream1=connected_finishing_toolpaths)
finishing_toolpaths_4 = Curve(filter_22)
len_8 = Length(Curve=flatten(finishing_toolpaths_4))  # disabled
finishing_toolpaths_5 = Curve(finishing_toolpaths_4)
ma_3 = MassAddition(Input=len_8)  # -> Result, PartialResults
division_15 = Division(A=ma_3.Result, B=Slider(30, range=0..100))
len_9 = Length(Curve=finishing_toolpaths_5)  # disabled
division_16 = Division(A=division_15, B=Slider(60, range=0..100))
ma_4 = MassAddition(Input=len_9)  # -> Result, PartialResults
panel_23 = Panel(division_16)
panel_24 = Panel(ma_4.Result)

# ---- group: Detect curves inside curves
aligned_curves_3 = Curve(simplify_19)
end_9 = EndPoints(Curve=aligned_curves_3)  # -> Start, End
graft_5 = GraftTree(Tree=aligned_curves_3, IncludeEmptyLists=True, IncludeNullItems=True)

# ----
flatten_15 = FlattenTree(Tree=end_9.Start, Path="{0}")

# ---- group: Detect curves inside curves (continued)
incurve_3 = PointInCurve(Point=flatten_15, Curve=graft_5)  # -> Relationship, Point
multiplication_39 = Multiplication(A=incurve_3.Relationship, B="0.5")
round_8 = Round(Number=multiplication_39)  # -> Nearest, Floor, Ceiling
int_8 = Integer(round_8.Floor)

# ----
sort_7 = SortList(Keys=int_8)  # -> Keys, ValuesA
rev_11 = ReverseList(List=sort_7.Keys)
item_33 = ListItem(List=rev_11, Index=0, Wrap=True)
pshift_44 = ShiftPaths(Data=item_33, Offset=-1)
lng_14 = ListLength(List=pshift_44)
smaller_12 = SmallerThan(FirstNumber=lng_14, SecondNumber="2")  # -> SmallerThan, OrEqualTo
dispatch_36 = Dispatch(List=pshift_44, DispatchPattern=smaller_12.SmallerThan)  # -> ListA, ListB
not_2 = GateNot(A=dispatch_36.ListA)
weave_12 = Weave(Pattern=[0, 1], Stream0=dispatch_36.ListB, Stream1=not_2, NullGaps=False)

# ---- group: Detect curves inside curves (continued)
dispatch_37 = Dispatch(List=aligned_curves_3, DispatchPattern=weave_12)  # -> ListA, ListB
curves_outside = Curve(dispatch_37.ListA)
curves_inside = Curve(dispatch_37.ListB)

# ----
curves_for_offset_outwards = Curve(curves_outside)
curves_for_offset_inwards = Curve(curves_inside)
redpline_6 = Reduce(Polyline=curves_for_offset_outwards, Tolerance="0.02")  # -> Polyline, Reduction
redpline_7 = Reduce(Polyline=curves_for_offset_inwards, Tolerance="0.02")  # -> Polyline, Reduction
offset_7 = Offset(Curve=redpline_6.Polyline, Distance=neg_6, Plane=operation_plane_2, Corners=2)
offset_8 = Offset(Curve=redpline_7.Polyline, Distance=compensated_tool_radius, Plane=operation_plane_2, Corners=2)
cls_4 = Closed(Curve=offset_7)  # -> Closed, Periodic
cls_5 = Closed(Curve=offset_8)  # -> Closed, Periodic
safe_offset_curve = SafeOffsetCurve(offset_amount=compensated_tool_radius, curves_to_offset=redpline_6.Polyline)  # -> error_corrected_curves_outside_2, error_corrected_curves_inside_2
safe_offset_curve_2 = SafeOffsetCurve(offset_amount=compensated_tool_radius, curves_to_offset=redpline_7.Polyline)  # -> error_corrected_curves_outside_2, error_corrected_curves_inside_2
flip_8 = FlipCurve(Curve=safe_offset_curve.error_corrected_curves_outside_2)  # -> Curve, Flag
p_n_c_4 = PickNChoose(Pattern=cls_5.Closed, Stream0=safe_offset_curve_2.error_corrected_curves_inside_2, Stream1=offset_8)
p_n_c_5 = PickNChoose(Pattern=cls_4.Closed, Stream0=flip_8.Curve, Stream1=offset_7)
flip_9 = FlipCurve(Curve=p_n_c_4)  # -> Curve, Flag
outside_cutout_curves = Curve(p_n_c_5)
inside_cutout_curves = Curve(flip_9.Curve)

outside_cutout_curves_2 = Curve(outside_cutout_curves)
inside_cutout_curves_2 = Curve(inside_cutout_curves)
inside_outline_curves = Curve(inside_cutout_curves_2)
end_10 = EndPoints(Curve=inside_outline_curves)  # -> Start, End
incurves_2 = PointInCurves(Point=end_10.Start, Curves=outside_cutout_curves_2)  # -> Relationship, Index, Point
addition_9 = Addition(A=incurves_2.Index, B="1")
ins = InsertItems(List=outside_cutout_curves_2, Item=inside_outline_curves, Indices=incurves_2.Index, Wrap=True)

merge_8 = Merge(Data1=outside_cutout_curves, Data2=inside_cutout_curves)  # disabled

# ---- group: Flip curves for climb direction
sorted_inside_and_outside_curves = Curve(ins)
use_climb_direction_3 = Panel("0")
flip_10 = FlipCurve(Curve=sorted_inside_and_outside_curves)  # -> Curve, Flag
filter_23 = StreamFilter(Gate=use_climb_direction_3, Stream0=flip_10.Curve, Stream1=sorted_inside_and_outside_curves)
sorted_inside_and_outside_curves_2 = Curve(filter_23)

# ----
sorted_inside_and_outside_curves_3 = Curve(filter_23)
filter_24 = StreamFilter(Gate=generate_cutout_3, Stream1=sorted_inside_and_outside_curves_2)

# ---- group: Move cutout toolpaths to cut depths
extra_cut_depth_2 = Panel(addition)
cutout_depth_2 = Panel(cutout_depth)
cls_6 = Closed(Curve=outside_cutout_curves)  # -> Closed, Periodic
cull_2 = CullPattern(List=cutout_depth_2, CullPattern=cls_6.Closed)
simplify_24 = SimplifyTree(Tree=filter_24, Front=False)
clean_18 = CleanTree(RemoveNulls=True, RemoveInvalid=True, RemoveEmpty=True, Tree=cull_2)
clean_19 = CleanTree(RemoveNulls=True, RemoveInvalid=True, RemoveEmpty=False, Tree=simplify_24)
simplify_25 = SimplifyTree(Tree=clean_18, Front=False)
addition_10 = Addition(A=simplify_25, B=extra_cut_depth_2)
sorted_inside_and_outside_curves_4 = Curve(clean_19)
pass_depth_cutout_2 = Panel(pass_depth_roughing_and_cutout)
cut_depth_cutout_2 = Panel(addition_10)
division_17 = Division(A=cut_depth_cutout_2, B=pass_depth_cutout_2)
graft_6 = GraftTree(Tree=sorted_inside_and_outside_curves_4, IncludeEmptyLists=True, IncludeNullItems=True)
round_9 = Round(Number=division_17)  # -> Nearest, Floor, Ceiling
division_18 = Division(A=cut_depth_cutout_2, B=round_9.Ceiling)
actual_pass_depth = Panel(division_18)
series_7 = Series(Start=actual_pass_depth, Step=actual_pass_depth, Count=round_9.Ceiling)
neg_17 = Negative(Value=series_7)
Z_36 = UnitZ(Factor=neg_17)
move_36 = Move(Geometry=graft_6, Motion=Z_36)  # -> Geometry, Transform
flatten_16 = FlattenTree(Tree=move_36.Geometry, Path="{0}")

# ----
filter_25 = StreamFilter(Gate=generate_roughing_4, Stream1=sorted_inside_and_outside_curves_2)
cutout_curves = Curve(flatten_16)
item_34 = ListItem(List=cutout_curves, Index=Slider(10, range=0..10), Wrap=True)
cutout_curves_2 = Curve(cutout_curves)
len_10 = Length(Curve=cutout_curves_2)  # disabled
ma_5 = MassAddition(Input=len_10)  # -> Result, PartialResults
panel_25 = Panel(ma_5.Result)

extra_cut_depth_3 = Panel(addition)
roughing_material_leftover_3 = Panel(roughing_material_leftover)
cutout_depth_3 = Panel(abs)
simplify_26 = SimplifyTree(Tree=filter_25, Front=False)
clean_20 = CleanTree(RemoveNulls=True, RemoveInvalid=True, RemoveEmpty=False, Tree=simplify_26)
cls_7 = Closed(Curve=outside_cutout_curves)  # -> Closed, Periodic
cull_3 = CullPattern(List=cutout_depth_3, CullPattern=cls_7.Closed)
clean_21 = CleanTree(RemoveNulls=True, RemoveInvalid=True, RemoveEmpty=True, Tree=cull_3)
simplify_27 = SimplifyTree(Tree=clean_21, Front=False)
addition_11 = Addition(A=simplify_27, B=extra_cut_depth_3)
pass_depth_cutout_3 = Panel(pass_depth_roughing_and_cutout)
cut_depth_cutout_3 = Panel(addition_11)
division_19 = Division(A=cut_depth_cutout_3, B=pass_depth_cutout_3)
round_10 = Round(Number=division_19)  # -> Nearest, Floor, Ceiling
division_20 = Division(A=cut_depth_cutout_3, B=round_10.Ceiling)
actual_pass_depth_2 = Panel(division_20)
subtraction_19 = Subtraction(A=round_10.Ceiling, B="1")
series_8 = Series(Start=actual_pass_depth_2, Step=actual_pass_depth_2, Count=subtraction_19)
neg_18 = Negative(Value=series_8)
Z_37 = UnitZ(Factor=neg_18)

offset_9 = Offset(Curve=clean_20, Distance=roughing_material_leftover_3, Plane=PlaneXY(0, 0, 0), Corners=1)

sorted_inside_and_outside_curves_5 = Curve(offset_9)

graft_7 = GraftTree(Tree=sorted_inside_and_outside_curves_5, IncludeEmptyLists=True, IncludeNullItems=True)

move_37 = Move(Geometry=graft_7, Motion=Z_37)  # -> Geometry, Transform
flatten_17 = FlattenTree(Tree=move_37.Geometry, Path="{0}")

final_roughing_passes = Curve(flatten_17)  # disabled
final_roughing_passes_2 = Curve(final_roughing_passes)
merge_9 = Merge(Data1=rouging_toolpaths_2, Data2=final_roughing_passes_2)
rouging_toolpaths_3 = Curve(merge_9)
rouging_toolpaths_4 = Curve(rouging_toolpaths_3)
len_11 = Length(Curve=rouging_toolpaths_4)  # disabled
merge_10 = Merge(Data1=rouging_toolpaths_4, Data2=finishing_toolpaths_5, Data3=cutout_curves_2)
ma_6 = MassAddition(Input=len_11)  # -> Result, PartialResults
clean_22 = CleanTree(RemoveNulls=True, RemoveInvalid=True, RemoveEmpty=False, Tree=merge_10)
panel_26 = Panel(ma_6.Result)
_3d_mill_toolpaths = Curve(clean_22)

wip_3d_mill_toolpaths = Curve(_3d_mill_toolpaths)
merge_11 = Merge(
    Data1=flatten(drill.drill_toolpaths_3),
    Data2=flatten(pocket),
    Data3=flatten(engrave),
    Data4=flatten(wip_3d_mill_toolpaths),
    Data5=flatten(cutout))

_3d_mill_toolpaths_2 = Curve(flatten(wip_3d_mill_toolpaths))
shopbot_code_postprocessor = ShopBotCodePostProcessor(
    toolpath_curves=merge_11,
    tab_breps=tab_breps_2,
    feed_rate=feed_rate_2,
    plunge_rate=plunge_rate_2,
    safe_z_height=safe_z_height,
    use_spindle=use_spindle_2,
    spindle_speed=spindle_speed_2,
    ramp_plunges=ramp_plunges_2,
    ramp_angle=ramp_angle_2,
    use_custom_jog_home=use_custom_jog_home_2,
    custom_home_x=custom_jog_home_x_2,
    custom_home_y=custom_jog_home_y_2,
    deviation_tolerance=deviation_tolerance_2,
    job_name=job_name)  # -> shopbot_code_connect_panel_stream_and_sa, toolpath_preview_line_2, cut_transition_preview_line_2, cut_entry_preview_line_2, cut_exit_preview_line_2
preview_graphic_for_1_1_projection_on_ma = PreviewGraphicFor11ProjectionOnMachine(
    toolpath_curves=[pocket_toolpaths, cutout_toolpaths, engrave_toolpaths, _3d_mill_toolpaths_2],
    cutting_curves=cutting_curves,
    pocket_curves=pocket_curves,
    drill_preview_curves=drill_preview_geometry,
    expected_projected_size=expected_projected_size,
    measured_projected_size=measured_projected_size,
    position_correction_x=position_correction_x,
    position_correction_y=position_correction_y,
    rotation_correction=rotation_correction,
    svg_px_width="719",
    svg_px_heigth="1279")  # "Preview graphic for 1:1 projection on machine"
stream_and_save_as_svg = Panel(preview_graphic_for_1_1_projection_on_ma)

# ---- group: ShopBot code
stream_and_save_as_sbp = Panel(shopbot_code_postprocessor.shopbot_code_connect_panel_stream_and_sa)

# ---- group: Toolpath preview (continued)
preview_7 = CustomPreview(Geometry=shopbot_code_postprocessor.toolpath_preview_line_2, Shader=toolpaths)
preview_8 = CustomPreview(Geometry=shopbot_code_postprocessor.cut_transition_preview_line_2, Shader=jog_transitions)
preview_9 = CustomPreview(Geometry=shopbot_code_postprocessor.cut_entry_preview_line_2, Shader=cut_entries)
preview_10 = CustomPreview(Geometry=shopbot_code_postprocessor.cut_exit_preview_line_2, Shader=cut_exits)

# ----
len_12 = Length(Curve=[shopbot_code_postprocessor.cut_transition_preview_line_2, shopbot_code_postprocessor.cut_entry_preview_line_2, shopbot_code_postprocessor.cut_exit_preview_line_2])
ma_7 = MassAddition(Input=len_12)  # -> Result, PartialResults
panel_27 = Panel(ma_7.Result)

# ==== cluster DivideCurveEvenLenght: Calculates approximate curve length for even division
crv = ClusterInput()
crv_2 = Curve(crv)
B = ClusterInput()
len = Length(Curve=crv_2)
division = Division(A=len, B=B)
int = Integer(division)
divide = DivideCurve(Curve=crv_2, Count=int, Kinks=False)  # -> Points, Tangents, Parameters
P = ClusterOutput(divide.Points)

# ==== cluster SafeOffsetCurve: Always makes closed non intersecting curves from offset. Can handle extreme offset values.
curves_to_offset = ClusterInput()
offset_amount = ClusterInput()
curves_to_offset_2 = Curve(curves_to_offset)
offset_amount_2 = Number(offset_amount)
multiplication = Multiplication(A=offset_amount_2, B=Slider(0.05, range=0..1))
multiplication_2 = Multiplication(A=offset_amount_2, B=Slider(0.1, range=0..1))
curve_reduction_tolerance = Number(multiplication)
offset_fix_sample_distance = Number(multiplication_2)
topoly = CurveToPolyline(Curve=curves_to_offset_2, ToleranceDistance=curve_reduction_tolerance, ToleranceAngle=0)  # -> Polyline, Segments
neg = Negative(Value=offset_amount_2)
graft = GraftTree(Tree=topoly.Polyline, IncludeEmptyLists=True, IncludeNullItems=True)
num = Number([offset_amount_2, neg])
offset_l = OffsetLoose(Curve=graft, Distance=num)
crv = Curve(offset_l)
cp = ControlPoints(Curve=crv)  # -> Points, Weights, Knots
hull = ConvexHull(Points=cp.Points, Plane=PlaneXY(0, 0, 0))  # -> Hull, HullZ, Indices
len = Length(Curve=hull.Hull)
division = Division(A=len, B=offset_fix_sample_distance)
int = Integer(division)
dom = ConstructDomain(DomainStart=Slider(0, range=0..100), DomainEnd=Slider(500, range=0..10000))
constrain = Constrain(Number=int, Domain=dom)
pframes = PerpFrames(Curve=hull.Hull, Count=constrain, Align=True)  # -> Frames, Parameters
deplane = DeconstructPlane(Plane=pframes.Frames)  # -> Origin, XAxis, YAxis, ZAxis
pcx = CurvePlane(Curve=graft(crv), Plane=pframes.Frames)  # -> Points, ParamsC, ParamsP
dist = Distance(PointA=graft(deplane.Origin), PointB=pcx.Points)
sort = SortList(Keys=dist, ValuesA=pcx.Points)  # -> Keys, ValuesA
item = ListItem(List=sort.ValuesA, Index=0, Wrap=True)
pshift = ShiftPaths(Data=item, Offset=-1)
pline = PolyLine(Vertices=pshift, Closed=True)
pshift_2 = ShiftPaths(Data=pline, Offset=2)
flip = FlipMatrix(Data=pshift_2)
len_2 = Length(Curve=flip)
sort_2 = SortList(Keys=len_2, ValuesA=flip)  # -> Keys, ValuesA
rev = ReverseList(List=sort_2.ValuesA)
curve_reduction_tolerance_2 = Number(curve_reduction_tolerance)
item_2 = ListItem(List=sort_2.ValuesA, Index=0, Wrap=True)
item_3 = ListItem(List=rev, Index=0, Wrap=True)
redpline = Reduce(Polyline=item_3, Tolerance=curve_reduction_tolerance_2)  # -> Polyline, Reduction
redpline_2 = Reduce(Polyline=item_2, Tolerance=curve_reduction_tolerance_2)  # -> Polyline, Reduction
flip_2 = FlipCurve(Curve=redpline_2.Polyline)  # -> Curve, Flag
error_corrected_curves_outside = Curve(redpline.Polyline)
error_corrected_curves_inside = Curve(flip_2.Curve)
error_corrected_curves_outside_2 = ClusterOutput(error_corrected_curves_outside)
error_corrected_curves_inside_2 = ClusterOutput(error_corrected_curves_inside)

# ==== cluster Pocket
cut_depth_pocket = ClusterInput()
raster_along_y_0_1 = ClusterInput()
tool_diameter = ClusterInput()
stepover_0_1 = ClusterInput()
pass_depth = ClusterInput()
curves_for_raster_pocket = ClusterInput()
cut_depth_pocket_2 = Number(cut_depth_pocket)
raster_along_y_0_1_2 = Integer(raster_along_y_0_1)
tool_diameter_2 = Number(tool_diameter)
stepover_0_1_2 = Number(stepover_0_1)
pass_depth_2 = Number(pass_depth)

# ---- group: Filter out open curves
curves_for_raster_pocket_2 = Curve(curves_for_raster_pocket)
cls = Closed(Curve=curves_for_raster_pocket_2)  # -> Closed, Periodic
dispatch = Dispatch(List=curves_for_raster_pocket_2, DispatchPattern=cls.Closed)  # -> ListA, ListB

# ----
xy = XYPlane(Origin=Point(0, 0, 0))
multiplication = Multiplication(A=tool_diameter_2, B="0.5")
multiplication_2 = Multiplication(A=tool_diameter_2, B=stepover_0_1_2)
operation_plane = Plane(xy)
tool_radius = Panel(multiplication)
stepover_distance = Panel(multiplication_2)
tool_radius_2 = Panel(tool_radius)

# ---- group: Merge overlapping curves
curves_for_merging_overlap = Curve(dispatch.ListA)
mcx = MultipleCurves(Curves=curves_for_merging_overlap)  # -> Points, IndexA, IndexB, ParamA, ParamB
dcon = DeleteConsecutive(Set=[mcx.IndexA, mcx.IndexB], Wrap=False)  # -> Set, Count
item = ListItem(List=curves_for_merging_overlap, Index=dcon.Set, Wrap=True)
cull_i = CullIndex(List=curves_for_merging_overlap, Indices=dcon.Set, Wrap=True)
runion = RegionUnion(Curves=item, Plane=operation_plane)
merged_overlapping_curves = Curve([runion, cull_i])

# ---- group: Align curve directions
curves_for_aligned_direction = Curve(merged_overlapping_curves)
graft = GraftTree(Tree=curves_for_aligned_direction, IncludeEmptyLists=True, IncludeNullItems=True)
offset = Offset(Curve=graft, Distance="0.01", Plane=PlaneXY(0, 0, 0), Corners=2)
end = EndPoints(Curve=offset)  # -> Start, End
pshift = ShiftPaths(Data=end.Start, Offset=-1)
incurve = PointInCurve(Point=pshift, Curve=graft)  # -> Relationship, Point
multiplication_3 = Multiplication(A=incurve.Relationship, B="0.5")
round = Round(Number=multiplication_3)  # -> Nearest, Floor, Ceiling
crv = Curve(graft)
int = Integer(round.Nearest)
flip = FlipCurve(Curve=crv)  # -> Curve, Flag
weave = Weave(Pattern=int, Stream0=flip.Curve, Stream1=crv, NullGaps=False)
pshift_2 = ShiftPaths(Data=weave, Offset=-1)
aligned_curves = Curve(pshift_2)

# ---- group: Detect curves inside curves
aligned_curves_2 = Curve(aligned_curves)
graft_2 = GraftTree(Tree=aligned_curves_2, IncludeEmptyLists=True, IncludeNullItems=True)
end_2 = EndPoints(Curve=aligned_curves_2)  # -> Start, End
incurve_2 = PointInCurve(Point=end_2.Start, Curve=graft_2)  # -> Relationship, Point
multiplication_4 = Multiplication(A=incurve_2.Relationship, B="0.5")
round_2 = Round(Number=multiplication_4)  # -> Nearest, Floor, Ceiling
int_2 = Integer(round_2.Floor)
flip_2 = FlipMatrix(Data=int_2)
ma = MassAddition(Input=flip_2)  # -> Result, PartialResults
pshift_3 = ShiftPaths(Data=ma.Result, Offset=-1)
dispatch_2 = Dispatch(List=aligned_curves_2, DispatchPattern=pshift_3)  # -> ListA, ListB
curves_outside = Curve(dispatch_2.ListB)
curves_inside = Curve(dispatch_2.ListA)

# ----
curves_for_offset_outwards = Curve(curves_inside)
curves_for_offset_inwards = Curve(curves_outside)
operation_plane_2 = Plane(operation_plane)
neg = Negative(Value=tool_radius_2)
offset_2 = Offset(Curve=curves_for_offset_inwards, Distance=tool_radius_2, Plane=operation_plane_2, Corners=2)
offset_3 = Offset(Curve=curves_for_offset_outwards, Distance=neg, Plane=operation_plane_2, Corners=2)
pshift_4 = ShiftPaths(Data=offset_3, Offset=-1)
pshift_5 = ShiftPaths(Data=offset_2, Offset=-1)

# ---- group: Merge overlapping inside curves
curves_for_merging_overlap_2 = Curve(pshift_4)
mcx_2 = MultipleCurves(Curves=curves_for_merging_overlap_2)  # -> Points, IndexA, IndexB, ParamA, ParamB
dcon_2 = DeleteConsecutive(Set=[mcx_2.IndexA, mcx_2.IndexB], Wrap=False)  # -> Set, Count
item_2 = ListItem(List=curves_for_merging_overlap_2, Index=dcon_2.Set, Wrap=True)
runion_2 = RegionUnion(Curves=item_2, Plane=operation_plane_2)
cull_i_2 = CullIndex(List=curves_for_merging_overlap_2, Indices=dcon_2.Set, Wrap=True)
merged_overlapping_curves_2 = Curve([runion_2, cull_i_2])

# ----
operation_plane_3 = Plane(operation_plane_2)

# ---- group: Detect narrow gaps
graft_3 = GraftTree(Tree=merged_overlapping_curves_2, IncludeEmptyLists=True, IncludeNullItems=True)
ccx = CurveCurve(CurveA=flatten(pshift_5), CurveB=graft_3)  # -> Points, ParamsA, ParamsB
lng = ListLength(List=ccx.ParamsB)
larger = LargerThan(FirstNumber=lng, SecondNumber="0")  # -> LargerThan, OrEqualTo
pshift_6 = ShiftPaths(Data=larger.LargerThan, Offset=-1)
ma_2 = MassAddition(Input=pshift_6)  # -> Result, PartialResults
pshift_7 = ShiftPaths(Data=ma_2.Result, Offset=-1)
dispatch_3 = Dispatch(List=merged_overlapping_curves_2, DispatchPattern=pshift_7)  # -> ListA, ListB
rdiff = RegionDifference(CurvesA=pshift_5, CurvesB=dispatch_3.ListA, Plane=operation_plane_3)
inside_outline_curves = Curve(dispatch_3.ListB)
fixed_outline_curves = Curve(rdiff)

# ----
curves_for_raster_generation = Curve(fixed_outline_curves)
raster_direction_bollean = Integer(raster_along_y_0_1_2)

oultine_curve = Curve(curves_for_raster_generation)
X = UnitX(Factor=1)
Y = UnitY(Factor=1)
bbox = BoundingBox(Content=oultine_curve, Plane=PlaneXY(0, 0, 0))  # -> Box, Box_2
rev = Reverse(Vector=Y)
edges = BrepEdges(Brep=bbox.Box)  # -> Naked, Interior, NonManifold
filter = StreamFilter(Gate=raster_direction_bollean, Stream0="2", Stream1="3")
filter_2 = StreamFilter(Gate=raster_direction_bollean, Stream0="3", Stream1="2")
filter_3 = StreamFilter(Gate=raster_direction_bollean, Stream0=rev, Stream1=X)
item_3 = ListItem(List=edges.Naked, Index=filter_2, Wrap=True)
item_4 = ListItem(List=edges.Naked, Index=filter, Wrap=True)
len = Length(Curve=item_3)
stepover_distance_2 = Panel(stepover_distance)
division = Division(A=len, B=stepover_distance_2)
round_3 = Round(Number=division)  # -> Nearest, Floor, Ceiling
series = Series(Start=stepover_distance_2, Step=stepover_distance_2, Count=round_3.Floor)
amp = Amplitude(Vector=filter_3, Amplitude=series)
move = Move(Geometry=item_4, Motion=amp)  # -> Geometry, Transform
raster_curves = Curve(move.Geometry)

raster_cutoff_safety_factor = Panel("0.05")

# ---- group: Trim raster curves
dispatch_4 = Dispatch(List=flatten(raster_curves), DispatchPattern=[True, False])  # -> ListA, ListB
operation_plane_4 = Plane(operation_plane)
oultine_curve_2 = Curve(curves_for_raster_generation)
flip_3 = FlipCurve(Curve=dispatch_4.ListA)  # -> Curve, Flag
weave_2 = Weave(Pattern=[0, 1], Stream0=flip_3.Curve, Stream1=dispatch_4.ListB, NullGaps=False)
multiplication_5 = Multiplication(A=tool_radius_2, B=raster_cutoff_safety_factor)
raster_curves_2 = Curve(weave_2)
offset_4 = Offset(Curve=oultine_curve_2, Distance=multiplication_5, Plane=operation_plane_4, Corners=1)
trim = TrimWithRegion(Curve=raster_curves_2, Region=offset_4, Plane=operation_plane_4)  # -> Inside, Outside
simplify = SimplifyTree(Tree=trim.Inside, Front=False)
trimmed_raster_curves = Curve(simplify)

# ---- group: Filter short curves
stepover_distance_3 = Panel(stepover_distance_2)
len_2 = Length(Curve=trimmed_raster_curves)
multiplication_6 = Multiplication(A=stepover_distance_3, B="0.8")
smaller = SmallerThan(FirstNumber=len_2, SecondNumber=multiplication_6)  # -> SmallerThan, OrEqualTo
dispatch_5 = Dispatch(List=trimmed_raster_curves, DispatchPattern=smaller.SmallerThan)  # -> ListA, ListB
trimmed_and_filtered_raster_curves = Curve(dispatch_5.ListB)

# ---- group: Create line connections
oultine_curve_3 = Curve(oultine_curve_2)
lng_2 = ListLength(List=flatten(oultine_curve_3))
smaller_2 = SmallerThan(FirstNumber=lng_2, SecondNumber="2")  # -> SmallerThan, OrEqualTo
flatten = FlattenTree(Tree=trimmed_and_filtered_raster_curves, Path="{0}")
pshift_8 = ShiftPaths(Data=trimmed_and_filtered_raster_curves, Offset=-1)
filter_4 = StreamFilter(Gate=smaller_2.SmallerThan, Stream0=pshift_8, Stream1=flatten)
crv_2 = Curve(filter_4)
shift = ShiftList(List=crv_2, Shift="-1", Wrap=False)
shift_2 = ShiftList(List=crv_2, Shift="1", Wrap=False)
end_3 = EndPoints(Curve=shift)  # -> Start, End
end_4 = EndPoints(Curve=shift_2)  # -> Start, End
ln = Line(StartPoint=end_3.End, EndPoint=end_4.Start)

# ---- group: Filter intersecting curves
line_connections = Curve(ln)
oultine_curve_4 = Curve(oultine_curve_2)
colom = CollisionOneMany(Collider=line_connections, Obstacles=oultine_curve_4)  # -> Collision, Index
dispatch_6 = Dispatch(List=line_connections, DispatchPattern=colom.Collision)  # -> ListA, ListB
connection_lines = Curve(dispatch_6.ListB)

# ---- group: Trim with inside outline curves
trimmed_and_filtered_raster_curves_2 = Curve(trimmed_and_filtered_raster_curves)
connection_lines_2 = Curve(connection_lines)
inside_outline_curves_2 = Curve(inside_outline_curves)
operation_plane_5 = Plane(operation_plane)
neg_2 = Negative(Value=multiplication_5)
offset_5 = Offset(Curve=inside_outline_curves_2, Distance=neg_2, Plane=operation_plane_5, Corners=1)
oultine_curve_5 = Curve(oultine_curve_2)
lng_3 = ListLength(List=flatten(oultine_curve_5))
smaller_3 = SmallerThan(FirstNumber=lng_3, SecondNumber="2")  # -> SmallerThan, OrEqualTo
pshift_9 = ShiftPaths(Data=trimmed_and_filtered_raster_curves_2, Offset=-1)
flatten_2 = FlattenTree(Tree=trimmed_and_filtered_raster_curves_2, Path="{0}")
filter_5 = StreamFilter(Gate=smaller_3.SmallerThan, Stream0=pshift_9, Stream1=flatten_2)
pshift_10 = ShiftPaths(Data=offset_5, Offset=-1)
lng_4 = ListLength(List=flatten(inside_outline_curves_2))
smaller_4 = SmallerThan(FirstNumber=lng_4, SecondNumber="1")  # -> SmallerThan, OrEqualTo
trim_2 = TrimWithRegions(Curve=filter_5, Regions=pshift_10, Plane=operation_plane_4)  # -> Inside, Outside

# ----
filter_6 = StreamFilter(Gate=smaller_4.SmallerThan, Stream0=trim_2.Outside, Stream1=filter_5)

# ---- group: Trim with inside outline curves (continued)
crv_3 = Curve(filter_6)
join = JoinCurves(Curves=flatten([connection_lines_2, crv_3]), Preserve=True)
raster_curves_3 = Curve(join)

# ----
end_5 = EndPoints(Curve=raster_curves_3)  # -> Start, End
cps = ClosestPoints(Point=end_5.End, Cloud=end_5.Start, Count=2)  # -> ClosestPoint, CPIndex, Distance
dist = Distance(PointA=graft(end_5.Start), PointB=cps.ClosestPoint)
equals = Equality(FirstNumber=dist, SecondNumber="0")  # -> Equality, Inequality
dispatch_7 = Dispatch(List=cps.ClosestPoint, DispatchPattern=equals.Equality)  # -> ListA, ListB
item_5 = ListItem(List=dispatch_7.ListB, Index=0, Wrap=True)
ln_2 = Line(StartPoint=item_5, EndPoint=graft(end_5.End))

merge = Merge(Data1=inside_outline_curves_2, Data2=oultine_curve_4)
insied_and_outside_outline_curves = Curve(flatten(merge))
line_connections_2 = Curve(ln_2)
colom_2 = CollisionOneMany(Collider=line_connections_2, Obstacles=insied_and_outside_outline_curves)  # -> Collision, Index
dispatch_8 = Dispatch(List=line_connections_2, DispatchPattern=colom_2.Collision)  # -> ListA, ListB
stepover_distance_4 = Panel(stepover_distance_2)
len_3 = Length(Curve=dispatch_8.ListB)
multiplication_7 = Multiplication(A=stepover_distance_4, B="3")
larger_2 = LargerThan(FirstNumber=len_3, SecondNumber=multiplication_7)  # -> LargerThan, OrEqualTo
dispatch_9 = Dispatch(List=dispatch_8.ListB, DispatchPattern=larger_2.LargerThan)  # -> ListA, ListB
extra_connection_lines = Curve(dispatch_9.ListB)

extra_connection_lines_2 = Curve(extra_connection_lines)
raster_curves_4 = Curve(join)
join_2 = JoinCurves(Curves=flatten([raster_curves_4, extra_connection_lines_2]), Preserve=False)
raster_curves_5 = Curve(join_2)

inside_outline_curves_3 = Curve(inside_outline_curves)
raster_curves_6 = Curve(raster_curves_5)
oultine_curve_6 = Curve(curves_for_raster_generation)
flatten_3 = FlattenTree(Tree=oultine_curve_6, Path="{0}")
end_6 = EndPoints(Curve=inside_outline_curves_3)  # -> Start, End
incurves = PointInCurves(Point=end_6.Start, Curves=flatten_3)  # -> Relationship, Index, Point
addition = Addition(A=incurves.Index, B="1")
# fix curve order fail when no raster lines
# fix offset from when 1 line becomes more ? (narrow channels)
ins = InsertItems(List=flatten_3, Item=inside_outline_curves_3, Indices=addition, Wrap=True)
end_7 = EndPoints(Curve=raster_curves_6)  # -> Start, End
incurves_2 = PointInCurves(Point=end_7.Start, Curves=ins)  # -> Relationship, Index, Point
ins_2 = InsertItems(List=ins, Item=raster_curves_6, Indices=incurves_2.Index, Wrap=True)
sorted_raster_and_outline_routes = Curve(flatten(ins_2))

# ---- group: Move pocket toolpaths to cut depths
pass_depth_3 = Panel(pass_depth_2)
cut_depth_pocket_3 = Panel(cut_depth_pocket_2)
sorted_raster_and_outline_routes_2 = Curve(sorted_raster_and_outline_routes)
division_2 = Division(A=cut_depth_pocket_3, B=pass_depth_3)
round_4 = Round(Number=division_2)  # -> Nearest, Floor, Ceiling
division_3 = Division(A=cut_depth_pocket_3, B=round_4.Ceiling)
actual_pass_depth = Panel(division_3)
series_2 = Series(Start=actual_pass_depth, Step=actual_pass_depth, Count=round_4.Ceiling)
neg_3 = Negative(Value=series_2)
item_6 = ListItem(List=neg_3, Index=0, Wrap=True)
null = NullItem(Item=item_6)  # -> NullFlags, InvalidFlags, Description
filter_7 = StreamFilter(Gate=null.NullFlags, Stream0=neg_3, Stream1="0")
Z = UnitZ(Factor=filter_7)

# ----
group = Group(Objects=sorted_raster_and_outline_routes_2)

# ---- group: Move pocket toolpaths to cut depths (continued)
move_2 = Move(Geometry=group, Motion=Z)  # -> Geometry, Transform
ungroup = Ungroup(Group=move_2.Geometry)
flatten_4 = FlattenTree(Tree=ungroup, Path="{0}")

# ----
pocket_toolpaths = Curve(flatten_4)
pocket_toolpaths_2 = ClusterOutput(pocket_toolpaths)

# ==== cluster Drill
I = ClusterInput()
I_2 = ClusterInput()
default_tool_diameter = Panel("6")
default_drill_depth = Panel("10")
null = NullItem(Item=I_2)  # -> NullFlags, InvalidFlags, Description
null_2 = NullItem(Item=I)  # -> NullFlags, InvalidFlags, Description
drill_curves = ClusterInput()
filter = StreamFilter(Gate=null.NullFlags, Stream0=I_2, Stream1=default_tool_diameter)
filter_2 = StreamFilter(Gate=null_2.NullFlags, Stream0=I, Stream1=default_drill_depth)

# ---- group: Creat hold down drill lines
drill_curves_2 = Curve(drill_curves)
drill_depth = Number(filter_2)
area = Area(Geometry=drill_curves_2)  # -> Area, Centroid
drill_depth_2 = Panel(drill_depth)
pdecon = Deconstruct(Point=area.Centroid)  # -> XComponent, YComponent, ZComponent
pt = ConstructPoint(XCoordinate=pdecon.XComponent, YCoordinate=pdecon.YComponent, ZCoordinate=0)
neg = Negative(Value=drill_depth_2)
Z = UnitZ(Factor=neg)
move = Move(Geometry=pt, Motion=Z)  # -> Geometry, Transform
ln = Line(StartPoint=pt, EndPoint=move.Geometry)

# ----
tool_diameter_for_preview = Number(filter)

# ---- group: Create hold down preview circles
drill_toolpaths = Curve(ln)
tool_diameter = Panel(tool_diameter_for_preview)
end = EndPoints(Curve=drill_toolpaths)  # -> Start, End
multiplication = Multiplication(A=tool_diameter, B="0.5")
pt_2 = Point(end.Start)
neg_2 = Negative(Value=multiplication)
neg_3 = Negative(Value=multiplication)
X = UnitX(Factor=multiplication)
X_2 = UnitX(Factor=neg_3)
Y = UnitY(Factor=neg_2)
Y_2 = UnitY(Factor=multiplication)
move_2 = Move(Geometry=pt_2, Motion=Y)  # -> Geometry, Transform
xy = XYPlane(Origin=pt_2)
move_3 = Move(Geometry=pt_2, Motion=X_2)  # -> Geometry, Transform
move_4 = Move(Geometry=pt_2, Motion=Y_2)  # -> Geometry, Transform
move_5 = Move(Geometry=pt_2, Motion=X)  # -> Geometry, Transform
cir = Circle(Plane=xy, Radius=multiplication)
ln_2 = Line(StartPoint=move_4.Geometry, EndPoint=move_2.Geometry)
ln_3 = Line(StartPoint=move_5.Geometry, EndPoint=move_3.Geometry)
drill_preview_geometry = Curve([ln_3, ln_2, cir])

# ----
drill_preview_geometry_2 = Curve(drill_preview_geometry)
drill_toolpaths_2 = Curve(ln)
drill_preview_geometry_3 = ClusterOutput(drill_preview_geometry_2)
drill_toolpaths_3 = ClusterOutput(drill_toolpaths_2)

# ==== cluster Engrave
engrave_curves = ClusterInput()
pass_depth = ClusterInput()
cut_depth = ClusterInput()
engrave_curves_2 = Curve(engrave_curves)
pass_depth_2 = Number(pass_depth)
cut_depth_2 = Number(cut_depth)
pass_depth_3 = Panel(pass_depth_2)
cut_depth_line_engrave = Panel(cut_depth_2)
division = Division(A=cut_depth_line_engrave, B=pass_depth_3)
round = Round(Number=division)  # -> Nearest, Floor, Ceiling
division_2 = Division(A=cut_depth_line_engrave, B=round.Ceiling)
actual_pass_depth = Panel(division_2)
series = Series(Start=actual_pass_depth, Step=actual_pass_depth, Count=round.Ceiling)
neg = Negative(Value=series)
null = NullItem(Item=division_2)  # -> NullFlags, InvalidFlags, Description
filter = StreamFilter(Gate=null.NullFlags, Stream0=neg, Stream1="0")
Z = UnitZ(Factor=filter)
move = Move(Geometry=graft(engrave_curves_2), Motion=Z)  # -> Geometry, Transform
flatten = FlattenTree(Tree=move.Geometry, Path="{0}")
engrave_toolpaths = Curve(flatten)
engrave_toolpaths_2 = ClusterOutput(engrave_toolpaths)

# ==== cluster Cutout
use_climb_direction = ClusterInput()
use_inside_cutting = ClusterInput()
curves_for_cutout = ClusterInput()
cutout_tolerance = ClusterInput()
tool_diameter = ClusterInput()
pass_depth = ClusterInput()
cut_depth = ClusterInput()
use_climb_direction_2 = Integer(use_climb_direction)
use_inside_cutting_2 = Integer(use_inside_cutting)
curves_for_cutout_2 = Curve(curves_for_cutout)
cutout_tolerance_2 = Number(cutout_tolerance)
tool_diameter_2 = Number(tool_diameter)
pass_depth_2 = Number(pass_depth)
cut_depth_2 = Number(cut_depth)
tool_diameter_3 = Panel(tool_diameter_2)
use_climb_direction_3 = Panel(use_climb_direction_2)
use_inside_cutting_3 = Panel(use_inside_cutting_2)

# ---- group: Filter out open curves
curves_for_cutout_3 = Curve(curves_for_cutout_2)
cls = Closed(Curve=curves_for_cutout_3)  # -> Closed, Periodic
dispatch = Dispatch(List=curves_for_cutout_3, DispatchPattern=cls.Closed)  # -> ListA, ListB

# ----
xy = XYPlane(Origin=Point(0, 0, 0))
operation_plane = Plane(xy)
multiplication = Multiplication(A=tool_diameter_3, B="0.5")
cutout_tolerance_3 = Panel(cutout_tolerance_2)
tool_radius = Panel(multiplication)
addition = Addition(A=tool_radius, B=cutout_tolerance_3)
compensated_tool_radius = Panel(addition)

# ---- group: Merge overlapping curves
curves_for_merging_overlap = Curve(dispatch.ListA)
mcx = MultipleCurves(Curves=curves_for_merging_overlap)  # -> Points, IndexA, IndexB, ParamA, ParamB
dcon = DeleteConsecutive(Set=[mcx.IndexA, mcx.IndexB], Wrap=False)  # -> Set, Count
item = ListItem(List=curves_for_merging_overlap, Index=dcon.Set, Wrap=True)
cull_i = CullIndex(List=curves_for_merging_overlap, Indices=dcon.Set, Wrap=True)
runion = RegionUnion(Curves=item, Plane=operation_plane)
merged_overlapping_curves = Curve([runion, cull_i])

# ----
use_inside_cutting_4 = Panel(use_inside_cutting_3)
operation_plane_2 = Plane(operation_plane)
neg = Negative(Value=compensated_tool_radius)
pass_depth_3 = Number(pass_depth_2)
cut_depth_3 = Number(cut_depth_2)

# ---- group: Align curve directions
curves_for_aligned_direction = Curve(merged_overlapping_curves)
graft = GraftTree(Tree=curves_for_aligned_direction, IncludeEmptyLists=True, IncludeNullItems=True)
offset = Offset(Curve=graft, Distance="0.01", Plane=PlaneXY(0, 0, 0), Corners=2)
end = EndPoints(Curve=offset)  # -> Start, End
pshift = ShiftPaths(Data=end.Start, Offset=-1)
incurve = PointInCurve(Point=pshift, Curve=graft)  # -> Relationship, Point
multiplication_2 = Multiplication(A=incurve.Relationship, B="0.5")
round = Round(Number=multiplication_2)  # -> Nearest, Floor, Ceiling
crv = Curve(graft)
int = Integer(round.Nearest)
flip = FlipCurve(Curve=crv)  # -> Curve, Flag
weave = Weave(Pattern=int, Stream0=flip.Curve, Stream1=crv, NullGaps=False)
pshift_2 = ShiftPaths(Data=weave, Offset=-1)

# ----
flip_2 = FlipCurve(Curve=pshift_2)  # -> Curve, Flag
filter = StreamFilter(Gate=use_inside_cutting_4, Stream0=pshift_2, Stream1=flip_2.Curve)

# ---- group: Align curve directions (continued)
aligned_curves = Curve(filter)

# ---- group: Detect curves inside curves
aligned_curves_2 = Curve(aligned_curves)
graft_2 = GraftTree(Tree=aligned_curves_2, IncludeEmptyLists=True, IncludeNullItems=True)
end_2 = EndPoints(Curve=aligned_curves_2)  # -> Start, End
incurve_2 = PointInCurve(Point=end_2.Start, Curve=graft_2)  # -> Relationship, Point
multiplication_3 = Multiplication(A=incurve_2.Relationship, B="0.5")
round_2 = Round(Number=multiplication_3)  # -> Nearest, Floor, Ceiling
int_2 = Integer(round_2.Floor)
flip_3 = FlipMatrix(Data=int_2)
ma = MassAddition(Input=flip_3)  # -> Result, PartialResults
pshift_3 = ShiftPaths(Data=ma.Result, Offset=-1)
dispatch_2 = Dispatch(List=aligned_curves_2, DispatchPattern=pshift_3)  # -> ListA, ListB
curves_outside = Curve(dispatch_2.ListB)
curves_inside = Curve(dispatch_2.ListA)

# ----
curves_for_offset_outwards = Curve(curves_outside)
curves_for_offset_inwards = Curve(curves_inside)
offset_2 = Offset(Curve=curves_for_offset_outwards, Distance=neg, Plane=operation_plane_2, Corners=2)
offset_3 = Offset(Curve=curves_for_offset_inwards, Distance=compensated_tool_radius, Plane=operation_plane_2, Corners=2)
pshift_4 = ShiftPaths(Data=offset_3, Offset=-1)
pshift_5 = ShiftPaths(Data=offset_2, Offset=-1)
flip_4 = FlipCurve(Curve=pshift_4)  # -> Curve, Flag
outside_cutout_curves = Curve(pshift_5)
inside_cutout_curves = Curve(flip_4.Curve)

outside_cutout_curves_2 = Curve(outside_cutout_curves)
inside_cutout_curves_2 = Curve(inside_cutout_curves)
inside_outline_curves = Curve(inside_cutout_curves_2)
flatten = FlattenTree(Tree=outside_cutout_curves_2, Path="{0}")
end_3 = EndPoints(Curve=inside_outline_curves)  # -> Start, End
incurves = PointInCurves(Point=end_3.Start, Curves=flatten)  # -> Relationship, Index, Point
addition_2 = Addition(A=incurves.Index, B="1")
ins = InsertItems(List=flatten, Item=inside_outline_curves, Indices=incurves.Index, Wrap=True)

# ---- group: Flip curves for climb direction
sorted_inside_and_outside_curves = Curve(ins)
use_climb_direction_4 = Panel(use_climb_direction_3)
flip_5 = FlipCurve(Curve=sorted_inside_and_outside_curves)  # -> Curve, Flag
filter_2 = StreamFilter(Gate=use_climb_direction_4, Stream0=flip_5.Curve, Stream1=sorted_inside_and_outside_curves)
sorted_inside_and_outside_curves_2 = Curve(filter_2)

# ---- group: Move cutout toolpaths to cut depths
sorted_inside_and_outside_curves_3 = Curve(sorted_inside_and_outside_curves_2)
pass_depth_4 = Panel(pass_depth_3)
cut_depth_cutout = Panel(cut_depth_3)
division = Division(A=cut_depth_cutout, B=pass_depth_4)
graft_3 = GraftTree(Tree=sorted_inside_and_outside_curves_3, IncludeEmptyLists=True, IncludeNullItems=True)
round_3 = Round(Number=division)  # -> Nearest, Floor, Ceiling
division_2 = Division(A=cut_depth_cutout, B=round_3.Ceiling)
actual_pass_depth = Panel(division_2)
series = Series(Start=actual_pass_depth, Step=actual_pass_depth, Count=round_3.Ceiling)
neg_2 = Negative(Value=series)
Z = UnitZ(Factor=neg_2)
move = Move(Geometry=graft_3, Motion=Z)  # -> Geometry, Transform
flatten_2 = FlattenTree(Tree=move.Geometry, Path="{0}")

# ----
cutout_toolpaths = Curve(flatten_2)
cutout_toolpaths_2 = ClusterOutput(cutout_toolpaths)

# ==== cluster PreviewGraphicFor11ProjectionOnMachine
measured_projected_size = ClusterInput()
expected_projected_size = ClusterInput()
position_correction_x = ClusterInput()
position_correction_y = ClusterInput()
drill_preview_curves = ClusterInput()
rotation_correction = ClusterInput()
toolpath_curves = ClusterInput()
cutting_curves = ClusterInput()
svg_px_heigth = ClusterInput()
pocket_curves = ClusterInput()
svg_px_width = ClusterInput()
toolpath_curves_2 = Curve(flatten(toolpath_curves))
cutting_curves_2 = Curve(cutting_curves)
drill_preview_curves_2 = Curve(drill_preview_curves)
measured_projected_size_2 = Number(measured_projected_size)
position_correction_x_2 = Number(position_correction_x)
position_correction_y_2 = Number(position_correction_y)
svg_px_width_2 = Number(svg_px_width)
pocket_curves_2 = Curve(pocket_curves)
expected_projected_size_2 = Number(expected_projected_size)
rotation_correction_2 = Number(rotation_correction)
svg_px_heigth_2 = Number(svg_px_heigth)
background_color = ColourSwatch(SwatchColor=RGB(0, 0, 0))
explode = Explode(Curve=toolpath_curves_2, Recursive=True)  # -> Segments, Vertices
pt = ConstructPoint(XCoordinate=position_correction_x_2, YCoordinate=position_correction_y_2, ZCoordinate=0)
division = Division(A=expected_projected_size_2, B=measured_projected_size_2)
pt_2 = ConstructPoint(XCoordinate="0", YCoordinate="0", ZCoordinate=0)
vec2pt = Vector2Pt(PointA=pt_2, PointB=pt, Unitize=False)  # -> Vector, Length
xy = XYPlane(Origin=pt_2)
pocket_curves_3 = Curve(flatten(pocket_curves_2))
x_y_and_z_axis_indicators = Curve([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])
cutting_curves_3 = Curve(flatten(cutting_curves_2))
toolpath_curves_3 = Curve(flatten(explode.Segments))
drill_preview_curves_3 = Curve(drill_preview_curves_2)
scale = Scale(Geometry=flatten(x_y_and_z_axis_indicators), Center=pt_2, Factor=division)  # -> Geometry, Transform
scale_2 = Scale(Geometry=cutting_curves_3, Center=pt_2, Factor=division)  # -> Geometry, Transform
scale_3 = Scale(Geometry=pocket_curves_3, Center=pt_2, Factor=division)  # -> Geometry, Transform
scale_4 = Scale(Geometry=drill_preview_curves_3, Center=pt_2, Factor=division)  # -> Geometry, Transform
move = Move(Geometry=scale_3.Geometry, Motion=vec2pt.Vector)  # -> Geometry, Transform
move_2 = Move(Geometry=scale_2.Geometry, Motion=vec2pt.Vector)  # -> Geometry, Transform
scale_5 = Scale(Geometry=toolpath_curves_3, Center=pt_2, Factor=division)  # -> Geometry, Transform
move_3 = Move(Geometry=scale.Geometry, Motion=vec2pt.Vector)  # -> Geometry, Transform
move_4 = Move(Geometry=scale_4.Geometry, Motion=vec2pt.Vector)  # -> Geometry, Transform
move_5 = Move(Geometry=scale_5.Geometry, Motion=vec2pt.Vector)  # -> Geometry, Transform
rotate = Rotate(Geometry=move_2.Geometry, Angle=rotation_correction_2, Plane=xy)  # -> Geometry, Transform
rotate_2 = Rotate(Geometry=move.Geometry, Angle=rotation_correction_2, Plane=xy)  # -> Geometry, Transform
rotate_3 = Rotate(Geometry=move_4.Geometry, Angle=rotation_correction_2, Plane=xy)  # -> Geometry, Transform
rotate_4 = Rotate(Geometry=move_3.Geometry, Angle=rotation_correction_2, Plane=xy)  # -> Geometry, Transform
rotate_5 = Rotate(Geometry=move_5.Geometry, Angle=rotation_correction_2, Plane=xy)  # -> Geometry, Transform
topoly = CurveToPolyline(Curve=rotate_3.Geometry, ToleranceDistance=Slider(0.25, range=0..1), ToleranceAngle=0)  # -> Polyline, Segments
topoly_2 = CurveToPolyline(Curve=rotate_2.Geometry, ToleranceDistance=Slider(0.25, range=0..1), ToleranceAngle=0)  # -> Polyline, Segments
topoly_3 = CurveToPolyline(Curve=rotate.Geometry, ToleranceDistance=Slider(0.25, range=0..1), ToleranceAngle=0)  # -> Polyline, Segments
topoly_4 = CurveToPolyline(Curve=rotate_4.Geometry, ToleranceDistance=Slider(0.25, range=0..1), ToleranceAngle=0)  # -> Polyline, Segments
topoly_5 = CurveToPolyline(Curve=rotate_5.Geometry, ToleranceDistance=Slider(0.25, range=0..1), ToleranceAngle=0)  # -> Polyline, Segments
explode_2 = Explode(Curve=topoly_4.Polyline, Recursive=True)  # -> Segments, Vertices
crv = Curve(topoly.Polyline)
int = Integer(svg_px_heigth_2)
int_2 = Integer(svg_px_heigth_2)
crv_2 = Curve(topoly_2.Polyline)
crv_3 = Curve(flatten(explode_2.Segments))
int_3 = Integer(svg_px_heigth_2)
crv_4 = Curve(topoly_3.Polyline)
int_4 = Integer(svg_px_heigth_2)
crv_5 = Curve(topoly_5.Polyline)
int_5 = Integer(svg_px_heigth_2)
cluster = Cluster_2(
    background_height=int,
    polyline=crv,
    stroke_color=ColourSwatch(SwatchColor=RGB(255, 191, 0)),
    stroke_width=Slider(0.8, range=0..5))
cluster_2 = Cluster_2(
    background_height=int_2,
    polyline=crv_2,
    stroke_color=ColourSwatch(SwatchColor=RGB(251, 0, 255)),
    stroke_width=Slider(0.8, range=0..5))
cluster_3 = Cluster_2(
    background_height=int_3,
    polyline=crv_4,
    stroke_color=ColourSwatch(SwatchColor=RGB(0, 140, 255)),
    stroke_width=Slider(0.8, range=0..5))
cluster_4 = Cluster_2(
    background_height=int_4,
    polyline=crv_3,
    stroke_color=ColourSwatch(SwatchColor=RGB(106, 150, 158)),
    stroke_width=Slider(0.8, range=0..5))
cluster_5 = Cluster_2(
    background_height=int_5,
    polyline=crv_5,
    stroke_color=ColourSwatch(SwatchColor=RGB(184, 251, 255)),
    stroke_width=Slider(0.8, range=0..5))
flatten = FlattenTree(Tree=cluster, Path="{0}")
flatten_2 = FlattenTree(Tree=cluster_2, Path="{0}")
flatten_3 = FlattenTree(Tree=cluster_3, Path="{0}")
flatten_4 = FlattenTree(Tree=cluster_4, Path="{0}")
flatten_5 = FlattenTree(Tree=cluster_5, Path="{0}")
flatten_6 = FlattenTree(Tree=[flatten_5, flatten_3, flatten, flatten_2, flatten_4], Path="{0}")
cluster_6 = Cluster(background_width=svg_px_width_2, background_height=svg_px_heigth_2, background_color=background_color, data=flatten_6)
stream_save_as_svg = Panel(cluster_6)
composed_svg_stream_save_as_svg = ClusterOutput(cluster_6)

# ==== cluster ShopBotCodePostProcessor
use_custom_jog_home = ClusterInput()
deviation_tolerance = ClusterInput()
custom_home_x = ClusterInput()
toolpath_curves = ClusterInput()
custom_home_y = ClusterInput()
ramp_plunges = ClusterInput()
spindle_speed = ClusterInput()
safe_z_height = ClusterInput()
ramp_angle = ClusterInput()
use_spindle = ClusterInput()
plunge_rate = ClusterInput()
tab_breps = ClusterInput()
job_name = ClusterInput()
feed_rate = ClusterInput()

convert_to_inches = BooleanToggle(False)
toolpath_curves_2 = Curve(toolpath_curves)
tab_breps_2 = Brep(tab_breps)
feed_rate_2 = Number(feed_rate)
plunge_rate_2 = Number(plunge_rate)
safe_z_height_2 = Number(safe_z_height)
use_spindle_2 = Integer(use_spindle)
spindle_speed_2 = Number(spindle_speed)
ramp_plunges_2 = Integer(ramp_plunges)
ramp_angle_2 = Number(ramp_angle)
use_custom_jog_home_2 = Integer(use_custom_jog_home)
custom_home_x_2 = Number(custom_home_x)
custom_home_y_2 = Number(custom_home_y)
deviation_tolerance_2 = Number(deviation_tolerance)
job_name_2 = Text(job_name)
use_inches_boolean = Panel(convert_to_inches)
flatten = FlattenTree(Tree=tab_breps_2, Path="{0}")
flatten_2 = FlattenTree(Tree=toolpath_curves_2, Path="{0}")
filter = StreamFilter(Gate=use_inches_boolean, Stream0="1", Stream1="25.4")
division = Division(A=custom_home_x_2, B=filter)
division_2 = Division(A=custom_home_y_2, B=filter)
join = TextJoin(Text=flatten(["'", job_name_2]))
topoly = CurveToPolyline(Curve=flatten_2, ToleranceDistance=deviation_tolerance_2, ToleranceAngle=0)  # -> Polyline, Segments
division_3 = Division(A=feed_rate_2, B=filter)
division_4 = Division(A=plunge_rate_2, B=filter)
division_5 = Division(A=safe_z_height_2, B=filter)
polyline_toolpaths = Curve(topoly.Polyline)

# ---- group: Add ramps to toolpaths
ramp_toolpath_plunges = RampToolpathPlunges(toolpaths_to_ramp=polyline_toolpaths, ramp_angle=ramp_angle_2)
ramp_plunges_3 = Integer(ramp_plunges_2)
filter_2 = StreamFilter(Gate=ramp_plunges_3, Stream0=polyline_toolpaths, Stream1=ramp_toolpath_plunges)

# ---- group: Eliminate unecessary jog Z
connect_overlapping_toolpaths = ConnectOverlappingToolpaths(polyline_toolpaths=filter_2)

# ---- group: Adds tabs to toolpaths
tab_toolpaths = TabToolpaths(polyline_toolpaths=connect_overlapping_toolpaths, tab_breps=flatten)

# ---- group: Create safe Z transtions
cp = ControlPoints(Curve=tab_toolpaths)  # -> Points, Weights, Knots
rev = ReverseList(List=cp.Points)
safe_z_height_3 = Number(division_5)
item = ListItem(List=cp.Points, Index=0, Wrap=True)
item_2 = ListItem(List=rev, Index=0, Wrap=True)
pdecon = Deconstruct(Point=item)  # -> XComponent, YComponent, ZComponent
pdecon_2 = Deconstruct(Point=item_2)  # -> XComponent, YComponent, ZComponent
pt = ConstructPoint(XCoordinate=pdecon.XComponent, YCoordinate=pdecon.YComponent, ZCoordinate=safe_z_height_3)
pt_2 = ConstructPoint(XCoordinate=pdecon_2.XComponent, YCoordinate=pdecon_2.YComponent, ZCoordinate=safe_z_height_3)
safe_z_end_point = Point(pt_2)
safe_z_start_point = Point(pt)

# ----
toolpath_points = Point(cp.Points)
pdecon_3 = Deconstruct(Point=toolpath_points)  # -> XComponent, YComponent, ZComponent

# ---- group: Optional MM to inch conversion
convert_to_inches_boolean = Panel(convert_to_inches)
filter_3 = StreamFilter(Gate=convert_to_inches_boolean, Stream0="1", Stream1="25.4")
division_6 = Division(A=pdecon_3.XComponent, B=filter_3)
division_7 = Division(A=pdecon_3.YComponent, B=filter_3)
division_8 = Division(A=pdecon_3.ZComponent, B=filter_3)

# ----
lng = ListLength(List=toolpath_points)
flatten_3 = FlattenTree(Tree=lng, Path="{0}")
merge = Merge(Data1=Slider(0, range=0..100), Data2=flatten_3)
panel = Panel(division_6)
panel_2 = Panel(division_7)
panel_3 = Panel(division_8)

# ---- group: Create toolpath preview
rev_2 = ReverseList(List=flatten(safe_z_end_point))
cull_i = CullIndex(List=flatten(safe_z_start_point), Indices=0, Wrap=True)
cull_i_2 = CullIndex(List=rev_2, Indices=0, Wrap=True)
rev_3 = ReverseList(List=flatten(cull_i_2))
ln = Line(StartPoint=rev_3, EndPoint=cull_i)
ln_2 = Line(StartPoint=safe_z_start_point, EndPoint=item)
ln_3 = Line(StartPoint=item_2, EndPoint=safe_z_end_point)
cut_transition_preview_line = Curve(flatten(ln))
cut_entry_preview_line = Curve(flatten(ln_2))
cut_exit_preview_line = Curve(flatten(ln_3))
toolpath_preview_line = Curve(tab_toolpaths)

# ---- group: Jog to safe Z
safe_z_height_4 = Number(flatten(safe_z_height_3))
text = Text("JZ,")
graft = GraftTree(Tree=safe_z_height_4, IncludeEmptyLists=True, IncludeNullItems=True)
graft_2 = GraftTree(Tree=text, IncludeEmptyLists=True, IncludeNullItems=True)
lng_2 = ListLength(List=flatten(merge))
join_2 = TextJoin(Text=[graft_2, graft])
dup = DuplicateData(Data=join_2, Number=lng_2, Order=True)

# ---- group: Name
panel_4 = Panel(join)

# ---- group: Set spindle speed
spindle_speed_3 = Number(spindle_speed_2)
int = Integer(spindle_speed_3)
join_3 = TextJoin(Text=["TR,", int, ",1"])

# ---- group: Turn off spindle
filter_4 = StreamFilter(Gate=use_spindle_2, Stream1="SO,1,0")

# ---- group: Toolpath coordinates
text_2 = Text("M3,")
text_3 = Text(",")
text_4 = Text(",")
dup_2 = DuplicateData(Data=text_4, Number=lng, Order=True)
dup_3 = DuplicateData(Data=text_3, Number=lng, Order=True)
dup_4 = DuplicateData(Data=text_2, Number=lng, Order=True)
simplify = SimplifyTree(Tree=flatten(dup_4), Front=False)
simplify_2 = SimplifyTree(Tree=flatten(panel), Front=False)
simplify_3 = SimplifyTree(Tree=flatten(dup_3), Front=False)
simplify_4 = SimplifyTree(Tree=flatten(panel_2), Front=False)
simplify_5 = SimplifyTree(Tree=flatten(dup_2), Front=False)
simplify_6 = SimplifyTree(Tree=flatten(panel_3), Front=False)
graft_3 = GraftTree(Tree=simplify, IncludeEmptyLists=True, IncludeNullItems=True)
graft_4 = GraftTree(Tree=simplify_2, IncludeEmptyLists=True, IncludeNullItems=True)
graft_5 = GraftTree(Tree=simplify_3, IncludeEmptyLists=True, IncludeNullItems=True)
graft_6 = GraftTree(Tree=simplify_4, IncludeEmptyLists=True, IncludeNullItems=True)
graft_7 = GraftTree(Tree=simplify_5, IncludeEmptyLists=True, IncludeNullItems=True)
graft_8 = GraftTree(Tree=simplify_6, IncludeEmptyLists=True, IncludeNullItems=True)
join_4 = TextJoin(Text=[graft_3, graft_4, graft_5, graft_6, graft_7, graft_8])
flatten_4 = FlattenTree(Tree=join_4, Path="{0}")

# ---- group: Start spindle
panel_5 = Panel("PAUSE 1")
filter_5 = StreamFilter(Gate=use_spindle_2, Stream1="SO,1,1")

# ---- group: Set Feed rate (X Y speed) and plunge rate (Z speed)
feed_rate_3 = Number(division_3)
plunge_rate_3 = Number(division_4)
plunge_rate_4 = Number(plunge_rate_3)
feed_rate_4 = Number(feed_rate_3)
text_5 = Text("MS,")
text_6 = Text(",")
join_5 = TextJoin(Text=flatten([text_5, feed_rate_4, text_6, plunge_rate_4]))

# ----
filter_6 = StreamFilter(Gate=use_spindle_2, Stream1=join_3)
cut_transition_preview_line_2 = ClusterOutput(cut_transition_preview_line)
cut_exit_preview_line_2 = ClusterOutput(cut_exit_preview_line)
toolpath_preview_line_2 = ClusterOutput(toolpath_preview_line)
cut_entry_preview_line_2 = ClusterOutput(cut_entry_preview_line)
text_7 = Text("J2,")
text_8 = Text(",")
join_6 = TextJoin(Text=[text_7, division, text_8, division_2])

# ---- group: Insert JZ commands
ma = MassAddition(Input=merge)  # -> Result, PartialResults
ins = InsertItems(List=flatten_4, Item=dup, Indices=ma.PartialResults, Wrap=True)

# ---- group: Jog to startpoints
item_3 = ListItem(List=division_6, Index=0, Wrap=True)
item_4 = ListItem(List=division_7, Index=0, Wrap=True)
lng_3 = ListLength(List=flatten(item_3))
text_9 = Text(",")
text_10 = Text("J2,")
dup_5 = DuplicateData(Data=text_10, Number=lng_3, Order=True)
dup_6 = DuplicateData(Data=text_9, Number=lng_3, Order=True)
simplify_7 = SimplifyTree(Tree=flatten(dup_5), Front=False)
simplify_8 = SimplifyTree(Tree=flatten(item_3), Front=False)
simplify_9 = SimplifyTree(Tree=flatten(dup_6), Front=False)
simplify_10 = SimplifyTree(Tree=flatten(item_4), Front=False)
graft_9 = GraftTree(Tree=simplify_7, IncludeEmptyLists=True, IncludeNullItems=True)
graft_10 = GraftTree(Tree=simplify_8, IncludeEmptyLists=True, IncludeNullItems=True)
graft_11 = GraftTree(Tree=simplify_9, IncludeEmptyLists=True, IncludeNullItems=True)
graft_12 = GraftTree(Tree=simplify_10, IncludeEmptyLists=True, IncludeNullItems=True)
join_7 = TextJoin(Text=[graft_9, graft_10, graft_11, graft_12])
jh = Text("JH")
flatten_5 = FlattenTree(Tree=join_7, Path="{0}")

# ----
filter_7 = StreamFilter(Gate=use_custom_jog_home_2, Stream0=jh, Stream1=flatten(join_6))

# ---- group: Jog to startpoints (continued)
merge_2 = Merge(Data1=flatten_5, Data2=filter_7)

# ---- group: Insert J2 commands
lng_4 = ListLength(List=merge_2)
dup_7 = DuplicateData(Data=Slider(1, range=0..1), Number=lng_4, Order=True)
addition = Addition(A=dup_7, B=merge)
ma_2 = MassAddition(Input=addition)  # -> Result, PartialResults
ins_2 = InsertItems(List=ins, Item=merge_2, Indices=ma_2.PartialResults, Wrap=True)

# ----
flatten_6 = FlattenTree(Tree=ins_2, Path="{0}")
merge_3 = Merge(Data1=panel_4, Data3=filter_6, Data4=filter_5, Data5=panel_5, Data6=join_5, Data7=flatten_6, Data8=filter_4)
shopbot_code_connect_panel_stream_and_sa = ClusterOutput(merge_3)  # "ShopBot code - Connect panel, stream and save as .sbp"
stream_and_save_as_sbp = Panel(merge_3)

# ==== cluster Cluster
background_details = Panel("<svg xmlns=\"http://www.w3.org/2000/svg\" version=\"1.1\" width=\"W\" height=\"H\" style=\"background-color:rgb(C)\">")
background_width = ClusterInput()
rep = ReplaceText(Text=background_details, Find="W", BackgroundWidth=background_width, RecursiveReplace=False)
background_height = ClusterInput()
rep_2 = ReplaceText(Text=rep, Find="H", BackgroundHeight=background_height, RecursiveReplace=False)
background_color = ClusterInput()
rep_3 = ReplaceText(Text=rep_2, Find="C", BackgroundColor=background_color, RecursiveReplace=False)
data = ClusterInput()
data_2 = Data(data)
merge = Merge(Data1=rep_3, Data2=data_2, Data3="</svg>")
svg_composer = ClusterOutput(merge)

# ==== cluster Cluster_2
polyline = ClusterInput()
disc = Discontinuity(Polyline=polyline, Level=1)  # -> Points, Parameters
pdecon = Deconstruct(Point=disc.Points)  # -> XComponent, YComponent, ZComponent
background_height = ClusterInput()
polyline_string = Panel("<polyline points=\"C\" stroke=\"rgb(S)\" stroke-width=\"W\" stroke-dasharray=\"A\" fill=\"none\" />")
subtraction = Subtraction(BackgroundHeight=background_height, B=pdecon.YComponent)
concat = Concatenate(FragmentA=pdecon.XComponent, FragmentB=",", FragmentC=subtraction, FragmentD=" ")
join = TextJoin(Text=concat)
stroke_color = ClusterInput()
rep = ReplaceText(Text=polyline_string, Find="C", Replace=join, RecursiveReplace=False)
stroke_width = ClusterInput()
rep_2 = ReplaceText(Text=rep, Find="S", StrokeColor=stroke_color, RecursiveReplace=False)
rep_3 = ReplaceText(Text=rep_2, Find="W", StrokeWidth=stroke_width, RecursiveReplace=False)
stroke_dasharray = ClusterInput()
rep_4 = ReplaceText(Text=rep_3, Find="A", StrokeDasharray=stroke_dasharray, RecursiveReplace=False)
polyline_svg = ClusterOutput(rep_4)

# ==== cluster ConnectOverlappingToolpaths
polyline_toolpaths = ClusterInput()
polyline_toolpaths_2 = Curve(polyline_toolpaths)
clean = CleanTree(RemoveNulls=True, RemoveInvalid=True, RemoveEmpty=False, Tree=polyline_toolpaths_2)
crv = Curve(clean)
cp = ControlPoints(Curve=crv)  # -> Points, Weights, Knots
cp_2 = ControlPoints(Curve=crv)  # -> Points, Weights, Knots
end = EndPoints(Curve=crv)  # -> Start, End
lng = ListLength(List=cp.Points)
pshift = ShiftPaths(Data=cp_2.Points, Offset=-1)
shift = ShiftList(List=end.Start, Shift=1, Wrap=False)
shift_2 = ShiftList(List=end.End, Shift=-1, Wrap=False)
pshift_2 = ShiftPaths(Data=lng, Offset=-1)
pline = PolyLine(Vertices=pshift, Closed=False)
pdecon = Deconstruct(Point=shift)  # -> XComponent, YComponent, ZComponent
pdecon_2 = Deconstruct(Point=shift_2)  # -> XComponent, YComponent, ZComponent
ma = MassAddition(Input=pshift_2)  # -> Result, PartialResults
cp_3 = ControlPoints(Curve=pline)  # -> Points, Weights, Knots
pshift_3 = ShiftPaths(Data=cp_2.Points, Offset=-1)
flatten = FlattenTree(Tree=ma.PartialResults, Path="{0}")
multiplication = Multiplication(A=pdecon.YComponent, B="100")
multiplication_2 = Multiplication(A=pdecon.XComponent, B="100")
multiplication_3 = Multiplication(A=pdecon_2.XComponent, B="100")
multiplication_4 = Multiplication(A=pdecon_2.YComponent, B="100")
lng_2 = ListLength(List=pshift_3)
lng_3 = ListLength(List=cp_3.Points)
int = Integer(multiplication)
int_2 = Integer(multiplication_2)
int_3 = Integer(multiplication_3)
int_4 = Integer(multiplication_4)
smaller = SmallerThan(FirstNumber=lng_3, SecondNumber=lng_2)  # -> SmallerThan, OrEqualTo
division = Division(A=int, B="100")
division_2 = Division(A=int_2, B="100")
division_3 = Division(A=int_3, B="100")
division_4 = Division(A=int_4, B="100")
unreialiable_result_boolean = Panel(smaller.SmallerThan)
equals = Equality(FirstNumber=division_2, SecondNumber=division_3)  # -> Equality, Inequality
equals_2 = Equality(FirstNumber=division, SecondNumber=division_4)  # -> Equality, Inequality
and = GateAnd(A=equals.Equality, B=equals_2.Equality)

# ---- group: Line connection viz for troubleshooting
dispatch = Dispatch(List=shift_2, DispatchPattern=and)  # -> ListA, ListB
dispatch_2 = Dispatch(List=shift, DispatchPattern=and)  # -> ListA, ListB
ln = Line(StartPoint=dispatch_2.ListA, EndPoint=dispatch.ListA)  # disabled

# ----
rev = ReverseList(List=flatten)
rev_2 = ReverseList(List=flatten)
cull_i = CullIndex(List=rev, Indices="0", Wrap=True)
item = ListItem(List=rev, Index="0", Wrap=True)
cull_i_2 = CullIndex(List=rev_2, Indices="0", Wrap=True)
pshift_4 = ShiftPaths(Data=and, Offset=-1)
pshift_5 = ShiftPaths(Data=cull_i, Offset=-1)
pshift_6 = ShiftPaths(Data=cull_i_2, Offset=-1)
lng_4 = ListLength(List=pshift_4)
rev_3 = ReverseList(List=pshift_5)
rev_4 = ReverseList(List=pshift_6)
ins = InsertItems(List=pshift_4, Item=Toggle(False), Indices="0", Wrap=True)
ins_2 = InsertItems(List=pshift_4, Item=Toggle(False), Indices=lng_4, Wrap=True)
subtraction = Subtraction(A=rev_3, B="1")
cp_4 = ControlPoints(Curve=pline)  # -> Points, Weights, Knots
flatten_2 = FlattenTree(Tree=pshift, Path="{0}")
pshift_7 = ShiftPaths(Data=ins, Offset=-1)
merge = Merge(Data1=subtraction, Data2=item)
merge_2 = Merge(Data1="0", Data2=rev_4)
pshift_8 = ShiftPaths(Data=ins_2, Offset=-1)
dispatch_3 = Dispatch(List=merge_2, DispatchPattern=pshift_7)  # -> ListA, ListB
dispatch_4 = Dispatch(List=merge, DispatchPattern=pshift_8)  # -> ListA, ListB
dom = ConstructDomain(DomainStart=dispatch_3.ListB, DomainEnd=dispatch_4.ListB)
subset = SubList(List=flatten_2, Domain=dom, Wrap=False)  # -> List, Index
pline_2 = PolyLine(Vertices=subset.List, Closed=False)
unreialiable_result_boolean_2 = Panel(unreialiable_result_boolean)
flatten_3 = FlattenTree(Tree=pline_2, Path="{0}")
pshift_9 = ShiftPaths(Data=pline_2, Offset=-2)
filter = StreamFilter(Gate=unreialiable_result_boolean_2, Stream0=pshift_9)
item_2 = ListItem(List=flatten_3, Index=0, Wrap=True)
polyline_toolpaths_3 = Curve(polyline_toolpaths_2)
null = NullItem(Item=item_2)  # -> NullFlags, InvalidFlags, Description
filter_2 = StreamFilter(Gate=null.NullFlags, Stream0=flatten_3, Stream1=polyline_toolpaths_3)
z_connected_polyline_toolpaths = Curve(filter_2)
z_connected_polyline_toolpaths_2 = ClusterOutput(z_connected_polyline_toolpaths)

# ==== cluster TabToolpaths
polyline_toolpaths = ClusterInput()
tab_breps = ClusterInput()
tab_breps_2 = Brep(tab_breps)
polyline_toolpaths_2 = Curve(polyline_toolpaths)
flatten = FlattenTree(Tree=tab_breps_2, Path="{0}")
bbox = BoundingBox(Content=polyline_toolpaths_2, Plane=PlaneXY(0, 0, 0), UnionBox=True)  # -> Box, Box_2
bbox_2 = BoundingBox(Content=flatten, Plane=PlaneXY(0, 0, 0))  # -> Box, Box_2
debrep = DeconstructBrep(Brep=bbox.Box)  # -> Faces, Edges, Vertices

# ---- group: Check for input tab breps
item = ListItem(List=flatten, Index=0, Wrap=True)
null = NullItem(Item=item)  # -> NullFlags, InvalidFlags, Description
no_tab_brep_input_boolean = Panel(null.NullFlags)

# ----
debrep_2 = DeconstructBrep(Brep=bbox_2.Box)  # -> Faces, Edges, Vertices
item_2 = ListItem(List=debrep.Vertices, Index="0", Wrap=True)
item_3 = ListItem(List=debrep_2.Vertices, Index="4", Wrap=True)
item_4 = ListItem(List=debrep_2.Vertices, Index="0", Wrap=True)
pdecon = Deconstruct(Point=flatten(item_2))  # -> XComponent, YComponent, ZComponent
pdecon_2 = Deconstruct(Point=flatten(item_3))  # -> XComponent, YComponent, ZComponent
pdecon_3 = Deconstruct(Point=flatten(item_4))  # -> XComponent, YComponent, ZComponent
subtraction = Subtraction(A=pdecon.ZComponent, B="0.1")
panel = Panel(subtraction)

larger = LargerThan(FirstNumber=pdecon_2.ZComponent, SecondNumber="0")  # -> LargerThan, OrEqualTo
subtraction_2 = Subtraction(A=pdecon_2.ZComponent, B="0")
dispatch = Dispatch(List=subtraction_2, DispatchPattern=larger.LargerThan)  # -> ListA, ListB
lng = ListLength(List=dispatch.ListB)
dup = DuplicateData(Data="0", Number=lng, Order=True)
weave = Weave(Pattern=larger.LargerThan, Stream0=dup, Stream1=dispatch.ListA, NullGaps=False)
neg = Negative(Value=weave)
Z = UnitZ(Factor=neg)
move = Move(Geometry=flatten(item_3), Motion=Z)  # -> Geometry, Transform
move_2 = Move(Geometry=flatten(item_4), Motion=Z)  # -> Geometry, Transform
move_3 = Move(Geometry=tab_breps_2, Motion=Z)  # -> Geometry, Transform

pdecon_4 = Deconstruct(Point=flatten(move_2.Geometry))  # -> XComponent, YComponent, ZComponent
smaller = SmallerThan(FirstNumber=pdecon_4.ZComponent, SecondNumber=panel)  # -> SmallerThan, OrEqualTo
dist = Distance(PointA=flatten(item_3), PointB=flatten(item_4))
subtraction_3 = Subtraction(A=pdecon_4.ZComponent, B=panel)
dispatch_2 = Dispatch(List=move_3.Geometry, DispatchPattern=smaller.SmallerThan)  # -> ListA, ListB
dispatch_3 = Dispatch(List=move.Geometry, DispatchPattern=smaller.SmallerThan)  # -> ListA, ListB
dispatch_4 = Dispatch(List=dist, DispatchPattern=smaller.SmallerThan)  # -> ListA, ListB
dispatch_5 = Dispatch(List=subtraction_3, DispatchPattern=smaller.SmallerThan)  # -> ListA, ListB
xy = XYPlane(Origin=dispatch_3.ListB)
addition = Addition(A=dispatch_5.ListB, B=dispatch_4.ListB)
division = Division(A=addition, B=dispatch_4.ListB)
scale_nu = ScaleNU(Geometry=dispatch_2.ListB, Plane=xy, ScaleX=1, ScaleY=1, ScaleZ=division)  # -> Geometry, Transform
weave_2 = Weave(Pattern=smaller.SmallerThan, Stream0=scale_nu.Geometry, Stream1=dispatch_2.ListA, NullGaps=False)

polyline_toolpaths_3 = Curve(polyline_toolpaths_2)
scaled_positioned_tab_breps = Brep(weave_2)
no_tab_brep_input_boolean_2 = Panel(no_tab_brep_input_boolean)
polyline_toolpaths_4 = Curve(polyline_toolpaths_2)

mesh = MeshBrep(
    Brep=scaled_positioned_tab_breps,
    Settings={GridMaxCount=0, GridMinCount=16, JaggedSeams=False, MaxEdgeLength=0, MinEdgeLength=0.0001, MinTolerance=0, Refine=True, RefineAngle=0, RelativeTolerance=0.65, SimplePlanes=True, Tolerance=0})
mjoin = MeshJoin(Meshes=mesh)
tab_volume_mesh = Mesh(mjoin)
colom = CollisionOneMany(Collider=tab_volume_mesh, Obstacles=graft(polyline_toolpaths_3))  # -> Collision, Index
pshift = ShiftPaths(Data=colom.Collision, Offset=-1)

tab_or_no_tab_booleans = Integer(pshift)

dispatch_6 = Dispatch(List=polyline_toolpaths_3, DispatchPattern=tab_or_no_tab_booleans)  # -> ListA, ListB
toolpaths_without_tabs = Curve(dispatch_6.ListB)
toolpaths_for_tabbing = Curve(dispatch_6.ListA)

bbox_3 = BoundingBox(Content=mesh, Plane=PlaneXY(0, 0, 0))  # -> Box, Box_2
volume = Volume(Geometry=bbox_3.Box)  # -> Volume, Centroid
xy_2 = XYPlane(Origin=volume.Centroid)
scale_nu_2 = ScaleNU(Geometry=bbox_3.Box, Plane=xy_2, ScaleX="1.01", ScaleY="1.01", ScaleZ=1)  # -> Geometry, Transform
mjoin_2 = MeshJoin(Meshes=scale_nu_2.Geometry)
tab_control_point_intersect_mesh = Mesh(mjoin_2)

mcx = MeshCurve(Mesh=tab_volume_mesh, Curve=toolpaths_for_tabbing)  # -> Points, Faces
crv_cp = CurveClosestPoint(Point=mcx.Points, Curve=graft(toolpaths_for_tabbing))  # -> Point, Parameter, Distance
tab_volume_mesh_2 = Mesh(tab_volume_mesh)
shatter = Shatter(Curve=graft(toolpaths_for_tabbing), Parameters=crv_cp.Parameter)
curvepoint = PointOnCurve(shatter, parameter=0.5)
minc = MeshInclusion(Mesh=tab_volume_mesh_2, Point=curvepoint, Strict=False)
dispatch_7 = Dispatch(List=shatter, DispatchPattern=minc)  # -> ListA, ListB
toolpaths_inside_tabs = Curve(dispatch_7.ListA)
toolpath_outside_tabs = Curve(dispatch_7.ListB)

cp = ControlPoints(Curve=toolpaths_inside_tabs)  # -> Points, Weights, Knots
Z_2 = UnitZ(Factor=1)
meshray = MeshRay(Mesh=tab_control_point_intersect_mesh, Point=cp.Points, Direction=Z_2)  # -> Point, Hit
pline = PolyLine(Vertices=meshray.Point, Closed=False)
pshift_2 = ShiftPaths(Data=pline, Offset=-1)

weave_3 = Weave(Pattern=minc, Stream0=toolpath_outside_tabs, Stream1=pshift_2, NullGaps=False)
cp_2 = ControlPoints(Curve=weave_3)  # -> Points, Weights, Knots

# ---- group: Test closing
cls = Closed(Curve=toolpaths_for_tabbing)  # -> Closed, Periodic
graft = GraftTree(Tree=cls.Closed, IncludeEmptyLists=True, IncludeNullItems=True)

# ----
pshift_3 = ShiftPaths(Data=cp_2.Points, Offset=-1)
pline_2 = PolyLine(Vertices=pshift_3, Closed=graft)
pshift_4 = ShiftPaths(Data=pline_2, Offset="-2")
toolpaths_without_tabs_2 = Curve(toolpaths_without_tabs)
tab_or_no_tab_booleans_2 = Integer(tab_or_no_tab_booleans)
toolpaths_with_tabs = Curve(pshift_4)
weave_4 = Weave(Pattern=tab_or_no_tab_booleans_2, Stream0=toolpaths_without_tabs_2, Stream1=toolpaths_with_tabs, NullGaps=False)

polyline_toolpaths_5 = Curve(polyline_toolpaths_2)
end = EndPoints(Curve=weave_4)  # -> Start, End

end_2 = EndPoints(Curve=polyline_toolpaths_5)  # -> Start, End
crv_cp_2 = CurveClosestPoint(Point=end_2.End, Curve=weave_4)  # -> Point, Parameter, Distance
pt = Point(end_2.End)

dist_2 = Distance(PointA=end.End, PointB=pt)
smaller_2 = SmallerThan(FirstNumber=dist_2, SecondNumber="0.01")  # -> SmallerThan, OrEqualTo
dispatch_8 = Dispatch(List=crv_cp_2.Parameter, DispatchPattern=smaller_2.SmallerThan)  # -> ListA, ListB
dispatch_9 = Dispatch(List=weave_4, DispatchPattern=smaller_2.SmallerThan)  # -> ListA, ListB
seam = Seam(Curve=dispatch_9.ListB, Seam=dispatch_8.ListB)
weave_5 = Weave(Pattern=smaller_2.SmallerThan, Stream0=seam, Stream1=dispatch_9.ListA, NullGaps=False)

filter = StreamFilter(Gate=no_tab_brep_input_boolean_2, Stream0=weave_5, Stream1=polyline_toolpaths_4)
tabbed_polyline_toolpaths = Curve(filter)
tabbed_polyline_toolpaths_2 = ClusterOutput(tabbed_polyline_toolpaths)

# ==== cluster RampToolpathPlunges
toolpaths_to_ramp = ClusterInput()
ramp_angle = ClusterInput()
toolpaths_to_ramp_2 = Curve(toolpaths_to_ramp)
ramp_angle_2 = Number(ramp_angle)
end = EndPoints(Curve=toolpaths_to_ramp_2)  # -> Start, End
pdecon = Deconstruct(Point=end.Start)  # -> XComponent, YComponent, ZComponent
abs = Absolute(Value=pdecon.ZComponent)
dom = ConstructDomain(DomainStart="1", DomainEnd="89")
constrain = Constrain(Number=ramp_angle_2, Domain=dom)
rad = Radians(Degrees=constrain)
rtrig = RightTrigonometry(Beta=rad, QLength=abs)  # -> Alpha, Beta, PLength, QLength, RLength
len = Length(Curve=toolpaths_to_ramp_2)
smaller = SmallerThan(FirstNumber=len, SecondNumber=rtrig.PLength)  # -> SmallerThan, OrEqualTo
dispatch = Dispatch(List=len, DispatchPattern=smaller.OrEqualTo)  # -> ListA, ListB
dispatch_2 = Dispatch(List=rtrig.PLength, DispatchPattern=smaller.OrEqualTo)  # -> ListA, ListB
division = Division(A=dispatch_2.ListA, B=dispatch.ListA)
weave = Weave(Pattern=smaller.OrEqualTo, Stream0=dispatch_2.ListB, Stream1=dispatch.ListA, NullGaps=False)

cls = Closed(Curve=toolpaths_to_ramp_2)  # -> Closed, Periodic
dispatch_3 = Dispatch(List=toolpaths_to_ramp_2, DispatchPattern=cls.Closed)  # -> ListA, ListB
flip = FlipCurve(Curve=dispatch_3.ListA)  # -> Curve, Flag
weave_2 = Weave(Pattern=cls.Closed, Stream0=dispatch_3.ListB, Stream1=flip.Curve, NullGaps=False)

round = Round(Number=division)  # -> Nearest, Floor, Ceiling
division_2 = Division(A=weave, B="0.1")
dispatch_4 = Dispatch(List=abs, DispatchPattern=smaller.OrEqualTo)  # -> ListA, ListB
int = Integer(division_2)
division_3 = Division(A=dispatch_4.ListA, B=round.Ceiling)
int_2 = Integer(division_2)
division_4 = Division(A=weave, B=int)
weave_3 = Weave(Pattern=smaller.OrEqualTo, Stream0=dispatch_4.ListB, Stream1=division_3, NullGaps=False)
addition = Addition(A=int, B="1")
division_5 = Division(A=weave_3, B=int_2)
series = Series(Start=0, Step=division_4, Count=addition)
series_2 = Series(Start=0, Step=division_5, Count=addition)
eval = EvaluateLength(Curve=graft(weave_2), Length=series, Normalized=False)  # -> Point, Tangent, Parameter
Z = UnitZ(Factor=series_2)
move = Move(Geometry=eval.Point, Motion=Z)  # -> Geometry, Transform
pline = PolyLine(Vertices=move.Geometry, Closed=False)
pshift = ShiftPaths(Data=pline, Offset=-1)
redpline = Reduce(Polyline=pshift, Tolerance="0.02")  # -> Polyline, Reduction
flip_2 = FlipCurve(Curve=redpline.Polyline)  # -> Curve, Flag

dispatch_5 = Dispatch(List=flip_2.Curve, DispatchPattern=smaller.OrEqualTo)  # -> ListA, ListB
end_2 = EndPoints(Curve=dispatch_5.ListA)  # -> Start, End
pdecon_2 = Deconstruct(Point=end_2.End)  # -> XComponent, YComponent, ZComponent
pdecon_3 = Deconstruct(Point=end_2.Start)  # -> XComponent, YComponent, ZComponent
pt = ConstructPoint(XCoordinate=0, YCoordinate=0, ZCoordinate=pdecon_2.ZComponent)
pt_2 = ConstructPoint(XCoordinate=0, YCoordinate=0, ZCoordinate=pdecon_3.ZComponent)
dist = Distance(PointA=pt_2, PointB=pt)
series_3 = Series(Start=0, Step=dist, Count=round.Ceiling)
Z_2 = UnitZ(Factor=series_3)
move_2 = Move(Geometry=graft(dispatch_5.ListA), Motion=Z_2)  # -> Geometry, Transform

clean = CleanTree(RemoveNulls=True, RemoveInvalid=True, RemoveEmpty=False, Tree=move_2.Geometry)
join = JoinCurves(Curves=move_2.Geometry, Preserve=False)
flip_3 = FlipMatrix(Data=clean)
lng = ListLength(List=join)
dispatch_6 = Dispatch(List=flip_3, DispatchPattern=cls.Closed)  # -> ListA, ListB
larger = LargerThan(FirstNumber=lng, SecondNumber="1")  # -> LargerThan, OrEqualTo
flip_4 = FlipMatrix(Data=dispatch_6.ListB)
dispatch_7 = Dispatch(List=join, DispatchPattern=larger.LargerThan)  # -> ListA, ListB
simplify = SimplifyTree(Tree=dispatch_7.ListA, Front=False)
dispatch_8 = Dispatch(List=flip_4, DispatchPattern=[True, False])  # -> ListA, ListB
flatten = FlattenTree(Tree=dispatch_7.ListB, Path="{0}")
dispatch_9 = Dispatch(List=simplify, DispatchPattern=[True, False])  # -> ListA, ListB
cp = ControlPoints(Curve=dispatch_8.ListB)  # -> Points, Weights, Knots
pdecon_4 = Deconstruct(Point=cp.Points)  # -> XComponent, YComponent, ZComponent
cp_2 = ControlPoints(Curve=dispatch_9.ListB)  # -> Points, Weights, Knots
rev = ReverseList(List=pdecon_4.ZComponent)
pdecon_5 = Deconstruct(Point=cp_2.Points)  # -> XComponent, YComponent, ZComponent
pt_3 = ConstructPoint(XCoordinate=pdecon_4.XComponent, YCoordinate=pdecon_4.YComponent, ZCoordinate=rev)
rev_2 = ReverseList(List=pdecon_5.ZComponent)
pline_2 = PolyLine(Vertices=pt_3, Closed=False)
pt_4 = ConstructPoint(XCoordinate=pdecon_5.XComponent, YCoordinate=pdecon_5.YComponent, ZCoordinate=rev_2)
pshift_2 = ShiftPaths(Data=pline_2, Offset=-1)
pline_3 = PolyLine(Vertices=pt_4, Closed=False)
flip_5 = FlipCurve(Curve=pshift_2)  # -> Curve, Flag
pshift_3 = ShiftPaths(Data=pline_3, Offset=-1)
weave_4 = Weave(Pattern=[0, 1], Stream0=dispatch_8.ListA, Stream1=flip_5.Curve, NullGaps=False)
flip_6 = FlipCurve(Curve=pshift_3)  # -> Curve, Flag
flip_7 = FlipMatrix(Data=weave_4)
weave_5 = Weave(Pattern=[0, 1], Stream0=dispatch_9.ListA, Stream1=flip_6.Curve, NullGaps=False)
weave_6 = Weave(Pattern=cls.Closed, Stream0=flip_7, Stream1=dispatch_6.ListA, NullGaps=False)
join_2 = JoinCurves(Curves=weave_5, Preserve=False)
flip_8 = FlipMatrix(Data=weave_6)
simplify_2 = SimplifyTree(Tree=join_2, Front=False)
join_3 = JoinCurves(Curves=flip_8, Preserve=False)
number_slider = Slider(4, range=0..10)
weave_7 = Weave(Pattern=flatten(larger.LargerThan), Stream0=flatten(flatten), Stream1=flatten(simplify_2), NullGaps=False)
pshift_4 = ShiftPaths(Data=join_3, Offset=-1)
pshift_5 = ShiftPaths(Data=pshift_4, Offset=-1)
weave_8 = Weave(Pattern=smaller.OrEqualTo, Stream0=dispatch_5.ListB, Stream1=weave_7, NullGaps=False)
item = ListItem(List=toolpaths_to_ramp_2, Index=number_slider, Wrap=True)
item_2 = ListItem(List=weave_8, Index=number_slider, Wrap=True)
weave_9 = Weave(Pattern=[0, 1], Stream0=weave_8, Stream1=toolpaths_to_ramp_2, NullGaps=False)
ramped_toolpaths = Curve(weave_9)
ramped_toolpaths_2 = ClusterOutput(ramped_toolpaths)
