# Grasshopper definition Motoman toolpath generator and post processor.gh (Grasshopper 0.9.76)
# plug-ins: KUKA|prc - Parametric Robot Control for Grasshopper, Firefly.Core

z_offset = Panel("0.2")
srf = Surface(<surface referenced from the Rhino model>)
number_slider = Slider(10, range=0..100)
dim = Dimensions(Surface=srf)  # -> UDimension, VDimension
Z = UnitZ(Factor=z_offset)
division = Division(A=dim.VDimension, B=number_slider)
subtraction = Subtraction(A=number_slider, B=Slider(1, range=0..10))
series = Series(Start=0, Step=division, Count=subtraction)
pt = ConstructPoint(XCoordinate=0, YCoordinate=0, ZCoordinate=0)
pt_2 = ConstructPoint(XCoordinate=pt, YCoordinate=series, ZCoordinate=0)
iso = IsoCurve(Surface=srf, UVPoint=pt_2)  # -> UIsocurve, VIsocurve
crv = Curve(<curve referenced from the Rhino model>)
topoly = CurveToPolyline(Curve=iso.UIsocurve, ToleranceDistance=Slider(1, range=0..10), ToleranceAngle=0)  # -> Polyline, Segments
X = Panel("904.64")
Y = Panel("-358.02")
Z_2 = Panel("-235.54")
X_2 = Panel("977.67")
Y_2 = Panel("-208.85")
Z_3 = Panel("-235.23")
X_3 = Panel("828.26")
Y_3 = Panel("-209.81")
Z_4 = Panel("-235.57")
dispatch = Dispatch(List=flatten(topoly.Polyline), DispatchPattern=[True, False])  # -> ListA, ListB
panel = Panel("""rx-22.7
ry-58.13
rz-166.15""")
flip = FlipCurve(Curve=dispatch.ListB)  # -> Curve, Flag
rhinorefpoint1 = Point(Point(847.4501024, 509.5433037, 0))
rhinorefpoint2 = Point(Point(997.4501024, 509.5433037, 0))
rhinorefpoint3 = Point(Point(922.4501024, 359.5433037, 0))
weave = Weave(Pattern=[0, 1], Stream0=dispatch.ListA, Stream1=flip.Curve, NullGaps=False)
pt_3 = ConstructPoint(XCoordinate=X_2, YCoordinate=Y_2, ZCoordinate=Z_3)
pt_4 = ConstructPoint(XCoordinate=X_3, YCoordinate=Y_3, ZCoordinate=Z_4)
pt_5 = ConstructPoint(XCoordinate=X, YCoordinate=Y, ZCoordinate=Z_2)
cp = ControlPoints(Curve=weave)  # -> Points, Weights, Knots
rhinorefpoint1_2 = Point(rhinorefpoint1)
rhinorefpoint2_2 = Point(rhinorefpoint2)
rhinorefpoint3_2 = Point(rhinorefpoint3)
roborefpoint1 = Point(pt_4)
roborefpoint2 = Point(pt_3)
roborefpoint3 = Point(pt_5)
flatten = FlattenTree(Tree=cp.Points, Path="{0}")
srf_cp = SurfaceClosestPoint(Point=flatten, Surface=srf)  # -> Point, UVPoint, Distance
rec_3pt = Rectangle3Pt(PointA=rhinorefpoint1_2, PointB=rhinorefpoint2_2, PointC=rhinorefpoint3_2)  # -> Rectangle, Length
area = Area(Geometry=rec_3pt.Rectangle)  # -> Area, Centroid
move = Move(Geometry=area.Centroid, Motion=Z)  # -> Geometry, Transform

# ---- group: Create spiral toolpath
spiral_box_start_size = Panel(Slider(45, range=0..100))
offset_distance = Panel(Slider(5, range=0..10))
number_off_offsets = Panel(Slider(10, range=0..10))
pt_6 = ConstructPoint(XCoordinate=Slider(800, range=0..1000), YCoordinate=Slider(96, range=0..1000), ZCoordinate=Slider(300, range=0..1000))
offset_distance_2 = Panel("0")
xy = XYPlane(Origin=move.Geometry)
multiplication = Multiplication(A=spiral_box_start_size, B=Slider(0.5, range=0..1))
series_2 = Series(Start=offset_distance_2, Step=offset_distance, Count=number_off_offsets)
neg = Negative(Value=multiplication)
dom = ConstructDomain(DomainStart=neg, DomainEnd=multiplication)
rectangle = Rectangle(Plane=xy, XSize=dom, YSize=dom, Radius=0)  # -> Rectangle, Length
offset = Offset(Curve=rectangle.Rectangle, Distance=series_2, Plane=PlaneXY(0, 0, 0), Corners=1)
redpline = Reduce(Polyline=offset, Tolerance=1)  # -> Polyline, Reduction
cp_2 = ControlPoints(Curve=redpline.Polyline)  # -> Points, Weights, Knots
flatten_2 = FlattenTree(Tree=cp_2.Points, Path="{0}")
pline = PolyLine(Vertices=flatten_2, Closed=False)
cp_3 = ControlPoints(Curve=pline)  # -> Points, Weights, Knots
xy_2 = XYPlane(Origin=cp_3.Points)

# ----
rec_3pt_2 = Rectangle3Pt(PointA=roborefpoint1, PointB=roborefpoint2, PointC=roborefpoint3)  # -> Rectangle, Length
evalsrf = EvaluateSurface(Surface=srf, Point=srf_cp.UVPoint)  # -> Point, Normal, Frame
Z_5 = UnitZ(Factor=1)
planar = Planar(Curve=rec_3pt.Rectangle)  # -> Planar, Plane, Deviation
planar_2 = Planar(Curve=rec_3pt_2.Rectangle)  # -> Planar, Plane, Deviation
pipeline = GeometryPipeline(
    GroupByLayer=False,
    GroupByType=False,
    IncludeHidden=True,
    IncludeLocked=True,
    LayerFilter="Robot follow curve",
    NameFilter="*",
    TypeFilter=4)
rev = Reverse(Vector=Z_5)
pln = Plane(planar.Plane)
align = AlignPlane(Plane=evalsrf.Frame, Direction=Z_5)  # -> Plane, Angle
pln_2 = Plane(planar_2.Plane)
brep_of_pentamarker_tool = Brep([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])  # disabled
pln_3 = Plane(xy_2)
pt_7 = Point(Point(0, -164.8067942, 19.49673696))
pipeline_2 = GeometryPipeline(
    GroupByLayer=False,
    GroupByType=False,
    IncludeHidden=True,
    IncludeLocked=True,
    LayerFilter="Robot follow curve",
    NameFilter="*",
    TypeFilter=4)
orient = Orient(Geometry=pln_3, Source=pln, Target=pln_2)  # -> Geometry, Transform
jagged = SettingsSpeed()
marker_offset_values = Panel(pt_7)
mesh = MeshBrep(Brep=brep_of_pentamarker_tool, Settings=jagged)
pln_4 = Plane(orient.Geometry)
crv_2 = Curve(pipeline_2)
mjoin = MeshJoin(Meshes=mesh)
frames = CurveFrames(Curve=crv_2, Count=Slider(30, range=0..100))  # -> Frames, Parameters
pln_5 = Plane()
# Green - right
# Red - down
# Wrong
# 
# Green - right
# Red - Up
number_slider_2 = Slider(270, range=0..370)
X_4 = UnitX(Factor=1)
frames_2 = CurveFrames(Curve=crv_2, Count=Slider(20, range=0..100))  # -> Frames, Parameters; disabled
align_2 = AlignPlane(Plane=frames_2.Frames, Direction=X_4)  # -> Plane, Angle
topoly_2 = CurveToPolyline(Curve=crv_2, ToleranceDistance=Slider(1, range=0..1), ToleranceAngle=0)  # -> Polyline, Segments
rad = Radians(Degrees=Slider(180, range=0..370))
rad_2 = Radians(Degrees=number_slider_2)
number_slider_3 = Slider(90, range=0..370)
rotate = Rotate(Geometry=pln_4, Angle=degrees(Slider(0, range=0..370)), Plane=pln_4)  # -> Geometry, Transform
deplane = DeconstructPlane(Plane=rotate.Geometry)  # -> Origin, XAxis, YAxis, ZAxis
X_5 = UnitX(Factor=1)
rad_3 = Radians(Degrees=Slider(0, range=0..370))
rad_4 = Radians(Degrees=Slider(0, range=0..370))
cp_4 = ControlPoints(Curve=topoly_2.Polyline)  # -> Points, Weights, Knots
item = ListItem(List=cp_4.Points, Index=Slider(2, range=0..10), Wrap=True)
xz = XZPlane(Origin=item)
xy_3 = XYPlane(Origin=item)
yz = YZPlane(Origin=item)
xz_2 = XZPlane(Origin=item)
xy_4 = XYPlane(Origin=item)
rotate_2 = Rotate(Geometry=xz_2, Angle=rad_3, Plane=yz)  # -> Geometry, Transform
deplane_2 = DeconstructPlane(Plane=xz_2)  # -> Origin, XAxis, YAxis, ZAxis
rad_5 = Radians(Degrees=Slider(109, range=0..1000))
rot3d = Rotate3D(Geometry=rotate.Geometry, Angle=rad, Center=deplane.Origin, Axis=deplane.XAxis)  # -> Geometry, Transform
pt_8 = ConstructPoint(XCoordinate=0, YCoordinate=0, ZCoordinate=0)
yz_2 = YZPlane(Origin=pt_8)
rotate_3 = Rotate(Geometry=rotate_2.Geometry, Angle=rad_5, Plane=xz)  # -> Geometry, Transform
rot3d_2 = Rotate3D(Geometry=xz_2, Angle=rad_3, Center=deplane_2.Origin, Axis=deplane_2.XAxis)  # -> Geometry, Transform
deplane_3 = DeconstructPlane(Plane=rot3d.Geometry)  # -> Origin, XAxis, YAxis, ZAxis
yz_3 = YZPlane(Origin=pt_8)
xz_3 = XZPlane(Origin=Point(0, 0, 0))
xy_5 = XYPlane(Origin=pt_8)
xz_4 = XZPlane(Origin=cp_4.Points)
vec2pt = Vector2Pt(PointA=pt_8, PointB=cp_4.Points, Unitize=False)  # -> Vector, Length
yz_4 = YZPlane(Origin=cp_4.Points)
xy_6 = XYPlane(Origin=cp_4.Points)
# Notes tool orientation:
# regular XY plane orients glange uppwards,
# flipping plane X axis orients plane downwards.
# Crossing origo line along  axis makes tool turn 360 degrees.
# Regular YZ plane makes flange face forwards
# XY switch is good, but it seems intrinsic extrinsic is wrong. Check how to do consectutive rotations
# Rotating YZ plane around YZ plane works untill 89deg. 90deg and more flips orientation in conversion, causing flange to face robot and collide.
# Plane to Rx Ry Rz need fix
# Testing Switching X and Y rotation output
# It seems roatations need to be intrinsic, not extrensic
# Stuck. switch x and y back? use xy start plane for checking?
rotate_4 = Rotate(Geometry=rotate_3.Geometry, Angle=rad_5, Plane=xy_3)  # -> Geometry, Transform
deplane_4 = DeconstructPlane(Plane=rot3d_2.Geometry)  # -> Origin, XAxis, YAxis, ZAxis
rot3d_3 = Rotate3D(Geometry=rot3d.Geometry, Angle=rad_2, Center=deplane_3.Origin, Axis=deplane_3.YAxis)  # -> Geometry, Transform
rad_6 = Radians(Degrees=Slider(0, range=0..370))
rad_7 = Radians(Degrees=Slider(0, range=0..370))
rot3d_4 = Rotate3D(Geometry=rot3d_2.Geometry, Angle=rad_5, Center=deplane_4.Origin, Axis=deplane_4.YAxis)  # -> Geometry, Transform

# ---- group: Flip from facing up to facing down
deplane_5 = DeconstructPlane(Plane=xy_5)  # -> Origin, XAxis, YAxis, ZAxis
rev_2 = Reverse(Vector=deplane_5.XAxis)
pl = ConstructPlane(Origin=deplane_5.Origin, XAxis=rev_2, YAxis=deplane_5.YAxis)

# ----
rotate_5 = Rotate(Geometry=xy_5, Angle=degrees(Slider(0, range=0..370)), Plane=xy_5)  # -> Geometry, Transform
deplane_6 = DeconstructPlane(Plane=rot3d_4.Geometry)  # -> Origin, XAxis, YAxis, ZAxis
deplane_7 = DeconstructPlane(Plane=rotate_5.Geometry)  # -> Origin, XAxis, YAxis, ZAxis
rot3d_5 = Rotate3D(Geometry=rot3d_4.Geometry, Angle=rad_4, Center=deplane_6.Origin, Axis=deplane_6.ZAxis)  # -> Geometry, Transform
create_start_and_end_position = BooleanToggle(True)
move_speed_mm_s = Slider(50, range=5..100)
start_and_end_height = Slider(12, range=0..100)
toolpath_planes = Plane(xy_6)
number_slider_4 = Slider(100, range=0..1000)
rot3d_6 = Rotate3D(Geometry=rotate_5.Geometry, Angle=rad_6, Center=deplane_7.Origin, Axis=deplane_7.YAxis)  # -> Geometry, Transform
crv_3 = Curve(<curve referenced from the Rhino model>)
preview = CustomPreview(
    Geometry=rot3d_5.Geometry,
    Shader={ambient=RGB(0, 0, 0), diffuse=RGB(255, 105, 180), emission=RGB(76, 32, 54), shine=0.5, specular=RGB(255, 255, 255), transparency=0})
deplane_8 = DeconstructPlane(Plane=rot3d_6.Geometry)  # -> Origin, XAxis, YAxis, ZAxis
toolpath_planes_2 = Plane(rot3d_3.Geometry)
frames_3 = CurveFrames(Curve=crv_3, Count=Slider(200, range=0..1000))  # -> Frames, Parameters
move_speed_mm_s_2 = Panel(move_speed_mm_s)
start_and_end_height_2 = Panel(start_and_end_height)
create_start_and_end_position_2 = Panel(create_start_and_end_position)
divlength = DivideLength(Curve=crv_3, Length=Slider(14, range=10..60))  # -> Points, Tangents, Parameters
rot3d_7 = Rotate3D(Geometry=rot3d_6.Geometry, Angle=rad_7, Center=deplane_8.Origin, Axis=deplane_8.ZAxis)  # -> Geometry, Transform
move_2 = Move(Geometry=rot3d_7.Geometry, Motion=vec2pt.Vector)  # -> Geometry, Transform
use_putput_bollean = Panel(Toggle(True))
deplane_9 = DeconstructPlane(Plane=frames_3.Frames)  # -> Origin, XAxis, YAxis, ZAxis
Y_4 = UnitY(Factor=1)
Z_6 = UnitZ(Factor=1)
rev_3 = Reverse(Vector=Z_6)
rev_4 = Reverse(Vector=deplane_9.YAxis)
rev_5 = Reverse(Vector=deplane_9.ZAxis)
rev_6 = ReverseList(List=toolpath_planes_2)
pl_2 = ConstructPlane(Origin=divlength.Points, XAxis=rev_3, YAxis=Y_4)
pl_3 = ConstructPlane(Origin=deplane_9.Origin, XAxis=rev_4, YAxis=deplane_9.ZAxis)
neg_2 = Negative(Value=start_and_end_height_2)
item_2 = ListItem(List=toolpath_planes_2, Index=0, Wrap=True)
item_3 = ListItem(List=rev_6, Index=0, Wrap=True)
Z_7 = UnitZ(Factor=1)
deplane_10 = DeconstructPlane(Plane=item_2)  # -> Origin, XAxis, YAxis, ZAxis
deplane_11 = DeconstructPlane(Plane=item_3)  # -> Origin, XAxis, YAxis, ZAxis
rev_7 = Reverse(Vector=Z_7)
multiplication_2 = Multiplication(B=Slider(60, range=0..100))
align_3 = AlignPlane(Plane=pl_3, Direction=rev_7)  # -> Plane, Angle
amp = Amplitude(Vector=deplane_10.XAxis, Amplitude=neg_2)
amp_2 = Amplitude(Vector=deplane_11.XAxis, Amplitude=neg_2)
division_2 = Division(A=multiplication_2, B=Slider(10, range=0..10))
move_speed_cm_m = Panel(division_2)
move_3 = Move(Geometry=item_2, Motion=amp)  # -> Geometry, Transform
move_4 = Move(Geometry=item_3, Motion=amp_2)  # -> Geometry, Transform
number_slider_5 = Slider(0, range=0..100)
ins = InsertItems(List=rev_6, Item=move_4.Geometry, Indices=number_slider_5, Wrap=True)
rev_8 = ReverseList(List=ins)
pt_9 = ConstructPoint(XCoordinate=0, YCoordinate=0, ZCoordinate=0)
ins_2 = InsertItems(List=rev_8, Item=move_3.Geometry, Indices=number_slider_5, Wrap=True)
number_slider_6 = Slider(100, range=0..1000)
xy_7 = XYPlane(Origin=pt_9)
tool_center_point_x = Panel("-19.5")
tool_center_point_y = Panel("0")
tool_center_point_z = Panel("164.8")
filter = StreamFilter(Gate=create_start_and_end_position_2, Stream0=toolpath_planes_2, Stream1=ins_2)
direction_arrow_length = Slider(5, range=0..100)
direction_arrow_radius = Slider(1, range=0..10)
cir = Circle(Plane=xy_7, Radius=Slider(9, range=0..100))
Z_8 = UnitZ(Factor=number_slider_6)
pln_6 = Plane(flatten(filter))
xy_8 = XYPlane(Origin=Point(0, 0, 0))
extr = Extrude(Base=cir, Direction=Z_8)
pln_7 = Plane(pln_6)
tool_center_point_x_2 = Panel(tool_center_point_x)
tool_center_point_y_2 = Panel(tool_center_point_y)
tool_center_point_z_2 = Panel(tool_center_point_z)
cap = CapHoles(Brep=extr)
deplane_12 = DeconstructPlane(Plane=pln_6)  # -> Origin, XAxis, YAxis, ZAxis
mesh_2 = MeshBrep(
    Brep=cap,
    Settings={GridMaxCount=0, GridMinCount=16, JaggedSeams=False, MaxEdgeLength=0, MinEdgeLength=0.0001, MinTolerance=0, Refine=True, RefineAngle=0, RelativeTolerance=0.65, SimplePlanes=True, Tolerance=0})
mesh_3 = Mesh(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)
mesh_4 = Mesh(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)
mesh_5 = Mesh(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)
mesh_6 = Mesh(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)
mesh_7 = Mesh(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)
mesh_8 = Mesh(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)
mesh_9 = Mesh(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)
mesh_10 = Mesh([<mesh referenced from the Rhino model> x11])
number_slider_7 = Slider(0, range=0..100)
scale = Scale(Center=Point(0, 0, 0), Factor=0.5)  # -> Geometry, Transform

direction_arrow_length_2 = Panel(direction_arrow_length)
direction_arrow_radius_2 = Panel(direction_arrow_radius)
toolpath_planes_3 = Plane(pln_7)
yz_5 = YZPlane(Origin=Point(0, 0, 0))
deplane_13 = DeconstructPlane(Plane=toolpath_planes_3)  # -> Origin, XAxis, YAxis, ZAxis
cone = Cone(Base=yz_5, Radius=direction_arrow_radius_2, Length=direction_arrow_length_2)  # -> Cone, Tip
pline_2 = PolyLine(Vertices=flatten(deplane_13.Origin), Closed=False)
neg_3 = Negative(Value=direction_arrow_length_2)
cp_5 = ControlPoints(Curve=pline_2)  # -> Points, Weights, Knots
X_6 = UnitX(Factor=neg_3)
number_slider_8 = Slider(0.001, range=0..1)
crv_cp = CurveClosestPoint(Point=cp_5.Points, Curve=pline_2)  # -> Point, Parameter, Distance
move_5 = Move(Geometry=cone.Cone, Motion=X_6)  # -> Geometry, Transform
addition = Addition(A=crv_cp.Parameter, B=Slider(0.5, range=0..1))
Z_9 = UnitZ(Factor=1)
frame = CurveFrame(Curve=pline_2, Parameter=addition)
jagged_2 = SettingsSpeed()
mesh_11 = MeshBrep(Brep=move_5.Geometry, Settings=jagged_2)
deplane_14 = DeconstructPlane(Plane=frame)  # -> Origin, XAxis, YAxis, ZAxis
item_4 = ListItem(List=cp_5.Points, Index=0, Wrap=True)
pl_4 = ConstructPlane(Origin=deplane_14.Origin, XAxis=deplane_14.XAxis, YAxis=Z_9)
xz_5 = XZPlane(Origin=Point(0, 0, 0))
xy_9 = XYPlane(Origin=item_4)
sph = Sphere(Base=xy_9, Radius=Slider(2, range=0..10))
orient_2 = Orient(Geometry=mesh_11, Source=xz_5, Target=pl_4)  # -> Geometry, Transform
swatch = ColourSwatch(SwatchColor=RGB(255, 0, 179))
material = CreateMaterial(Diffuse=swatch, Specular=RGB(255, 255, 255), Emission=swatch, Transparency=Slider(0.43, range=0..1), Shine=0)
material_2 = CreateMaterial(
    Diffuse=ColourSwatch(SwatchColor=RGB(0, 234, 255)),
    Specular=RGB(255, 255, 255),
    Emission=RGB(0, 0, 0),
    Transparency=Slider(0.359, range=0..1),
    Shine=0)
preview_2 = CustomPreview(Geometry=sph, Shader=material)
preview_3 = CustomPreview(Geometry=[orient_2.Geometry, pline_2, toolpath_planes_3], Shader=material_2)

kr150_2 = KUKAKR1502Series2000(kr150base=True, kr150l110=False)
custom_rob = CustomRobot(
    RobotBase=mesh_4,
    RobotJointBetweenA01AndA02=mesh_5,
    RobotJointBetweenA02AndA03=mesh_3,
    RobotJointBetweenA03AndA04=mesh_6,
    RobotJointBetweenA04AndA05=mesh_7,
    RobotJointBetweenA05AndA06=mesh_8,
    RobotFlangeEndeffector=mesh_9,
    a01length=530,
    a01offset=150,
    a02length=450,
    a03length=735,
    a03offset=115,
    a04length=95,
    valuesset=True)
tool_mesh = Mesh(mesh_2)
mjoin_2 = MeshJoin(Meshes=mesh_10)
timer = Timer(TimerInterval=20, Target=fader1)
amp_3 = Amplitude(Vector=deplane_12.YAxis, Amplitude=tool_center_point_y_2)
amp_4 = Amplitude(Vector=deplane_12.XAxis, Amplitude=tool_center_point_x_2)
amp_5 = Amplitude(Vector=deplane_12.ZAxis, Amplitude=tool_center_point_z_2)
tool = KUKAPrcCustomTool(
    CustomToolGeometry=mjoin_2,
    toolid=6,
    toolvala=0,
    toolvalb=0,
    toolvalc=0,
    toolvalx=0,
    toolvaly=0,
    toolvalz=0,
    valuesset=True)
pi = Pi(Factor=1)
pi_2 = Pi(Factor=1)
move_6 = Move(Geometry=deplane_12.Origin, Motion=amp_4)  # -> Geometry, Transform
pi_3 = Pi(Factor=1)
fader1 = FaderOneWay(
    Value1=Slider(0.01, range=0..0.01),
    Value2=Slider(0.914, range=0..1),
    FadeInterval=Slider(10000, range=0..10000),
    DelayOut=0)  # -> FadingOutput, LoopCounter
move_7 = Move(Geometry=move_6.Geometry, Motion=amp_3)  # -> Geometry, Transform
move_8 = Move(Geometry=move_7.Geometry, Motion=amp_5)  # -> Geometry, Transform
pl_5 = ConstructPlane(Origin=move_8.Geometry, XAxis=deplane_12.XAxis, YAxis=deplane_12.YAxis)
number_slider_9 = Slider(100, range=0..1000)
number_slider_10 = Slider(100, range=0..1000)
number_slider_11 = Slider(100, range=0..1000)
oriented_toolpath_planes = Plane(flatten(pln_6))
toolpath_planes_4 = Plane(flatten(oriented_toolpath_planes))
pln_8 = Plane(toolpath_planes_4)
deplane_15 = DeconstructPlane(Plane=pln_8)  # -> Origin, XAxis, YAxis, ZAxis
pdecon = Deconstruct(Point=deplane_15.Origin)  # -> XComponent, YComponent, ZComponent
deplane_16 = DeconstructPlane(Plane=pln_8)  # -> Origin, XAxis, YAxis, ZAxis
panel_2 = Panel(pdecon.YComponent)
panel_3 = Panel(pdecon.XComponent)
panel_4 = Panel(pdecon.ZComponent)
amp_6 = Amplitude(Vector=deplane_16.XAxis, Amplitude=number_slider_6)
rev_9 = Reverse(Vector=amp_6)
# A and B switched
orient_3 = Orient(Source=xy_8, Target=oriented_toolpath_planes)  # -> Geometry, Transform
move_9 = Move(Geometry=pln_8, Motion=rev_9)  # -> Geometry, Transform
c_script = CSharpScript(x=orient_3.Transform)  # -> out, A, B, C; inputs x: Transform
# ---------- c_script: C# ----------
    A = Math.Atan2(x.M21, x.M22);
    B = -Math.Atan2(x.M20, Math.Sqrt(x.M21 * x.M21 + x.M22 * x.M22));
    C = Math.Atan2(x.M10, x.M00);
# ---------- end c_script ----------
lin_move = KUKAPrcLinearMovement(Planes=toolpath_planes_4, interpolation="C_DIS", planeenabled=True)
addition_2 = Addition(A=c_script.B, B=pi)
addition_3 = Addition(A=c_script.C, B=pi_2)
addition_4 = Addition(A=c_script.A, B=pi_3)
deg = Degrees(Radians=c_script.A)
deg_2 = Degrees(Radians=addition_4)
deg_3 = Degrees(Radians=c_script.A)
deg_4 = Degrees(Radians=c_script.B)
deg_5 = Degrees(Radians=c_script.C)
kuka_prc_core = KUKAPrcCore(
    SimulationSlider=Slider(0.798, range=0..1),
    KUKAPrcCommand=flatten(lin_move),
    DefaultRobotTool=tool,
    VirtualRobot=custom_rob,
    a01end=5,
    a01max=70,
    a01min=-70,
    a01start=5,
    a02end=-90,
    a02max=360,
    a02min=-360,
    a02start=-90,
    a03end=100,
    a03max=360,
    a03min=-360,
    a03start=100,
    a04end=5,
    a04max=180,
    a04min=-180,
    a04start=5,
    a05end=10,
    a05max=180,
    a05min=-180,
    a05start=10,
    a06end=-5,
    a06max=360,
    a06min=-360,
    a06start=-5,
    abaseval=0,
    basenumber=6,
    bbaseval=0,
    cbaseval=0,
    checkendeffcoll=False,
    e01end=0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)  # -> RobotPositions, AnalysisOutput; disabled
panel_5 = Panel(deg_2)
panel_6 = Panel(deg)
multiplication_3 = Multiplication(A=deg_3, B=number_slider_9)
multiplication_4 = Multiplication(A=deg_4, B=number_slider_10)
multiplication_5 = Multiplication(A=deg_5, B=number_slider_11)
mesh_12 = Mesh(kuka_prc_core.RobotPositions)
round = Round(Number=multiplication_3)  # -> Nearest, Floor, Ceiling
round_2 = Round(Number=multiplication_4)  # -> Nearest, Floor, Ceiling
round_3 = Round(Number=multiplication_5)  # -> Nearest, Floor, Ceiling
medges = MeshEdges(Mesh=mesh_12)  # -> NakedEdges, InteriorEdges, NonManifoldEdges
division_3 = Division(A=round.Nearest, B=number_slider_9)
division_4 = Division(A=round_2.Nearest, B=number_slider_10)
division_5 = Division(A=round_3.Nearest, B=number_slider_11)
material_3 = CreateMaterial(
    Diffuse=ColourSwatch(SwatchColor=RGB(123, 158, 189)),
    Specular=RGB(255, 255, 255),
    Emission=ColourSwatch(SwatchColor=RGB(43, 75, 130)),
    Transparency=Slider(0.543, range=0..1),
    Shine=0)
line = Line(medges.InteriorEdges)
preview_4 = CustomPreview(Geometry=mesh_12, Shader=material_3)
lng = ListLength(List=division_3)
lng_2 = ListLength(List=division_3)
lng_3 = ListLength(List=division_3)
rz_overide = Panel("-90.00")
ry_overide = Panel("90.00")
rx_overide = Panel("-90.00")
pln_9 = Plane(oriented_toolpath_planes)
material_4 = CreateMaterial(
    Diffuse=ColourSwatch(SwatchColor=RGB(50, 53, 54)),
    Specular=RGB(255, 255, 255),
    Emission=RGB(0, 0, 0),
    Transparency=Slider(0.475, range=0..1),
    Shine=0)
dup = DuplicateData(Data=rz_overide, Number=lng, Order=True)
dup_2 = DuplicateData(Data=ry_overide, Number=lng_2, Order=True)
dup_3 = DuplicateData(Data=rx_overide, Number=lng_3, Order=True)
preview_5 = CustomPreview(Geometry=pln_9, Shader=material_4)
panel_8 = Panel(dup)
panel_9 = Panel(dup_2)
panel_10 = Panel(dup_3)
x_rotation = Panel(panel_10)
y_rotation = Panel(panel_9)
z_rotation = Panel(panel_8)
flatten_3 = FlattenTree(Tree=y_rotation, Path="{0}")
flatten_4 = FlattenTree(Tree=x_rotation, Path="{0}")
flatten_5 = FlattenTree(Tree=z_rotation, Path="{0}")

# ---- group: Orientation checker
deplane_17 = DeconstructPlane(Plane=oriented_toolpath_planes)  # -> Origin, XAxis, YAxis, ZAxis
pt_10 = Point(deplane_17.Origin)
xz_6 = XZPlane(Origin=pt_10)
yz_6 = YZPlane(Origin=pt_10)
xy_10 = XYPlane(Origin=pt_10)
xy_11 = XYPlane(Origin=pt_10)
rotate_6 = Rotate(Geometry=xy_11, Angle=degrees(flatten_4), Plane=yz_6)  # -> Geometry, Transform
number_slider_12 = Slider(5, range=0..10)
rotate_7 = Rotate(Geometry=rotate_6.Geometry, Angle=degrees(flatten_3), Plane=xz_6)  # -> Geometry, Transform
rotate_8 = Rotate(Geometry=rotate_7.Geometry, Angle=degrees(flatten_5), Plane=xy_10)  # -> Geometry, Transform
box = CenterBox(Base=rotate_8.Geometry, X=Slider(0.5, range=0..1), Y=Slider(2, range=0..10), Z=number_slider_12)
deplane_18 = DeconstructPlane(Plane=rotate_8.Geometry)  # -> Origin, XAxis, YAxis, ZAxis
amp_7 = Amplitude(Vector=deplane_18.ZAxis, Amplitude=number_slider_12)
move_10 = Move(Geometry=box, Motion=amp_7)  # -> Geometry, Transform

# ----
split = TextSplit(Text=flatten_3, Separators=".")
item_5 = ListItem(List=split, Index=0, Wrap=True)
item_6 = ListItem(List=split, Index="1", Wrap=True)
panel_11 = Panel(item_5)
panel_12 = Panel(item_6)
len = TextLength(Text=panel_12)
larger = LargerThan(FirstNumber=len, SecondNumber="1")  # -> LargerThan, OrEqualTo
dispatch_2 = Dispatch(List=panel_12, DispatchPattern=larger.LargerThan)  # -> ListA, ListB
flatten_6 = FlattenTree(Tree=dispatch_2.ListB, Path="{0}")
graft = GraftTree(Tree="0", IncludeEmptyLists=True, IncludeNullItems=True)
lng_4 = ListLength(List=flatten_6)
dup_4 = DuplicateData(Data="0", Number=lng_4, Order=True)
flatten_7 = FlattenTree(Tree=dup_4, Path="{0}")
flatten_8 = FlattenTree(Tree=dispatch_2.ListB, Path="{0}")
graft_2 = GraftTree(Tree=flatten_8, IncludeEmptyLists=True, IncludeNullItems=True)
graft_3 = GraftTree(Tree=flatten_7, IncludeEmptyLists=True, IncludeNullItems=True)
simplify = SimplifyTree(Tree=dispatch_2.ListA, Front=False)
join = TextJoin(Text=[graft_2, graft_3])
simplify_2 = SimplifyTree(Tree=larger.LargerThan, Front=False)
weave_2 = Weave(Pattern=flatten(simplify_2), Stream0=flatten(join), Stream1=flatten(simplify), NullGaps=False)
lng_5 = ListLength(List=flatten(panel_11))
panel_13 = Panel(weave_2)
panel_14 = Panel(panel_11)
dup_5 = DuplicateData(Data=".", Number=lng_5, Order=True)
flatten_9 = FlattenTree(Tree=panel_14, Path="{0}")
flatten_10 = FlattenTree(Tree=dup_5, Path="{0}")
flatten_11 = FlattenTree(Tree=panel_13, Path="{0}")
graft_4 = GraftTree(Tree=flatten_9, IncludeEmptyLists=True, IncludeNullItems=True)
graft_5 = GraftTree(Tree=flatten_10, IncludeEmptyLists=True, IncludeNullItems=True)
graft_6 = GraftTree(Tree=flatten_11, IncludeEmptyLists=True, IncludeNullItems=True)
join_2 = TextJoin(Text=[graft_4, graft_5, graft_6])
flatten_12 = FlattenTree(Tree=join_2, Path="{0}")
panel_15 = Panel(flatten_12)

split_2 = TextSplit(Text=flatten_5, Separators=".")
item_7 = ListItem(List=split_2, Index=0, Wrap=True)
item_8 = ListItem(List=split_2, Index="1", Wrap=True)
panel_16 = Panel(item_7)
panel_17 = Panel(item_8)
len_2 = TextLength(Text=panel_17)
larger_2 = LargerThan(FirstNumber=len_2, SecondNumber="1")  # -> LargerThan, OrEqualTo
dispatch_3 = Dispatch(List=panel_17, DispatchPattern=larger_2.LargerThan)  # -> ListA, ListB
flatten_13 = FlattenTree(Tree=dispatch_3.ListB, Path="{0}")
graft_7 = GraftTree(Tree="0", IncludeEmptyLists=True, IncludeNullItems=True)
lng_6 = ListLength(List=flatten_13)
dup_6 = DuplicateData(Data="0", Number=lng_6, Order=True)
flatten_14 = FlattenTree(Tree=dup_6, Path="{0}")
flatten_15 = FlattenTree(Tree=dispatch_3.ListB, Path="{0}")
graft_8 = GraftTree(Tree=flatten_15, IncludeEmptyLists=True, IncludeNullItems=True)
graft_9 = GraftTree(Tree=flatten_14, IncludeEmptyLists=True, IncludeNullItems=True)
simplify_3 = SimplifyTree(Tree=dispatch_3.ListA, Front=False)
join_3 = TextJoin(Text=[graft_8, graft_9])
simplify_4 = SimplifyTree(Tree=larger_2.LargerThan, Front=False)
weave_3 = Weave(Pattern=flatten(simplify_4), Stream0=flatten(join_3), Stream1=flatten(simplify_3), NullGaps=False)
lng_7 = ListLength(List=flatten(panel_16))
panel_18 = Panel(weave_3)
panel_19 = Panel(panel_16)
dup_7 = DuplicateData(Data=".", Number=lng_7, Order=True)
flatten_16 = FlattenTree(Tree=panel_19, Path="{0}")
flatten_17 = FlattenTree(Tree=dup_7, Path="{0}")
flatten_18 = FlattenTree(Tree=panel_18, Path="{0}")
graft_10 = GraftTree(Tree=flatten_16, IncludeEmptyLists=True, IncludeNullItems=True)
graft_11 = GraftTree(Tree=flatten_17, IncludeEmptyLists=True, IncludeNullItems=True)
graft_12 = GraftTree(Tree=flatten_18, IncludeEmptyLists=True, IncludeNullItems=True)
join_4 = TextJoin(Text=[graft_10, graft_11, graft_12])
flatten_19 = FlattenTree(Tree=join_4, Path="{0}")
panel_20 = Panel(flatten_19)

# ---- group: Create duble deciaml on every number
split_3 = TextSplit(Text=flatten_4, Separators=".")
item_9 = ListItem(List=split_3, Index=0, Wrap=True)
item_10 = ListItem(List=split_3, Index="1", Wrap=True)
panel_21 = Panel(item_9)
panel_22 = Panel(item_10)
len_3 = TextLength(Text=panel_22)
larger_3 = LargerThan(FirstNumber=len_3, SecondNumber="1")  # -> LargerThan, OrEqualTo
dispatch_4 = Dispatch(List=panel_22, DispatchPattern=larger_3.LargerThan)  # -> ListA, ListB
flatten_20 = FlattenTree(Tree=dispatch_4.ListB, Path="{0}")
graft_13 = GraftTree(Tree="0", IncludeEmptyLists=True, IncludeNullItems=True)
lng_8 = ListLength(List=flatten_20)
dup_8 = DuplicateData(Data="0", Number=lng_8, Order=True)
flatten_21 = FlattenTree(Tree=dup_8, Path="{0}")
flatten_22 = FlattenTree(Tree=dispatch_4.ListB, Path="{0}")
graft_14 = GraftTree(Tree=flatten_22, IncludeEmptyLists=True, IncludeNullItems=True)
graft_15 = GraftTree(Tree=flatten_21, IncludeEmptyLists=True, IncludeNullItems=True)
simplify_5 = SimplifyTree(Tree=dispatch_4.ListA, Front=False)
join_5 = TextJoin(Text=[graft_14, graft_15])
simplify_6 = SimplifyTree(Tree=larger_3.LargerThan, Front=False)
weave_4 = Weave(Pattern=flatten(simplify_6), Stream0=flatten(join_5), Stream1=flatten(simplify_5), NullGaps=False)
lng_9 = ListLength(List=flatten(panel_21))
panel_23 = Panel(weave_4)
panel_24 = Panel(panel_21)
dup_9 = DuplicateData(Data=".", Number=lng_9, Order=True)
flatten_23 = FlattenTree(Tree=panel_24, Path="{0}")
flatten_24 = FlattenTree(Tree=dup_9, Path="{0}")
flatten_25 = FlattenTree(Tree=panel_23, Path="{0}")
graft_16 = GraftTree(Tree=flatten_23, IncludeEmptyLists=True, IncludeNullItems=True)
graft_17 = GraftTree(Tree=flatten_24, IncludeEmptyLists=True, IncludeNullItems=True)
graft_18 = GraftTree(Tree=flatten_25, IncludeEmptyLists=True, IncludeNullItems=True)
join_6 = TextJoin(Text=[graft_16, graft_17, graft_18])
flatten_26 = FlattenTree(Tree=join_6, Path="{0}")
panel_25 = Panel(flatten_26)

# ----
lng_10 = ListLength(List=flatten(oriented_toolpath_planes))
series_3 = Series(Start=0, Step=1, Count=lng_10)
int = Integer(graft(series_3))
position_numbers = Panel(int)
number_of_digits_in_series = Panel("4")
len_4 = TextLength(Text=position_numbers)
subtraction_2 = Subtraction(A=number_of_digits_in_series, B=len_4)
number_slider_13 = Slider(0, range=0..100)
deplane_19 = DeconstructPlane(Plane=oriented_toolpath_planes)  # -> Origin, XAxis, YAxis, ZAxis
dup_10 = DuplicateData(Data=Slider(0, range=0..100), Number=subtraction_2, Order=True)
int_2 = Integer(dup_10)
number_slider_14 = Slider(1000, range=0..1000)
ins_3 = InsertItems(List=position_numbers, Item=int_2, Indices=number_slider_13, Wrap=True)
pdecon_2 = Deconstruct(Point=deplane_19.Origin)  # -> XComponent, YComponent, ZComponent
ins_4 = InsertItems(List=ins_3, Item="C", Indices=number_slider_13, Wrap=True)
multiplication_6 = Multiplication(A=pdecon_2.XComponent, B=number_slider_14)
multiplication_7 = Multiplication(A=pdecon_2.YComponent, B=number_slider_14)
multiplication_8 = Multiplication(A=pdecon_2.ZComponent, B=number_slider_14)
ins_5 = InsertItems(List="=", Item=ins_4, Indices=number_slider_13, Wrap=True)
round_4 = Round(Number=multiplication_6)  # -> Nearest, Floor, Ceiling
round_5 = Round(Number=multiplication_7)  # -> Nearest, Floor, Ceiling
round_6 = Round(Number=multiplication_8)  # -> Nearest, Floor, Ceiling
join_7 = TextJoin(Text=ins_5)
join_8 = TextJoin(Text=ins_4)
division_6 = Division(A=round_4.Nearest, B=number_slider_14)
division_7 = Division(A=round_5.Nearest, B=number_slider_14)
division_8 = Division(A=round_6.Nearest, B=number_slider_14)
simplify_7 = SimplifyTree(Tree=join_7, Front=False)
simplify_8 = SimplifyTree(Tree=join_8, Front=False)
panel_26 = Panel("""///TOOL 1
///POSTYPE ROBOT
///RECTAN
///RCONF 0,0,0,0,0""")
panel_27 = Panel("""/JOB
//NAME GHTEST4
//POS""")
panel_28 = Panel(simplify_7)
panel_29 = Panel(simplify_8)
x_cords = Panel(division_6)
y_cords = Panel(division_7)
z_cords = Panel(division_8)
number_of_positions = Panel(lng_10)
graft_19 = GraftTree(Tree=y_cords, IncludeEmptyLists=True, IncludeNullItems=True)
graft_20 = GraftTree(Tree=z_cords, IncludeEmptyLists=True, IncludeNullItems=True)
graft_21 = GraftTree(Tree=x_cords, IncludeEmptyLists=True, IncludeNullItems=True)
merge = Merge(Data1="///NPOS ", Data2=number_of_positions, Data3=",0,0,0,0,0")
join_9 = TextJoin(Text=merge)
graft_22 = GraftTree(Tree=panel_15, IncludeEmptyLists=True, IncludeNullItems=True)
merge_2 = Merge(Data1=panel_27, Data2=join_9, Data3=panel_26)
graft_23 = GraftTree(Tree=panel_20, IncludeEmptyLists=True, IncludeNullItems=True)
graft_24 = GraftTree(Tree=panel_25, IncludeEmptyLists=True, IncludeNullItems=True)
int_3 = Integer(move_speed_mm_s_2)
panel_30 = Panel(panel_29)
move_speed = Panel(int_3)
join_10 = TextJoin(Text=[graft_21, graft_19, graft_20, graft_24, graft_22, graft_23], Join=",")
simplify_9 = SimplifyTree(Tree=join_10, Front=False)
# Fix NPOS to reflect number of code lines
# http://www.robot-forum.com/robotforum/yaskawa-motoman-robot-forum/some-help-with-a-little-syntax-please/
# -fixed?
# 
# Remove RJ (realtive job) from ATTR?
panel_31 = Panel(simplify_9)
join_11 = TextJoin(Text=["SPEED V=", move_speed])
join_12 = TextJoin(Text=["V=", move_speed])
lng_11 = ListLength(List=flatten(panel_30))
panel_32 = Panel(join_12)
dup_11 = DuplicateData(Data=panel_32, Number=lng_11, Order=True)
dup_12 = DuplicateData(Data="MOVL", Number=lng_11, Order=True)
graft_25 = GraftTree(Tree=flatten(dup_11), IncludeEmptyLists=True, IncludeNullItems=True)
graft_26 = GraftTree(Tree=flatten(panel_30), IncludeEmptyLists=True, IncludeNullItems=True)
graft_27 = GraftTree(Tree=flatten(dup_12), IncludeEmptyLists=True, IncludeNullItems=True)
join_13 = TextJoin(Text=[graft_27, graft_26, graft_25], Join=" ")
flatten_27 = FlattenTree(Tree=join_13, Path="{0}")
lng_12 = ListLength(List=flatten_27)
subtraction_3 = Subtraction(A=lng_12, B="1")
panel_33 = Panel(subtraction_3)
use_putput_bollean_2 = Panel(use_putput_bollean)
join_14 = TextJoin(Text=[panel_28, panel_31])
ins_6 = InsertItems(List=flatten_27, Item=["DOUT OT#(121) ON", "DOUT OT#(121) OFF"], Indices=["2", panel_33], Wrap=True)
panel_34 = Panel(ins_6)
filter_2 = StreamFilter(Gate=use_putput_bollean_2, Stream0=flatten_27, Stream1=panel_34)
panel_35 = Panel(join_14)
time = Time("now")
# Reference start code: /JOB
# //NAME MOTOTEST1
# //POS
# ///NPOS 17,0,0,0,0,0
# ///TOOL 1
# ///POSTYPE ROBOT
# ///RECTAN
# ///RCONF 0,0,0,0,0,0,0,0
panel_36 = Panel(merge_2)
panel_37 = Panel(filter_2)
# //INST
# ///DATE 2015/05/22 15:03
# ///ATTR SC,RW,RJ
# ////FRAME ROBOT
# ///GROUP1 RB1
# NOP
panel_38 = Panel("""//INST
///DATE 2015/05/22 15:03
///ATTR SC,RW,RJ
////FRAME ROBOT
///GROUP1 RB1
NOP""")
merge_3 = Merge(Data1=flatten(panel_36), Data2=flatten(panel_35), Data3=flatten(panel_38), Data5=flatten(panel_37), Data6=flatten("END"))
panel_39 = Panel(merge_3)
# DOUT OT#(1) ON
# DOUT OT#(1) OFF
# PULSE OT#(XX)
# PULSE OT#(2) T=0.500
# WAIT IN#(5)=OFF
panel_40 = Panel(merge_3)
jbi_toolpath_code_guide_from_web = Panel("""http://www.robot-forum.com/robotforum/yaskawa-motoman-robot-forum/some-help-with-a-little-syntax-please/

I found the info on the Relative Job Manual, here is the whole info.

JOB DATA FORMAT

When a relative job is output via the YASNAC FC1 or FC2 or by data transmission, the output file contents are as follows.

FILE NAME .JBI
/JOB
//NAME <JOB NAME>
//POS
///NPOS <C>,<BC>,<EC>,<P>,<BP>,<EX>
///USER <N>
///TOOL <N>
///POSTYPE <T>
///RECTAN
///RCONF <l>,<m>,<n>,<o>,<p>,<q>
Cxxxx =X,Y,Z,Rx,Ry,Rz
BCxxxx=X0,Y0,Z0
ECxxxx=1,2
//INST
///DATE <YYYY>/<MM>/<DD> <HH>:<TT>
///COMM <COMMENT CHARACTER LINE>
///ATTR <ATTRIBUTE 1>,<ATTRIBUTE 2>,,<ATTRIBUTE 16>
///FRAME <C>
///GROUP1 <m1>,<m2>,<m3>
///GROUP2 <m1>,<m2>,<m3>
NOP
MOVJ Cxxx BCxxx ECxxx VJ=xxx.x
END



A pseudo instruction is distinguished by a single slash (/) at its beginning.
Each level of individual instructions are marked with a double slash (//), a triple slash (///), and a fourfold slash (////).
A pseudo instruction related to the job is made as follows.

JOB NAME
POS
INST
NPOS
USER
TOOL
POSTYPE
PULSE
RECTAN
RCONF
DATE
COMM
ATTR
FRAME
GROUP1
GROUP2
LVARS


JOB

Function : Shows that it is a job.
Format : /JOB


NAME

Function : Represents the job name.
Format : //NAME <Name>
<Name> : up to 8 characters


POS

Function : Represents the position data.
Format : //POS


NPOS

Function : Represents the number of position data items.
Format : ///NPOS <C>,<BC>,<EC>,<P>,<BP>,<EX>
<C> : Number of robot axis teaching positions
<BC>: Number of base axis teaching positions
<EC>: Number of external (station) axis teaching positions
<P> : Number of robot axis position variables
<BP>: Number of base axis position variables
<EX>: Number of external (station) axis position variables


USER

Function : Represents the currently selected user coordinate system No.
Format : ///USER <N>
<N>: User coordinate system No.(0 to 23)


TOOL

Function : Represents the currently selected tool No.
Format : ///TOOL <N>
<N>: Tool No.(0 to 23)


POSTYPE

Function : Represents the position data type.
Format : ///POSTYPE<T>
<T>: |PULSE||BASE||ROBOT||TOOL||USER||MTOOL|
<PULSE>: Pulse data
<BASE> : Cartesian data, base coordinate system
<ROBOT>: Cartesian data, robot coordinate system
<TOOL> : Cartesian data, tool coordinate system
<USER> : Cartesian data, user coordinate system
<MTOOL>: Cartesian data, master tool coordinate system


PULSE

Function : Represents that pulse data is defined during and after this pseudo instruction.
Format : ///PULSE
<Pulse data>:<C>|<BC>|<EC>|<P>|<BP>|<EX>
<C>:<Cxxxx>=<S>,<L>,<U>,<R>,<B>,<T>,<E1>,<E2>
<BC>:<BCxxxx>=<1>,<2>,<3>,<4>,<5>,<6>,<E1>,<E2>
<EC>:<ECxxxx>=<1>,<2>,<3>,<4>,<5>,<6>,<E1>,<E2>
<P>:<Pxxx>=<S>,<L>,<U>,<R>,<B>,<T>,<E1>,<E2>
<BP>:<BPxxx>=<1>,<2>,<3>,<4>,<5>,<6>,<E1>,<E2>
<EX>:<EXxxx>=<1>,<2>,<3>,<4>,<5>,<6>,<E1>,<E2>
<Cxxxx>: Robot axis teaching position
<BCxxxx>: Base axis teaching position
<ECxxxx>: External (station) axis teaching position
<Pxxx>: Robot axis position variables
<BPxxx>: Base axis position variables
<EXxxx>: External (station) axis position variables
<S>: S-axis pulse data
<L>: L-axis pulse data
<U>: U-axis pulse data
<R>: R-axis pulse data
<B>: B-axis pulse data
<T>: T-axis pulse data
<E1>: Not used
<E2>: Not used
xxxx := A number from 0 to 999


RECTAN

Function : Represents that Cartesian data is defined during and after this pseudo instruction.
Format : ///RECTAN
<Cartesian data>: <C>|<BC>|<P>|<BP>
<C> : <Cxxxx> = <X>,<Y>,<Z>,<Rx>,<Ry>,<Rz>
<BC>: <BCxxxx> = <1>,<2>,<3>,<4>,<5>,<6>
<P> : <Pxxx> = <X>,<Y>,<Z>,<Rx>,<Ry>,<Rz>
<BP>: <BPxxx> = <1>,<2>,<3>,<4>,<5>,<6>
<Cxxxx> : Robot axis teaching position
<BCxxxx>: Base axis teaching position
<Pxxx> : Robot axis position variables
<BPxxx> : Base axis position variables
<X> : X-axis Cartesian data
<Y> : Y-axis Cartesian data
<Z> : Z-axis Cartesian data
<Rx> : Rx-axis Cartesian data
<Ry> : Ry-axis Cartesian data
<Rz> : Rz-axis Cartesian data


RCONF

Function : Represents the manipulator type of the Cartesian data defined during and after this pseudo instruction.
Format : ///RCONF <l>,<m>,<n>,<o>,<p>,<q>
<l>: 0: Flip, 1: No-flip
<m>: 0: Upper arm, 1: Lower arm
<n>: 0: Front, 1: Rear
<o>: 0: R < 180, 1: R >= 180
<p>: 0: T < 180, 1: T >= 180
<q>: 0: S < 180, 1: S >= 180


INST

Function : Represents that it is an instruction.
Format : //INST


DATE

Function : Represents the date.
Format : ///DATE <YYYY>/<MM>/<DD> <HH>:<TT>
<YYYY>: Year
<MM>: Month
<DD>: Day
<HH>: Hour
<TT>: Minute


COMM

Function : Represents that it is a job comment.
Format : ///COMM <Comment character line>
<Comment character line> : Up to 32 characters


ATTR

Function : Represents the job attribute.
Format : ///ATTR <Attribute 1>,<Attribute 2>,,<Attribute16>
<Attribute>: JD|DD|SC|{RO|WO|RW}|RJ
<JD>: Job Destroy
<DD>: Directory Destroy
<SC>: Save Complete
{RO|WO|RW}
<RO>: Writing disabled “Edit-lock”(Read Only)
<WO>: Reading disabled(Write Only)
<RW>: Reading/Writing capable(Read/Write)
<RJ>: Relative job


FRAME

Function : Represents relative job teaching coordinate system.
Format : ///FRAME <C>
<C>: BASE|ROBOT|N|
<N>: User coordinate system No.(1 to 24)
<BASE>: Base coordinate system(Cartesian)
<ROBOT>: Robot coordinate system(Cartesian)
<USER>: User coordinate system(Cartesian)


GROUP1

Function : Represents 1st MOVE control group.
Format : ///GROUP1 <m1>,<m2>,<m3>
Add any of the following to<m1>,<m2>, and<m3>.
RE1(robot 1)
RE2(robot 2)
RE2(robot 3)
RE4(robot 4)
BS1(base 1)
BS2(base 2)
BS3(base 3)
BS4(base 4)
ST1(station 1)
ST2(station 2)
ST3(station 3)
ST4(station 4)
ST5(station 5)
ST6(station 6)
ST7(station 7)
ST8(station 8)
ST9(station 9)
ST10(station 10)
ST11(station 11)
ST12(station 12)


GROUP2

Function : Represents 2nd MOVE control group.
Format : ///GROUP2 <m1>,<m2>,<m3>
Add any of the following to<m1>,<m2>, and<m3>.
RE1(robot 1)
RE2(robot 2)
RE3(robot 3)
RE4(robot 4)
BS1(base 1)
BS2(base 2)
BS3(base 3)
BS4(base 4)
ST1(station 1)
ST2(station 2)
ST3(station 3)
ST4(station 4)
ST5(station 5)
ST6(station 6)
ST7(station 7)
ST8(station 8)
ST9(station 9)
ST10(station 10)
ST11(station 11)
ST12(station 12)


GROUP3

Function : Represents 3rd MOVE control group.
Format : ///GROUP3 <m1>,<m2>,<m3>
Add any of the following to<m1>,<m2>, and<m3>.
RE1(robot 1)
RE2(robot 2)
RE3(robot 3)
RE4(robot 4)
BS1(base 1)
BS2(base 2)
BS3(base 3)
BS4(base 4)
ST1(station 1)
ST2(station 2)
ST3(station 3)
ST4(station 4)
ST5(station 5)
ST6(station 6)
ST7(station 7)
ST8(station 8)
ST9(station 9)
ST10(station 10)
ST11(station 11)
ST12(station 12)


GROUP4

Function : Represents 4th MOVE control group.
Format : ///GROUP4 <m1>,<m2>,<m3>
Add any of the following to<m1>,<m2>, and<m3>.
RE1(robot 1)
RE2(robot 2)
RE3(robot 3)
RE4(robot 4)
BS1(base 1)
BS2(base 2)
BS3(base 3)
BS4(base 4)
ST1(station 1)
ST2(station 2)
ST3(station 3)
ST4(station 4)
ST5(station 5)
ST6(station 6)
ST7(station 7)
ST8(station 8)
ST9(station 9)
ST10(station 10)
ST11(station 11)
ST12(station 12)


LVARS

Function : Represents the number of local variables.
Format : ///LVARS <LB>,<LI>,<LD>,<LR>,<LS>,<LP>,<LBP>,<LEX>
<LB>: Number of byte type local variables
<LI>: Number of integer type local variables
<LD>: Number of double-precision type local variables
<LR>: Number of real number type local variables
<LS>: Number of character type local variables
<LP>: Number of robot axis position type local variables
<LBP>: Number of base axis position type local variables
<LEX>: Number of external (station) axis position type local variables""")
lng_13 = ListLength(List=panel_40)
code_length = Panel(lng_13)
